# Grasshopper definition 01-Voxelize.gh (Grasshopper 1.0.7)
# Copyright: ©2019 GNU General Public License

# ---- group: Base Plane
xy = XYPlane(Origin=Point(0, 0, 0))
rad = Radians(Degrees=Slider(45, range=0..360))
rad_2 = Radians(Degrees=Slider(45, range=0..360))
rotate = Rotate(Geometry=xy, Angle=rad_2, Plane=xy)  # -> Geometry, Transform
xz = XZPlane(Origin=Point(0, 0, 0))
rotate_2 = Rotate(Geometry=rotate.Geometry, Angle=rad, Plane=xz)  # -> Geometry, Transform

# ---- group: Geometry
cyl = Cylinder(Base=PlaneXY(0, 0, 0), Radius="10", Length="10")
msphere = MeshSphere(Base=PlaneXY(0, 0, 0), Radius="10", UCount=10, VCount=20)
cap = CapHoles(Brep=cyl)
item = ListItem(List=[msphere, cap], Index=Slider(1, range=0..1), Wrap=True)
preview = CustomPreview(Geometry=item, Material=ColourSwatch(SwatchColor=RGBA(0, 0, 0, 117)))

# ---- group: Voxelize (parameter)
range = Range(Domain=Domain(0, 1), Steps=Slider(10, range=0..10))
range_2 = Range(Domain=Domain(0, 1), Steps=Slider(10, range=0..10))
range_3 = Range(Domain=Domain(0, 1), Steps=Slider(10, range=0..10))
graph = GraphMapper(
    range,
    x0=0,
    x1=1,
    y0=0,
    y1=1,
    container_name="Bezier",
    cpx=[0, 0.1130437404, 0.8184120059, 1],
    cpy=[0, 0.4992905259, 0.4266634583, 1])
graph_2 = GraphMapper(
    range_2,
    x0=0,
    x1=1,
    y0=0,
    y1=1,
    container_name="Bezier",
    cpx=[0, 0.1318841428, 0.7695652843, 1],
    cpy=[0, 0.4964538813, 0.4283685088, 1])
graph_3 = GraphMapper(
    range_3,
    x0=0,
    x1=1,
    y0=0,
    y1=1,
    container_name="Bezier",
    cpx=[0, 0.2115942985, 0.7764883637, 1],
    cpy=[0, 0.5128570795, 0.3069961667, 1])
vp = CrystallonV2VoxelizeParameter(
    geometry=item,
    plane=rotate_2.Geometry,
    x_parameter=graph_3,
    y_parameter=graph_2,
    z_parameter=graph,
    fill_completely=Toggle(False))

# ---- group: Voxelize (distance)
vd = CrystallonV2VoxelizeDistance(
    geometry=item,
    plane=rotate_2.Geometry,
    voxel_size_x=Slider(1.87, range=0..10),
    voxel_size_y=Slider(1.84, range=0..10),
    voxel_size_z=Slider(1.524, range=0..10),
    fill_completely=Toggle(True))

# ==== cluster CrystallonV2VoxelizeDistance: Fill a volume with equal sized voxels

voxel_size_x = ClusterInput()  # Voxel size int the X direction
voxel_size_y = ClusterInput()  # Voxel size int the Y direction
voxel_size_z = ClusterInput()  # Voxel size int the Z direction
plane = ClusterInput()  # Base plane for voxels
geometry = ClusterInput()  # Geometry to voxelize
fill_completely = ClusterInput()  # If true, Voxels will fill entire volume. If false, only Voxels with their centroid within the volume will be kept.
mesh = Mesh(geometry)
pln = Plane(plane)
num = Number(voxel_size_x)
num_2 = Number(voxel_size_y)
num_3 = Number(voxel_size_z)
bool = Boolean(fill_completely)
bbox = BoundingBox(Content=mesh, Plane=pln)  # -> Box, Box_2
edges = BrepEdges(Brep=bbox.Box)  # -> Naked, Interior, NonManifold
item = ListItem(List=edges.Interior, Index="8", Wrap=True)
item_2 = ListItem(List=edges.Interior, Index="1", Wrap=True)
# CRYSTALLON V2.0 -- Lattice structure tools for Grasshopper3D
# 
# Copyright (C) 2019  Aaron Porterfield
# 
# www.fequalsf.com
# info@fequalsf.com
# 
#     This program is free software: you can redistribute it and/or modify
#     it under the terms of the GNU General Public License as published by
#     the Free Software Foundation, either version 3 of the License, or any later version.
# 
#     This program is distributed in the hope that it will be useful,
#     but WITHOUT ANY WARRANTY; without even the implied warranty of
#     MERCHANTABILITY or FITNESS FOR A PARTICULAR PURPOSE.  See the
#     GNU General Public License for more details.
# 
#     You should have received a copy of the GNU General Public License
#     along with this program.  If not, see <http://www.gnu.org/licenses/>.
item_3 = ListItem(List=edges.Interior, Index="0", Wrap=True)
divlength = DivideLength(Curve=reparameterize(item_2), Length=num_2)  # -> Points, Tangents, Parameters
divlength_2 = DivideLength(Curve=reparameterize(item_3), Length=num)  # -> Points, Tangents, Parameters
divlength_3 = DivideLength(Curve=reparameterize(item), Length=num_3)  # -> Points, Tangents, Parameters
reldif = RelativeDifferences(Values=divlength.Parameters)
reldif_2 = RelativeDifferences(Values=divlength_2.Parameters)
reldif_3 = RelativeDifferences(Values=divlength_3.Parameters)
item_4 = ListItem(List=reverse(divlength.Parameters), Index=0, Wrap=True)
item_5 = ListItem(List=reverse(reldif), Index=0, Wrap=True)
item_6 = ListItem(List=reverse(divlength_2.Parameters), Index=0, Wrap=True)
item_7 = ListItem(List=reverse(reldif_2), Index=0, Wrap=True)
item_8 = ListItem(List=reverse(divlength_3.Parameters), Index=0, Wrap=True)
item_9 = ListItem(List=reverse(reldif_3), Index=0, Wrap=True)
addition = Addition(A=item_5, B=item_4)
addition_2 = Addition(A=item_7, B=item_6)
addition_3 = Addition(A=item_9, B=item_8)
merge = Merge(Data1=divlength.Parameters, Data2=addition)
merge_2 = Merge(Data1=divlength_2.Parameters, Data2=addition_2)
merge_3 = Merge(Data1=divlength_3.Parameters, Data2=addition_3)
crossref = CrossReference(ListA=merge, ListB=merge_3, CrossMode=1)  # -> ListA, ListB
box = EvaluateBox(Box=bbox.Box, UParameter=graft(merge_2), VParameter=crossref.ListA, WParameter=crossref.ListB)  # -> Plane, Point, Include
panel = Panel("Voxelize")
division = Division(A=num_3, B="2")
division_2 = Division(A=num_2, B="2")
division_3 = Division(A=num, B="2")
neg = Negative(Value=division)
neg_2 = Negative(Value=division_2)
neg_3 = Negative(Value=division_3)
dom = ConstructDomain(DomainStart=neg, DomainEnd=division)
dom_2 = ConstructDomain(DomainStart=neg_2, DomainEnd=division_2)
dom_3 = ConstructDomain(DomainStart=neg_3, DomainEnd=division_3)
crossref_2 = CrossReference(ListA=dom_2, ListB=dom, CrossMode=1)  # -> ListA, ListB
box_2 = DomainBox(Base=simplify(box.Plane), X=graft(dom_3), Y=crossref_2.ListA, Z=crossref_2.ListB)
minc = MeshInclusion(Mesh=mesh, Point=box.Plane, Strict=False)
sort = SortList(Keys=[num, num_2, num_3])  # -> Keys, ValuesA
cull = CullPattern(List=box_2, CullPattern=minc)
meshcp = MeshClosestPoint(Point=box.Plane, Mesh=mesh)  # -> Point, Index, Parameter
dist = Distance(PointA=box.Plane, PointB=meshcp.Point)
expression = Expression(a=sort.Keys, d=dist, Expression="if(d<sqrt(2*(a/2)^2),True,False)")
cull_2 = CullPattern(List=box_2, CullPattern=expression)
cull_3 = CullPattern(List=cull_2, CullPattern=bool)
merge_4 = Merge(Data1=cull, Data2=cull_3)
voxels = ClusterOutput(merge_4)  # Voxels to be filled with unit cells

# ==== cluster CrystallonV2VoxelizeParameter: Fill a volume with varying sized voxels

plane = ClusterInput()  # Base plane for voxels
geometry = ClusterInput()  # Geometry to voxelize
x_parameter = ClusterInput()  # Range of numbers (0-1) for X divisions of the bounding box
y_parameter = ClusterInput()  # Range of numbers (0-1) for Y divisions of the bounding box
z_parameter = ClusterInput()  # Range of numbers (0-1) for Z divisions of the bounding box
fill_completely = ClusterInput()  # If true, Voxels will fill entire volume. If false, only Voxels with their centroid within the volume will be kept.
mesh = Mesh(geometry)
pln = Plane(plane)
num = Number(y_parameter)
bool = Boolean(fill_completely)
num_2 = Number(x_parameter)
num_3 = Number(z_parameter)
bbox = BoundingBox(Content=mesh, Plane=pln)  # -> Box, Box_2
edges = BrepEdges(Brep=bbox.Box)  # -> Naked, Interior, NonManifold
crossref = CrossReference(ListA=num, ListB=num_3, CrossMode=1)  # -> ListA, ListB
item = ListItem(List=edges.Interior, Index="8", Wrap=True)
toggle = BooleanToggle(False)
toggle_2 = BooleanToggle(True)
item_2 = ListItem(List=edges.Interior, Index="1", Wrap=True)
item_3 = ListItem(List=edges.Interior, Index="0", Wrap=True)
box = EvaluateBox(Box=bbox.Box, UParameter=graft(num_2), VParameter=crossref.ListA, WParameter=crossref.ListB)  # -> Plane, Point, Include
len = Length(Curve=item_2)
len_2 = Length(Curve=item_3)
len_3 = Length(Curve=item)
dom = ConstructDomain(DomainStart=0, DomainEnd=len)
dom_2 = ConstructDomain(DomainStart=0, DomainEnd=len_2)
dom_3 = ConstructDomain(DomainStart=0, DomainEnd=len_3)
remap = RemapNumbers(Value=num, Source=Domain(0, 1), Target=dom)  # -> Mapped, Clipped
remap_2 = RemapNumbers(Value=num_2, Source=Domain(0, 1), Target=dom_2)  # -> Mapped, Clipped
remap_3 = RemapNumbers(Value=num_3, Source=Domain(0, 1), Target=dom_3)  # -> Mapped, Clipped
shift = ShiftList(List=remap.Mapped, Shift="-1", Wrap=toggle)
shift_2 = ShiftList(List=remap.Mapped, Shift="1", Wrap=toggle)
shift_3 = ShiftList(List=remap_2.Mapped, Shift="-1", Wrap=toggle)
shift_4 = ShiftList(List=remap_2.Mapped, Shift="1", Wrap=toggle)
shift_5 = ShiftList(List=remap_3.Mapped, Shift="-1", Wrap=toggle)
shift_6 = ShiftList(List=remap_3.Mapped, Shift="1", Wrap=toggle)
subtraction = Subtraction(A=shift_2, B=shift)
subtraction_2 = Subtraction(A=shift_4, B=shift_3)
subtraction_3 = Subtraction(A=shift_6, B=shift_5)
division = Division(A=subtraction, B="2")
division_2 = Division(A=subtraction_2, B="2")
division_3 = Division(A=subtraction_3, B="2")
shift_7 = ShiftList(List=division, Shift="1", Wrap=toggle_2)
neg = Negative(Value=division)
neg_2 = Negative(Value=division_2)
shift_8 = ShiftList(List=division_2, Shift="1", Wrap=toggle_2)
shift_9 = ShiftList(List=division_3, Shift="1", Wrap=toggle_2)
neg_3 = Negative(Value=division_3)
panel = Panel("VOXELIZE (parameter)")
dom_4 = ConstructDomain(DomainStart=neg, DomainEnd=division)
dom_5 = ConstructDomain(DomainStart=neg, DomainEnd=shift_7)
dom_6 = ConstructDomain(DomainStart=neg_2, DomainEnd=division_2)
dom_7 = ConstructDomain(DomainStart=neg_2, DomainEnd=shift_8)
dom_8 = ConstructDomain(DomainStart=neg_3, DomainEnd=division_3)
dom_9 = ConstructDomain(DomainStart=neg_3, DomainEnd=shift_9)
rev = ReverseList(List=dom_4)
rev_2 = ReverseList(List=dom_6)
shift_10 = ShiftList(List=dom_5, Shift="-1", Wrap=toggle)
shift_11 = ShiftList(List=dom_7, Shift="-1", Wrap=toggle)
rev_3 = ReverseList(List=dom_8)
item_4 = ListItem(List=dom_4, Index=0, Wrap=True)
shift_12 = ShiftList(List=dom_9, Shift="-1", Wrap=toggle)
item_5 = ListItem(List=dom_6, Index=0, Wrap=True)
item_6 = ListItem(List=rev, Index=0, Wrap=True)
item_7 = ListItem(List=rev_2, Index=0, Wrap=True)
item_8 = ListItem(List=dom_8, Index=0, Wrap=True)
item_9 = ListItem(List=rev_3, Index=0, Wrap=True)
entwine = Entwine(Branch00=item_4, Branch01=shift_10, Branch02=item_6, FlattenInputs=True)  # -> flatten(Result)
entwine_2 = Entwine(Branch00=item_5, Branch01=shift_11, Branch02=item_7, FlattenInputs=True)  # -> flatten(Result)
entwine_3 = Entwine(Branch00=item_8, Branch01=shift_12, Branch02=item_9, FlattenInputs=True)  # -> flatten(Result)
sort = SortList(Keys=flatten([subtraction_3, subtraction, subtraction_2]))  # -> Keys, ValuesA
crossref_2 = CrossReference(ListA=entwine, ListB=entwine_3, CrossMode=1)  # -> ListA, ListB
rev_4 = ReverseList(List=sort.Keys)
box_2 = DomainBox(Base=simplify(box.Plane), X=graft(entwine_2), Y=crossref_2.ListA, Z=crossref_2.ListB)
item_10 = ListItem(List=rev_4, Index=0, Wrap=True)
minc = MeshInclusion(Mesh=mesh, Point=box.Plane, Strict=False)
cull = CullPattern(List=box_2, CullPattern=minc)
meshcp = MeshClosestPoint(Point=box.Plane, Mesh=mesh)  # -> Point, Index, Parameter
dist = Distance(PointA=box.Plane, PointB=meshcp.Point)
expression = Expression(a=item_10, d=dist, Expression="if(d<sqrt(2*(a/2)^2),True,False)")
cull_2 = CullPattern(List=box_2, CullPattern=expression)
cull_3 = CullPattern(List=cull_2, CullPattern=bool)
merge = Merge(Data1=cull, Data2=cull_3)
voxels = ClusterOutput(merge)  # Voxels to be filled with unit cells
