# Grasshopper definition 02-Morph Between Surfaces.gh (Grasshopper 1.0.7)
# Copyright: ©2019 GNU General Public License

# ---- group: Geometry
srf = Surface([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])
srf_2 = Surface([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])
entwine = Entwine(Branch00=srf, Branch01=srf_2, FlattenInputs=True)  # -> simplify(Result)
branch = TreeBranch(Tree=entwine, Path=Slider(1, range=0..1), MaintainPaths=True)
preview = CustomPreview(Geometry=branch, Material=ColourSwatch(SwatchColor=RGBA(0, 0, 0, 117)))

# ---- group: MBS with a graph
range = Range(Domain=Domain(0, 1), Steps=Slider(10, range=0..10))
range_2 = Range(Domain=Domain(0, 1), Steps=Slider(10, range=0..10))
range_3 = Range(Domain=Domain(0, 1), Steps=Slider(4, range=0..10))
graph = GraphMapper(
    range_3,
    x0=0,
    x1=1,
    y0=0,
    y1=1,
    container_name="Bezier",
    cpx=[0, 0.2242108732, 0.633417964, 1],
    cpy=[0, 0.6393870115, 0.8030695915, 1])
graph_2 = GraphMapper(range_2, x0=0, x1=1, y0=0, y1=1, container_name="Bezier", cpx=[0, 0.25, 0.75, 1], cpy=[0, 0.25, 0.75, 1])
graph_3 = GraphMapper(
    range,
    x0=0,
    x1=1,
    y0=0,
    y1=1,
    container_name="Bezier",
    cpx=[0, 0.4697349668, 0.4492749274, 1],
    cpy=[0, 0.1636834741, 0.7297531366, 1])
mbs = CrystallonV2MorphBetweenSurfaces(surfaces=branch, x_parameter=graph_2, y_parameter=graph_3, z_parameter=graph)

# ---- group: MBS with equal distances
range_4 = Range(Domain=Domain(0, 1), Steps=Slider(10, range=0..10))
range_5 = Range(Domain=Domain(0, 1), Steps=Slider(5, range=0..10))
range_6 = Range(Domain=Domain(0, 1), Steps=Slider(10, range=0..10))
mbs_2 = CrystallonV2MorphBetweenSurfaces(surfaces=branch, x_parameter=range_4, y_parameter=range_6, z_parameter=range_5)

# ==== cluster CrystallonV2MorphBetweenSurfaces: Conformal fill of voxels between two or more surfaces

x_parameter = ClusterInput()  # Range of numbers (0-1) for X divisions
z_parameter = ClusterInput()  # Range of numbers (0-1) for Z divisions
surfaces = ClusterInput()  # At least 2 surfaces to morph voxels between
y_parameter = ClusterInput()  # Range of numbers (0-1) for Y divisions
srf = Surface(flatten(surfaces))
num = Number(y_parameter)
num_2 = Number(x_parameter)
num_3 = Number(z_parameter)
pt = ConstructPoint(XCoordinate=simplify(graft(num_2)), YCoordinate=simplify(num), ZCoordinate=0)  # -> simplify(Point)
lng = ListLength(List=num_2)
num_4 = Number(lng)
# CRYSTALLON V2.0 -- Lattice structure tools for Grasshopper3D
# 
# Copyright (C) 2019  Aaron Porterfield
# 
# www.fequalsf.com
# info@fequalsf.com
# 
#     This program is free software: you can redistribute it and/or modify
#     it under the terms of the GNU General Public License as published by
#     the Free Software Foundation, either version 3 of the License, or any later version.
# 
#     This program is distributed in the hope that it will be useful,
#     but WITHOUT ANY WARRANTY; without even the implied warranty of
#     MERCHANTABILITY or FITNESS FOR A PARTICULAR PURPOSE.  See the
#     GNU General Public License for more details.
# 
#     You should have received a copy of the GNU General Public License
#     along with this program.  If not, see <http://www.gnu.org/licenses/>.
evalsrf = EvaluateSurface(Surface=reparameterize(simplify(srf)), Point=simplify(graft(pt)))  # -> simplify(Point), Normal, Frame
pline = PolyLine(Vertices=evalsrf.Point, Closed=False)
eval = EvaluateCurve(Curve=reparameterize(pline), Parameter=num_3)  # -> Point, Tangent, Angle
path_mapper = PathMapper(eval.Point, source="{A;B}(i)", target="{B;A}(i)")
path_mapper_2 = PathMapper(path_mapper, source="{A;B}", target="{path_index}")
toggle = BooleanToggle(False)
shift = ShiftList(List=path_mapper_2, Shift="1", Wrap=toggle)
shift_2 = ShiftList(List=path_mapper_2, Shift="-1", Wrap=toggle)
flip = FlipMatrix(Data=shift)
flip_2 = FlipMatrix(Data=shift_2)
partition = PartitionList(List=flip_2, Size=num_4)
partition_2 = PartitionList(List=flip, Size=num_4)
shift_3 = ShiftList(List=partition, Shift="-1", Wrap=toggle)  # -> simplify(List)
shift_4 = ShiftList(List=partition, Shift="1", Wrap=toggle)  # -> simplify(List)
shift_5 = ShiftList(List=partition_2, Shift="1", Wrap=toggle)  # -> simplify(List)
shift_6 = ShiftList(List=partition_2, Shift="-1", Wrap=toggle)  # -> simplify(List)
path_mapper_3 = PathMapper(shift_4, source="{A;B}(i)", target="{A;i}(B)")
path_mapper_4 = PathMapper(shift_3, source="{A;B}(i)", target="{A;i}(B)")
path_mapper_5 = PathMapper(shift_5, source="{A;B}(i)", target="{A;i}(B)")
path_mapper_6 = PathMapper(shift_6, source="{A;B}(i)", target="{A;i}(B)")
shift_7 = ShiftList(List=path_mapper_4, Shift="-1", Wrap=toggle)
shift_8 = ShiftList(List=path_mapper_3, Shift="1", Wrap=toggle)
shift_9 = ShiftList(List=path_mapper_3, Shift="-1", Wrap=toggle)
shift_10 = ShiftList(List=path_mapper_6, Shift="-1", Wrap=toggle)
shift_11 = ShiftList(List=path_mapper_4, Shift="1", Wrap=toggle)
shift_12 = ShiftList(List=path_mapper_5, Shift="1", Wrap=toggle)
shift_13 = ShiftList(List=path_mapper_5, Shift="-1", Wrap=toggle)
shift_14 = ShiftList(List=path_mapper_6, Shift="1", Wrap=toggle)
tbox = TwistedBox(
    CornerA=shift_11,
    CornerB=shift_7,
    CornerC=shift_9,
    CornerD=shift_8,
    CornerE=shift_14,
    CornerF=shift_10,
    CornerG=shift_13,
    CornerH=shift_12)
voxels = ClusterOutput(tbox)  # Voxels to be filled with unit cells
