# Grasshopper definition 03-Conformal Ribs and Pipes.gh (Grasshopper 1.0.7)
# Copyright: ©2019 GNU General Public License

# ---- group: Geometry
brep = Brep(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)
crv = Curve(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)
crv_2 = Curve(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)
item = ListItem(List=[crv, crv_2], Index=Slider(0, range=0..1), Wrap=True)
preview = CustomPreview(Geometry=[brep, item], Material=ColourSwatch(SwatchColor=RGBA(0, 0, 0, 117)))

# ---- group: Conformal Pipe (parameter)
number_slider = Slider(200, range=0..200)
range = Range(Domain=Domain(0, 1), Steps=number_slider)
range_2 = Range(Domain=Domain(0, 1), Steps=number_slider)
range_3 = Range(Domain=Domain(0, 1), Steps=number_slider)
dom = ConstructDomain(DomainStart=Slider(0.165, range=0..1), DomainEnd=Slider(0.048, range=0..1))
dom_2 = ConstructDomain(DomainStart=Slider(0.265, range=0..1), DomainEnd=Slider(0.065, range=0..1))
graph = GraphMapper(
    range_2,
    x0=0,
    x1=1,
    y0=0,
    y1=1,
    container_name="Bezier",
    cpx=[0, 0.6350871921, 0.3377101719, 1],
    cpy=[0, 0.07623201609, 0.8762171865, 1])
graph_2 = GraphMapper(
    range,
    x0=0,
    x1=1,
    y0=0,
    y1=1,
    container_name="Bezier",
    cpx=[0, 0.1718842834, 0.398550719, 1],
    cpy=[0, 0.6324639916, 0.8985507488, 1])
graph_3 = GraphMapper(
    range_3,
    x0=0,
    x1=1,
    y0=0,
    y1=1,
    container_name="Bezier",
    cpx=[0, 0.6350871921, 0.3377101719, 1],
    cpy=[0, 0.07623201609, 0.8762171865, 1])
cpp = CrystallonV2ConformalPipeParameter(
    geometry=brep,
    curve=item,
    periodic=Toggle(False),
    division_paramter=graph_2,
    distance=Slider(0, range=-1..1),
    radius_paramter=graph_3,
    radius_domain=dom_2,
    thickness_paramter=graph,
    thickness_domain=dom,
    rotation=Slider(45, range=0..360),
    sides=Slider(6, range=0..10))

# ---- group: Conformal Rib (parameter)
number_slider_2 = Slider(200, range=0..200)
range_4 = Range(Domain=Domain(0, 1), Steps=number_slider_2)
range_5 = Range(Domain=Domain(0, 1), Steps=number_slider_2)
range_6 = Range(Domain=Domain(0, 1), Steps=number_slider_2)
dom_3 = ConstructDomain(DomainStart=Slider(0.709, range=0..1), DomainEnd=Slider(0.197, range=0..1))
dom_4 = ConstructDomain(DomainStart=Slider(0.926, range=0..1), DomainEnd=Slider(0.095, range=0..1))
graph_4 = GraphMapper(
    range_6,
    x0=0,
    x1=1,
    y0=0,
    y1=1,
    container_name="Bezier",
    cpx=[0, 0.06047168747, 0.8654205799, 1],
    cpy=[0, 0.5462429523, 0.3798058629, 1])
graph_5 = GraphMapper(
    range_5,
    x0=0,
    x1=1,
    y0=0,
    y1=1,
    container_name="Bezier",
    cpx=[0, 0.6350871921, 0.3377101719, 1],
    cpy=[0, 0.07623201609, 0.8762171865, 1])
graph_6 = GraphMapper(
    range_4,
    x0=0,
    x1=1,
    y0=0,
    y1=1,
    container_name="Bezier",
    cpx=[0, 0.1333332956, 0.3652175665, 1],
    cpy=[0, 0.4695651531, 0.8811594844, 1])
crp = CrystallonV2ConformalRibParameter(
    geometry=brep,
    curve=item,
    periodic=Toggle(False),
    division_paramter=graph_6,
    height_paramter=graph_5,
    height_domain=dom_3,
    width_paramter=graph_4,
    width_domain=dom_4)

# ---- group: Conformal Pipe (distance)
cpd = CrystallonV2ConformalPipeDistance(
    geometry=brep,
    curve=item,
    periodic=Toggle(False),
    length=Slider(0.389, range=0..3),
    distance=Slider(0, range=-1..1),
    radius=Slider(0.12, range=0..1),
    thickness=Slider(0.177, range=0..1),
    rotation=Slider(45, range=0..360),
    sides=Slider(4, range=0..10))

# ---- group: Conformal Rib (distance)
crd = CrystallonV2ConformalRibDistance(
    geometry=brep,
    curve=item,
    periodic=Toggle(True),
    length=Slider(0.263, range=0..1),
    height=Slider(0.25, range=0..1),
    width=Slider(0.25, range=0..1))

# ==== cluster CrystallonV2ConformalRibDistance: Create a row of equal length voxels along a cuve on a surface (mesh or brep).

curve = ClusterInput()  # Curve to voxelize
geometry = ClusterInput()  # Geometry to conform to
periodic = ClusterInput()  # Is curve closed? (Boolean)
length = ClusterInput()  # Length of Voxels
height = ClusterInput()  # Voxel Height
width = ClusterInput()  # Voxel Width
crv = Curve(reparameterize(curve))
num = Number(length)
bool = Boolean(periodic)
geo = Geometry(geometry)
num_2 = Number(height)
num_3 = Number(width)
# CRYSTALLON V2.0 -- Lattice structure tools for Grasshopper3D
# 
# Copyright (C) 2019  Aaron Porterfield
# 
# www.fequalsf.com
# info@fequalsf.com
# 
#     This program is free software: you can redistribute it and/or modify
#     it under the terms of the GNU General Public License as published by
#     the Free Software Foundation, either version 3 of the License, or any later version.
# 
#     This program is distributed in the hope that it will be useful,
#     but WITHOUT ANY WARRANTY; without even the implied warranty of
#     MERCHANTABILITY or FITNESS FOR A PARTICULAR PURPOSE.  See the
#     GNU General Public License for more details.
# 
#     You should have received a copy of the GNU General Public License
#     along with this program.  If not, see <http://www.gnu.org/licenses/>.
divide = DivideCurve(Curve=reparameterize(crv), Count="2000", Kinks=False)  # -> Points, Tangents, Parameters
intcrv = Interpolate(Vertices=divide.Points, Degree=3, Periodic=False, KnotStyle=1)  # -> Curve, Length, Domain
divdist = DivideDistance(Curve=reparameterize(intcrv.Curve), Distance=num)  # -> Points, Tangents, Parameters
ins = InsertItems(List=reverse(divdist.Parameters), Item="0", Indices="0", Wrap=Toggle(True))  # -> reverse(List)
entwine = Entwine(Branch00=divdist.Parameters, Branch01=ins, FlattenInputs=True)  # -> simplify(Result)
branch = TreeBranch(Tree=entwine, Path=bool, MaintainPaths=True)
mesh = Mesh(geo)
pframe = PerpFrame(Curve=reparameterize(intcrv.Curve), Parameter=branch)
pln = Plane(pframe)
meshcp = MeshClosestPoint(Point=pln, Mesh=mesh)  # -> Point, Index, Parameter
deplane = DeconstructPlane(Plane=pln)  # -> Origin, XAxis, YAxis, ZAxis
meval = MeshEval(Mesh=mesh, Parameter=meshcp.Parameter)  # -> Point, Normal, Colour
panel = Panel("Conformal Rib Distance")
line = LineSDL(Start=deplane.Origin, Direction=meval.Normal, Length="10")
line_2 = LineSDL(Start=deplane.Origin, Direction=deplane.XAxis, Length="10")
division = Division(A=num_3, B="2")
angle = Angle(VectorA=line_2, VectorB=line, Plane=pln)  # -> Angle, Reflex
neg = Negative(Value=division)
prot = RotatePlane(Plane=pln, Angle=angle.Angle)
dom = ConstructDomain(DomainStart=neg, DomainEnd=division)
rectangle = Rectangle(Plane=prot, XSize=num_2, YSize=dom, Radius=0)  # -> Rectangle, Length
disc = Discontinuity(Curve=rectangle.Rectangle, Level=1)  # -> simplify(Points), Parameters
toggle = BooleanToggle(False)
flip = FlipMatrix(Data=disc.Points)
shift = ShiftList(List=flip, Shift="-1", Wrap=toggle)
shift_2 = ShiftList(List=flip, Shift="1", Wrap=toggle)
flip_2 = FlipMatrix(Data=shift)
flip_3 = FlipMatrix(Data=shift_2)
item = ListItem(List=flip_2, Index="1", Wrap=True)
item_2 = ListItem(List=flip_3, Index="1", Wrap=True)
item_3 = ListItem(List=flip_2, Index="0", Wrap=True)
item_4 = ListItem(List=flip_2, Index="3", Wrap=True)
item_5 = ListItem(List=flip_3, Index="3", Wrap=True)
item_6 = ListItem(List=flip_2, Index="2", Wrap=True)
item_7 = ListItem(List=flip_3, Index="2", Wrap=True)
item_8 = ListItem(List=flip_3, Index="0", Wrap=True)
tbox = TwistedBox(
    CornerA=item_3,
    CornerB=item,
    CornerC=item_6,
    CornerD=item_4,
    CornerE=item_8,
    CornerF=item_2,
    CornerG=item_7,
    CornerH=item_5)
voxels = ClusterOutput(tbox)  # Voxels to be filled with unit cells

# ==== cluster CrystallonV2ConformalRibParameter: Create a row of varying length voxels along a cuve on a surface

width_paramter = ClusterInput()  # Parameter for Voxel width (0-1)
height_domain = ClusterInput()  # Domain of Voxel Height (Domain)
height_paramter = ClusterInput()  # Parameter for Voxel Height (0-1)
geometry = ClusterInput()  # Geometry to conform to
curve = ClusterInput()  # Curve to voxelize
periodic = ClusterInput()  # Is curve closed? (Boolean)
division_paramter = ClusterInput()  # Parameter for Voxel Divisions (0-1)
width_domain = ClusterInput()  # Domain of Voxel Width (Domain)
crv = Curve(reparameterize(curve))
bool = Boolean(periodic)
domain = Domain(height_domain)
num = Number(height_paramter)
geo = Geometry(geometry)
num_2 = Number(division_paramter)
num_3 = Number(width_paramter)
domain_2 = Domain(width_domain)
lng = ListLength(List=num_2)
multiplication = Multiplication(A=lng, B="2")
divide = DivideCurve(Curve=reparameterize(crv), Count=multiplication, Kinks=False)  # -> Points, Tangents, Parameters
intcrv = Interpolate(Vertices=divide.Points, Degree=3, Periodic=bool, KnotStyle=1)  # -> Curve, Length, Domain
mesh = Mesh(geo)
pframe = PerpFrame(Curve=reparameterize(intcrv.Curve), Parameter=num_2)
pln = Plane(pframe)
meshcp = MeshClosestPoint(Point=pln, Mesh=mesh)  # -> Point, Index, Parameter
remap = RemapNumbers(Value=num_3, Source=Domain(0, 1), Target=domain_2)  # -> Mapped, Clipped
remap_2 = RemapNumbers(Value=num, Source=Domain(0, 1), Target=domain)  # -> Mapped, Clipped
meval = MeshEval(Mesh=mesh, Parameter=meshcp.Parameter)  # -> Point, Normal, Colour
deplane = DeconstructPlane(Plane=pln)  # -> Origin, XAxis, YAxis, ZAxis
division = Division(A=remap.Mapped, B="2")
neg = Negative(Value=division)
panel = Panel("Surface Conformal Ribs")
dom = ConstructDomain(DomainStart="0", DomainEnd=remap_2.Mapped)
line = LineSDL(Start=deplane.Origin, Direction=meval.Normal, Length="10")
line_2 = LineSDL(Start=deplane.Origin, Direction=deplane.XAxis, Length="10")
dom_2 = ConstructDomain(DomainStart=neg, DomainEnd=division)
angle = Angle(VectorA=line_2, VectorB=line, Plane=pln)  # -> Angle, Reflex
prot = RotatePlane(Plane=pln, Angle=angle.Angle)
rectangle = Rectangle(Plane=prot, XSize=dom, YSize=dom_2, Radius=0)  # -> Rectangle, Length
disc = Discontinuity(Curve=rectangle.Rectangle, Level=1)  # -> simplify(Points), Parameters
toggle = BooleanToggle(False)
flip = FlipMatrix(Data=disc.Points)
shift = ShiftList(List=flip, Shift="-1", Wrap=toggle)
shift_2 = ShiftList(List=flip, Shift="1", Wrap=toggle)
flip_2 = FlipMatrix(Data=shift)
flip_3 = FlipMatrix(Data=shift_2)
item = ListItem(List=flip_2, Index="1", Wrap=True)
item_2 = ListItem(List=flip_3, Index="1", Wrap=True)
item_3 = ListItem(List=flip_2, Index="0", Wrap=True)
item_4 = ListItem(List=flip_2, Index="3", Wrap=True)
item_5 = ListItem(List=flip_3, Index="3", Wrap=True)
item_6 = ListItem(List=flip_2, Index="2", Wrap=True)
item_7 = ListItem(List=flip_3, Index="2", Wrap=True)
item_8 = ListItem(List=flip_3, Index="0", Wrap=True)
tbox = TwistedBox(
    CornerA=item_3,
    CornerB=item,
    CornerC=item_6,
    CornerD=item_4,
    CornerE=item_8,
    CornerF=item_2,
    CornerG=item_7,
    CornerH=item_5)
voxels = ClusterOutput(tbox)  # Voxels to be filled with unit cells

# ==== cluster CrystallonV2ConformalPipeDistance: Create a pipe of equal length voxels along a cuve on a surface.

geometry = ClusterInput()  # Geometry to conform to
curve = ClusterInput()  # Curve to voxelize
length = ClusterInput()  # Length of Voxels
periodic = ClusterInput()  # Is curve closed? (Boolean)
thickness = ClusterInput()  # Thickness of pipe (number)
distance = ClusterInput()  # Distance from surface (number)
radius = ClusterInput()  # Inner radius of pipe (number)
rotation = ClusterInput()  # Rotation in degrees (number)
sides = ClusterInput()  # Number of sides of pipe (number)
crv = Curve(reparameterize(curve))
num = Number(distance)
num_2 = Number(length)
num_3 = Number(thickness)
bool = Boolean(periodic)
num_4 = Number(radius)
num_5 = Number(rotation)
geo = Geometry(geometry)
num_6 = Number(sides)
divide = DivideCurve(Curve=crv, Count="2000", Kinks=False)  # -> Points, Tangents, Parameters
intcrv = Interpolate(Vertices=divide.Points, Degree=3, Periodic=False, KnotStyle=1)  # -> Curve, Length, Domain
divdist = DivideDistance(Curve=reparameterize(intcrv.Curve), Distance=num_2)  # -> Points, Tangents, Parameters
ins = InsertItems(List=reverse(divdist.Parameters), Item="0", Indices="0", Wrap=Toggle(True))  # -> reverse(List)
entwine = Entwine(Branch00=divdist.Parameters, Branch01=ins, FlattenInputs=True)  # -> simplify(Result)
branch = TreeBranch(Tree=entwine, Path=bool, MaintainPaths=True)
mesh = Mesh(geo)
pframe = PerpFrame(Curve=reparameterize(intcrv.Curve), Parameter=branch)
pln = Plane(pframe)
meshcp = MeshClosestPoint(Point=pln, Mesh=mesh)  # -> Point, Index, Parameter
deplane = DeconstructPlane(Plane=pln)  # -> Origin, XAxis, YAxis, ZAxis
meval = MeshEval(Mesh=mesh, Parameter=meshcp.Parameter)  # -> Point, Normal, Colour
panel = Panel("Conformal Pipe Distance")
line = LineSDL(Start=deplane.Origin, Direction=deplane.XAxis, Length="10")
line_2 = LineSDL(Start=deplane.Origin, Direction=meval.Normal, Length="10")
angle = Angle(VectorA=line, VectorB=line_2, Plane=pln)  # -> Angle, Reflex
prot = RotatePlane(Plane=pln, Angle=angle.Angle)
amp = Amplitude(Vector=meval.Normal, Amplitude=num)
move = Move(Geometry=prot, Motion=amp)  # -> Geometry, Transform
rad = Radians(Degrees=num_5)
prot_2 = RotatePlane(Plane=move.Geometry, Angle=rad)
polygon = Polygon(Plane=prot_2, Radius=num_4, Segments=num_6, FilletRadius=0)  # -> Polygon, Length
offset = Offset(Curve=polygon.Polygon, Distance=num_3, Plane=prot_2, Corners=1)
disc = Discontinuity(Curve=offset, Level=1)  # -> simplify(Points), Parameters
disc_2 = Discontinuity(Curve=polygon.Polygon, Level=1)  # -> simplify(Points), Parameters
toggle = BooleanToggle(False)
toggle_2 = BooleanToggle(True)
flip = FlipMatrix(Data=disc_2.Points)
flip_2 = FlipMatrix(Data=disc.Points)
shift = ShiftList(List=flip, Shift="1", Wrap=toggle)
shift_2 = ShiftList(List=flip_2, Shift="-1", Wrap=toggle)
shift_3 = ShiftList(List=flip, Shift="-1", Wrap=toggle)
shift_4 = ShiftList(List=flip_2, Shift="1", Wrap=toggle)
flip_3 = FlipMatrix(Data=shift)
flip_4 = FlipMatrix(Data=shift_2)
flip_5 = FlipMatrix(Data=shift_4)
flip_6 = FlipMatrix(Data=shift_3)
shift_5 = ShiftList(List=flip_5, Shift="1", Wrap=toggle_2)
shift_6 = ShiftList(List=flip_4, Shift="1", Wrap=toggle_2)
shift_7 = ShiftList(List=flip_3, Shift="1", Wrap=toggle_2)
shift_8 = ShiftList(List=flip_6, Shift="1", Wrap=toggle_2)
tbox = TwistedBox(
    CornerA=flip_4,
    CornerB=shift_6,
    CornerC=shift_5,
    CornerD=flip_5,
    CornerE=flip_6,
    CornerF=shift_8,
    CornerG=shift_7,
    CornerH=flip_3)
voxels = ClusterOutput(tbox)  # Voxels to be filled with unit cells

# ==== cluster CrystallonV2ConformalPipeParameter: Create a pipe of varying length and size voxels along a cuve on a surface.

geometry = ClusterInput()  # Geometry to conform to
curve = ClusterInput()  # Curve to voxelize
division_paramter = ClusterInput()  # Parameter for Voxel Divisions (0-1)
periodic = ClusterInput()  # Is curve closed? (Boolean)
radius_paramter = ClusterInput()  # Parameter for pipe radius (0-1)
radius_domain = ClusterInput()  # Domain of pipe radius (Domain)
distance = ClusterInput()  # Distance from surface (number)
thickness_paramter = ClusterInput()  # Parameter for pipe thickness (0-1)
rotation = ClusterInput()  # Rotation in degrees (number)
thickness_domain = ClusterInput()  # Domain of pipe thickness (Domain)
sides = ClusterInput()  # Number of sides of pipe (number)
crv = Curve(reparameterize(curve))
bool = Boolean(periodic)
num = Number(division_paramter)
num_2 = Number(distance)
num_3 = Number(radius_paramter)
geo = Geometry(geometry)
domain = Domain(radius_domain)
num_4 = Number(rotation)
num_5 = Number(thickness_paramter)
num_6 = Number(sides)
domain_2 = Domain(thickness_domain)
lng = ListLength(List=num)
multiplication = Multiplication(A=lng, B="2")
divide = DivideCurve(Curve=crv, Count=multiplication, Kinks=False)  # -> Points, Tangents, Parameters
intcrv = Interpolate(Vertices=divide.Points, Degree=3, Periodic=bool, KnotStyle=1)  # -> Curve, Length, Domain
pframe = PerpFrame(Curve=reparameterize(intcrv.Curve), Parameter=num)
mesh = Mesh(geo)
pln = Plane(pframe)
meshcp = MeshClosestPoint(Point=pln, Mesh=mesh)  # -> Point, Index, Parameter
deplane = DeconstructPlane(Plane=pln)  # -> Origin, XAxis, YAxis, ZAxis
meval = MeshEval(Mesh=mesh, Parameter=meshcp.Parameter)  # -> Point, Normal, Colour
panel = Panel("Conformal Pipe Parameter")
line = LineSDL(Start=deplane.Origin, Direction=deplane.XAxis, Length="10")
line_2 = LineSDL(Start=deplane.Origin, Direction=meval.Normal, Length="10")
angle = Angle(VectorA=line, VectorB=line_2, Plane=pln)  # -> Angle, Reflex
prot = RotatePlane(Plane=pln, Angle=angle.Angle)
amp = Amplitude(Vector=meval.Normal, Amplitude=num_2)
move = Move(Geometry=prot, Motion=amp)  # -> Geometry, Transform
rad = Radians(Degrees=num_4)
remap = RemapNumbers(Value=num_3, Source=Domain(0, 1), Target=domain)  # -> Mapped, Clipped
remap_2 = RemapNumbers(Value=num_5, Source=Domain(0, 1), Target=domain_2)  # -> Mapped, Clipped
prot_2 = RotatePlane(Plane=move.Geometry, Angle=rad)
polygon = Polygon(Plane=prot_2, Radius=remap.Mapped, Segments=num_6, FilletRadius=0)  # -> Polygon, Length
offset = Offset(Curve=polygon.Polygon, Distance=remap_2.Mapped, Plane=prot_2, Corners=1)
disc = Discontinuity(Curve=offset, Level=1)  # -> simplify(Points), Parameters
disc_2 = Discontinuity(Curve=polygon.Polygon, Level=1)  # -> simplify(Points), Parameters
toggle = BooleanToggle(False)
toggle_2 = BooleanToggle(True)
flip = FlipMatrix(Data=disc_2.Points)
flip_2 = FlipMatrix(Data=disc.Points)
shift = ShiftList(List=flip, Shift="1", Wrap=toggle)
shift_2 = ShiftList(List=flip_2, Shift="-1", Wrap=toggle)
shift_3 = ShiftList(List=flip, Shift="-1", Wrap=toggle)
shift_4 = ShiftList(List=flip_2, Shift="1", Wrap=toggle)
flip_3 = FlipMatrix(Data=shift)
flip_4 = FlipMatrix(Data=shift_2)
flip_5 = FlipMatrix(Data=shift_4)
flip_6 = FlipMatrix(Data=shift_3)
shift_5 = ShiftList(List=flip_5, Shift="1", Wrap=toggle_2)
shift_6 = ShiftList(List=flip_4, Shift="1", Wrap=toggle_2)
shift_7 = ShiftList(List=flip_3, Shift="1", Wrap=toggle_2)
shift_8 = ShiftList(List=flip_6, Shift="1", Wrap=toggle_2)
tbox = TwistedBox(
    CornerA=flip_4,
    CornerB=shift_6,
    CornerC=shift_5,
    CornerD=flip_5,
    CornerE=flip_6,
    CornerF=shift_8,
    CornerG=shift_7,
    CornerH=flip_3)
voxels = ClusterOutput(tbox)  # Voxels to be filled with unit cells
