# Grasshopper definition 04-Surface and Mesh Offsets.gh (Grasshopper 1.0.7)
# Copyright: ©2019 GNU General Public License
# plug-ins: MeshEdit Components

# ---- group: Values
num = Number([0.03488666615, 0.1295493118, 0.3711908701, 0.8253842965, 0.9711280908, 0.996658631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])
pt = Point([Point(9.761250496, 9.304861069, 0.003232037416), Point(9.761250496, 8.928796768, 0.01555832318), Point(9.761250496, 8.552731991, 0.05350505933), Point(9.761250496, 8.176667213, 0.1301953159), Point(9.761250496, 7.800602674, 0.2553061955), Point(9.761250496, 7.424538136, 0.4352336079)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])
gradient = Gradient(LowerLimit=0, UpperLimit=1, Parameter=num, stops=[0: RGB(255, 255, 255), 1: RGB(0, 0, 0)])
preview = CustomPreview(Geometry=pt, Material=gradient)

# ---- group: Geometry
number_slider = Slider(50, range=0..100)
srf = Surface(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)
sdivide = DivideSurface(Surface=srf, UCount=number_slider, VCount=number_slider)  # -> Points, Normals, Parameters
addition = Addition(A=number_slider, B=1)
frompoints = MeshFromPoints(Points=flatten(sdivide.Points), UDirection=addition, VDirection=addition)
preview_2 = CustomPreview(Geometry=srf, Material=ColourSwatch(SwatchColor=RGBA(0, 0, 0, 103)))

# ---- group: Attractors
crv = Curve([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])
preview_3 = CustomPreview(Geometry=crv, Material=ColourSwatch(SwatchColor=RGBA(0, 0, 0, 103)))

# ---- group: Mesh Offset (value)
range = Range(Domain=Domain(0, 1), Steps=Slider(1, range=0..10))
mov = CrystallonV2MeshOffsetValue(
    mesh=frompoints,
    triangulated=Toggle(False),
    points=pt,
    values=num,
    distance_influence=Toggle(False),
    influence=Slider(0, range=0..1),
    magnitude_min=Slider(0.132, range=0..1),
    magnitude_max=Slider(0.624, range=0..1),
    z_parameter=range)  # -> voxels, quad_meshes

# ---- group: Mesh Offset
range_2 = Range(Domain=Domain(0, 1), Steps=Slider(1, range=0..10))
mop = CrystallonV2MeshOffestParameter(mesh=frompoints, triangulated=Toggle(False), distance=Slider(0.25, range=0..1), z_parameter=range_2)  # -> voxels, quad_meshes

# ---- group: Surface Offset (value)
number_slider_2 = Slider(50, range=0..100)
sov = CrystallonV2SurfaceOffsetValue(
    surface=srf,
    resolution_u=number_slider_2,
    resolution_v=number_slider_2,
    points=pt,
    values=num,
    distance_influence=Toggle(False),
    influence=Slider(0.024, range=0..1),
    magnitude_min=Slider(0.25, range=0..1),
    magnitude_max=Slider(1, range=0..1))

# ----
range_3 = Range(Domain=Domain(0, 1), Steps=Slider(1, range=0..10))
moa = CrystallonV2MeshOffsetAttractor(
    mesh=frompoints,
    triangulated=Toggle(False),
    attractor=crv,
    lower_limit=Slider(0, range=0..1),
    influence=Slider(0.948, range=0..1),
    magnitude_min=Slider(0.776, range=0..1),
    magnitude_max=Slider(0.093, range=0..1),
    z_parameter=range_3)  # -> voxels, quad_meshes

# ---- group: Surface Offset (attractor)
number_slider_3 = Slider(85, range=0..100)
soa = CrystallonV2SurfaceOffsetAttractor(
    surface=srf,
    resolution_u=number_slider_3,
    resolution_v=number_slider_3,
    attractor=crv,
    lower_limit=Slider(0, range=0..1),
    influence=Slider(0.721, range=0..1),
    magnitude_min=Slider(0.776, range=0..1),
    magnitude_max=Slider(0.093, range=0..1))

# ==== cluster CrystallonV2SurfaceOffsetValue: Offset a surface with a point cloud and corrosponding values

resolution_v = ClusterInput()  # Resolution of points in V direction
surface = ClusterInput()  # Surface to offset
resolution_u = ClusterInput()  # Resolution of points in U direction
points = ClusterInput()  # List of points (flattened)
magnitude_max = ClusterInput()  # Magnitude of the offset (maximum value)
influence = ClusterInput()  # Smoothed range of attractor influence (0-1)
values = ClusterInput()  # Values that correspond to points (flattened)
magnitude_min = ClusterInput()  # Magnitude of the offset (minimum value)
distance_influence = ClusterInput()  # If true the distance between the points and voxels will affect the magnitude
# CRYSTALLON V2.0 -- Lattice structure tools for Grasshopper3D
# 
# Copyright (C) 2019  Aaron Porterfield
# 
# www.fequalsf.com
# info@fequalsf.com
# 
#     This program is free software: you can redistribute it and/or modify
#     it under the terms of the GNU General Public License as published by
#     the Free Software Foundation, either version 3 of the License, or any later version.
# 
#     This program is distributed in the hope that it will be useful,
#     but WITHOUT ANY WARRANTY; without even the implied warranty of
#     MERCHANTABILITY or FITNESS FOR A PARTICULAR PURPOSE.  See the
#     GNU General Public License for more details.
# 
#     You should have received a copy of the GNU General Public License
#     along with this program.  If not, see <http://www.gnu.org/licenses/>.
sdivide = DivideSurface(Surface=surface, UCount=resolution_u, VCount=resolution_v)  # -> Points, Normals, Parameters
pt = Point(points)
num = Number(values)
bnd = Bounds(Numbers=num)
dom = ConstructDomain(DomainStart=magnitude_min, DomainEnd=magnitude_max)
cp = ClosestPoint(Point=sdivide.Points, Cloud=pt)  # -> ClosestPoint, CPIndex, Distance
remap = RemapNumbers(Value=num, Source=bnd, Target=dom)  # -> Mapped, Clipped
expression = Expression(x=influence, y=cp.Distance, Expression="-1*e^(-x*y)")
item = ListItem(List=remap.Mapped, Index=cp.CPIndex, Wrap=True)
panel = Panel("SURFACE OFFSET VALUE")
bnd_2 = Bounds(Numbers=flatten(expression))
remap_2 = RemapNumbers(Value=expression, Source=bnd_2, Target="1 to 0")  # -> Mapped, Clipped
not = GateNot(A=distance_influence)
multiplication = Multiplication(A=item, B=remap_2.Mapped)
cull = CullPattern(List=item, CullPattern=not)
cull_2 = CullPattern(List=multiplication, CullPattern=distance_influence)
amp = Amplitude(Vector=sdivide.Normals, Amplitude=[cull_2, cull])
move = Move(Geometry=sdivide.Points, Motion=amp)  # -> Geometry, Transform
srfgrid = SurfaceFromPoints(Points=flatten(move.Geometry), UCount=expr("x+1", resolution_u), Interpolate=False)
offest_surface = ClusterOutput(srfgrid)  # Offset Surface

# ==== cluster CrystallonV2SurfaceOffsetAttractor: Offset a surface with attractor(s)

lower_limit = ClusterInput()  # Smoothing of the surface closest to the attractor
attractor = ClusterInput()  # Any geometry to use as attractor(s)
magnitude_min = ClusterInput()  # Magnitude of the offset (minimum value)
magnitude_max = ClusterInput()  # Magnitude of the offset (maximum value)
resolution_v = ClusterInput()  # Resolution of points in V direction
surface = ClusterInput()  # Surface to offset
resolution_u = ClusterInput()  # Resolution of points in U direction
influence = ClusterInput()  # Smoothed range of attractor influence (0-1)
geo = Geometry(attractor)
num = Number(resolution_v)
num_2 = Number(lower_limit)
num_3 = Number(resolution_u)
num_4 = Number(influence)
srf = Surface(surface)
num_5 = Number(magnitude_min)
num_6 = Number(magnitude_max)
series = Series(Start=0, Step=1, Count=expr("x+1", num))
series_2 = Series(Start=0, Step=1, Count=expr("x+1", num_3))
sdivide = DivideSurface(Surface=srf, UCount=num_3, VCount=num)  # -> Points, Normals, Parameters
crossref = CrossReference(ListA=graft(series_2), ListB=series, CrossMode=1)  # -> ListA, ListB
panel = Panel("SURFACE OFFSET ATTRACTOR")
pull = PullPoint(Point=sdivide.Points, Geometry=geo, ClosestOnly=True)  # -> ClosestPoint, Distance
smaller = SmallerThan(FirstNumber=pull.Distance, SecondNumber=num_2)  # -> SmallerThan, OrEqualTo
cull = CullPattern(List=crossref.ListB, CullPattern=smaller.SmallerThan)
replace = ReplaceItems(List=pull.Distance, Item="0", Indices=cull, Wrap=False)
expression = Expression(x=num_4, y=replace, Expression="-1*e^(-x*y)")
bnd = Bounds(Numbers=flatten(expression))
dom = ConstructDomain(DomainStart=num_5, DomainEnd=num_6)
remap = RemapNumbers(Value=expression, Source=bnd, Target=dom)  # -> Mapped, Clipped
amp = Amplitude(Vector=sdivide.Normals, Amplitude=remap.Mapped)
move = Move(Geometry=sdivide.Points, Motion=amp)  # -> Geometry, Transform
srfgrid = SurfaceFromPoints(Points=flatten(move.Geometry), UCount=expr("x+1", num_3), Interpolate=False)
offest_surface = ClusterOutput(srfgrid)  # Offset Surface

# ==== cluster CrystallonV2MeshOffsetValue: Offset a mesh using a set of points and values

# ----
# MESH OFFSET VALUE (parameter)
triangulated = ClusterInput()  # True if mesh is triangulated. False if mesh is quads.
magnitude_max = ClusterInput()  # Magnitude of the offset (maximum value)
influence = ClusterInput()  # Smoothed range of attractor influence (0-1)
values = ClusterInput()  # Values that correspond to points (flattened)
magnitude_min = ClusterInput()  # Magnitude of the offset (minimum value)
distance_influence = ClusterInput()  # If true the distance between the points and voxels will affect the magnitude
points = ClusterInput()  # List of points (flattened)
mesh = ClusterInput()  # Mesh to offset
z_parameter = ClusterInput()  # Range of numbers (0-1) for Z divisions
bool = Boolean(triangulated)
mesh_2 = Mesh(mesh)
num = Number(influence)
bool_2 = Boolean(distance_influence)
pt = Point(points)
num_2 = Number(values)
dom = ConstructDomain(DomainStart=magnitude_min, DomainEnd=magnitude_max)
num_3 = Number(z_parameter)
cull = CullPattern(List=mesh_2, CullPattern=bool)
not = GateNot(A=bool)
weld = WeldMesh(Mesh=cull, Angle=3.141592654)
demesh = DeconstructMesh(Mesh=weld)  # -> Vertices, Faces, Colours, Normals
deface = DeconstructFace(Face=demesh.Faces)  # -> CornerA, CornerB, CornerC, CornerD
item = ListItem(List=demesh.Vertices, Index=deface.CornerB, Wrap=True)
item_2 = ListItem(List=demesh.Vertices, Index=deface.CornerC, Wrap=True)
item_3 = ListItem(List=demesh.Vertices, Index=deface.CornerA, Wrap=True)
panel = Panel("0")
panel_2 = Panel("1")
panel_3 = Panel("2")
addition = Addition(A=item_3, B=item)
addition_2 = Addition(A=item_3, B=item_2)
addition_3 = Addition(A=item, B=item_2)
bcentric = Barycentric(PointA=item_3, PointB=item, PointC=item_2, CoordinateU=1, CoordinateV=1, CoordinateW=1)
panel_4 = Panel("A")
division = Division(A=addition, B="2")
panel_5 = Panel("B")
panel_6 = Panel("C")
division_2 = Division(A=addition_3, B="2")
division_3 = Division(A=addition_2, B="2")
panel_7 = Panel("Z")
entwine = Entwine(Branch00=item_3, Branch01=division, Branch02=bcentric, Branch03=division_3, FlattenInputs=True)
entwine_2 = Entwine(Branch00=item, Branch01=division_2, Branch02=bcentric, Branch03=division, FlattenInputs=True)
entwine_3 = Entwine(Branch00=item_2, Branch01=division_3, Branch02=bcentric, Branch03=division_2, FlattenInputs=True)
flip = FlipMatrix(Data=entwine)
flip_2 = FlipMatrix(Data=entwine_3)
flip_3 = FlipMatrix(Data=entwine_2)
quad = MeshQuad(CornerA=0, CornerB=1, CornerC=2, CornerD=3)
quad_2 = MeshQuad(CornerA=0, CornerB=1, CornerC=2, CornerD=3)
quad_3 = MeshQuad(CornerA=0, CornerB=1, CornerC=2, CornerD=3)
conmesh = ConstructMesh(Vertices=flip_2, Faces=quad)
conmesh_2 = ConstructMesh(Vertices=flip_3, Faces=quad_2)
conmesh_3 = ConstructMesh(Vertices=flip, Faces=quad_3)
mjoin = MeshJoin(Meshes=flatten([conmesh_3, conmesh_2, conmesh]))
cull_2 = CullPattern(List=mesh_2, CullPattern=not)
demesh_2 = DeconstructMesh(Mesh=[mjoin, cull_2])  # -> Vertices, Faces, Colours, Normals
meshcp = MeshClosestPoint(Point=demesh_2.Vertices, Mesh=mesh_2)  # -> Point, Index, Parameter
cp = ClosestPoint(Point=demesh_2.Vertices, Cloud=pt)  # -> ClosestPoint, CPIndex, Distance
bnd = Bounds(Numbers=num_2)
meval = MeshEval(Mesh=mesh_2, Parameter=meshcp.Parameter)  # -> Point, Normal, Colour
remap = RemapNumbers(Value=num_2, Source=bnd, Target=dom)  # -> Mapped, Clipped
expression = Expression(x=num, y=cp.Distance, Expression="-1*e^(-x*y)")
item_4 = ListItem(List=remap.Mapped, Index=cp.CPIndex, Wrap=True)
bnd_2 = Bounds(Numbers=flatten(expression))
not_2 = GateNot(A=bool_2)
remap_2 = RemapNumbers(Value=expression, Source=bnd_2, Target="1 to 0")  # -> Mapped, Clipped
multiplication = Multiplication(A=item_4, B=remap_2.Mapped)
cull_3 = CullPattern(List=item_4, CullPattern=not_2)
cull_4 = CullPattern(List=multiplication, CullPattern=bool_2)
dom_2 = ConstructDomain(DomainStart=0, DomainEnd=flatten([cull_3, cull_4]))
remap_3 = RemapNumbers(Value=graft(num_3), Source=Domain(0, 1), Target=dom_2)  # -> simplify(Mapped), Clipped
amp = Amplitude(Vector=meval.Normal, Amplitude=remap_3.Mapped)
move = Move(Geometry=demesh_2.Vertices, Motion=amp)  # -> Geometry, Transform
toggle = BooleanToggle(False)
conmesh_4 = ConstructMesh(Vertices=move.Geometry, Faces=demesh_2.Faces)  # -> flatten(Mesh)
shift = ShiftList(List=flatten(conmesh_4), Shift="1", Wrap=toggle)
shift_2 = ShiftList(List=flatten(conmesh_4), Shift="-1", Wrap=toggle)
demesh_3 = DeconstructMesh(Mesh=shift_2)  # -> Vertices, Faces, Colours, Normals
demesh_4 = DeconstructMesh(Mesh=shift)  # -> Vertices, Faces, Colours, Normals
deface_2 = DeconstructFace(Face=demesh_3.Faces)  # -> CornerA, CornerB, CornerC, CornerD
deface_3 = DeconstructFace(Face=demesh_4.Faces)  # -> CornerA, CornerB, CornerC, CornerD
item_5 = ListItem(List=demesh_4.Vertices, Index=deface_3.CornerA, Wrap=True)
item_6 = ListItem(List=demesh_4.Vertices, Index=deface_3.CornerB, Wrap=True)
item_7 = ListItem(List=demesh_4.Vertices, Index=deface_3.CornerC, Wrap=True)
item_8 = ListItem(List=demesh_4.Vertices, Index=deface_3.CornerD, Wrap=True)
item_9 = ListItem(List=demesh_3.Vertices, Index=deface_2.CornerA, Wrap=True)
item_10 = ListItem(List=demesh_3.Vertices, Index=deface_2.CornerB, Wrap=True)
item_11 = ListItem(List=demesh_3.Vertices, Index=deface_2.CornerC, Wrap=True)
item_12 = ListItem(List=demesh_3.Vertices, Index=deface_2.CornerD, Wrap=True)
tbox = TwistedBox(
    CornerA=item_5,
    CornerB=item_6,
    CornerC=item_7,
    CornerD=item_8,
    CornerE=item_9,
    CornerF=item_10,
    CornerG=item_11,
    CornerH=item_12)  # -> flatten(TwistedBox)
mesh_3 = Mesh(conmesh_4)
quad_meshes = ClusterOutput(mesh_3)  # Quad meshes generated from the input mesh
voxels = ClusterOutput(tbox)  # Voxels to be filled with unit cells

# ==== cluster CrystallonV2MeshOffsetAttractor: Offset a mesh using an attractor

# ----
# MESH OFFSET ATTRACTOR (parameter)
triangulated = ClusterInput()  # True if mesh is triangulated. False if mesh is quads.
magnitude_min = ClusterInput()  # Magnitude of the offset (minimum value)
magnitude_max = ClusterInput()  # Magnitude of the offset (maximum value)
mesh = ClusterInput()  # Mesh to offset
z_parameter = ClusterInput()  # Range of numbers (0-1) for Z divisions
influence = ClusterInput()  # Smoothed range of attractor influence (0-1)
attractor = ClusterInput()  # Any geometry to use as attractor(s)
lower_limit = ClusterInput()  # Smoothing of the surface closest to the attractor
bool = Boolean(triangulated)
mesh_2 = Mesh(mesh)
num = Number(influence)
geo = Geometry(attractor)
num_2 = Number(z_parameter)
num_3 = Number(lower_limit)
num_4 = Number(magnitude_min)
num_5 = Number(magnitude_max)
cull = CullPattern(List=mesh_2, CullPattern=bool)
dom = ConstructDomain(DomainStart=num_4, DomainEnd=num_5)
weld = WeldMesh(Mesh=cull, Angle=3.141592654)
demesh = DeconstructMesh(Mesh=weld)  # -> Vertices, Faces, Colours, Normals
deface = DeconstructFace(Face=demesh.Faces)  # -> CornerA, CornerB, CornerC, CornerD
item = ListItem(List=demesh.Vertices, Index=deface.CornerB, Wrap=True)
item_2 = ListItem(List=demesh.Vertices, Index=deface.CornerC, Wrap=True)
item_3 = ListItem(List=demesh.Vertices, Index=deface.CornerA, Wrap=True)
addition = Addition(A=item_3, B=item)
addition_2 = Addition(A=item_3, B=item_2)
addition_3 = Addition(A=item, B=item_2)
bcentric = Barycentric(PointA=item_3, PointB=item, PointC=item_2, CoordinateU=1, CoordinateV=1, CoordinateW=1)
division = Division(A=addition, B="2")
division_2 = Division(A=addition_3, B="2")
division_3 = Division(A=addition_2, B="2")
entwine = Entwine(Branch00=item_3, Branch01=division, Branch02=bcentric, Branch03=division_3, FlattenInputs=True)
entwine_2 = Entwine(Branch00=item, Branch01=division_2, Branch02=bcentric, Branch03=division, FlattenInputs=True)
entwine_3 = Entwine(Branch00=item_2, Branch01=division_3, Branch02=bcentric, Branch03=division_2, FlattenInputs=True)
flip = FlipMatrix(Data=entwine)
flip_2 = FlipMatrix(Data=entwine_3)
flip_3 = FlipMatrix(Data=entwine_2)
quad = MeshQuad(CornerA=0, CornerB=1, CornerC=2, CornerD=3)
quad_2 = MeshQuad(CornerA=0, CornerB=1, CornerC=2, CornerD=3)
quad_3 = MeshQuad(CornerA=0, CornerB=1, CornerC=2, CornerD=3)
conmesh = ConstructMesh(Vertices=flip_2, Faces=quad)
conmesh_2 = ConstructMesh(Vertices=flip_3, Faces=quad_2)
conmesh_3 = ConstructMesh(Vertices=flip, Faces=quad_3)
not = GateNot(A=bool)
mjoin = MeshJoin(Meshes=flatten([conmesh_3, conmesh_2, conmesh]))
cull_2 = CullPattern(List=mesh_2, CullPattern=not)
demesh_2 = DeconstructMesh(Mesh=[mjoin, cull_2])  # -> Vertices, Faces, Colours, Normals
meshcp = MeshClosestPoint(Point=demesh_2.Vertices, Mesh=mesh_2)  # -> Point, Index, Parameter
pull = PullPoint(Point=demesh_2.Vertices, Geometry=geo, ClosestOnly=True)  # -> ClosestPoint, Distance
lng = ListLength(List=pull.Distance)
meval = MeshEval(Mesh=mesh_2, Parameter=meshcp.Parameter)  # -> Point, Normal, Colour
smaller = SmallerThan(FirstNumber=pull.Distance, SecondNumber=num_3)  # -> SmallerThan, OrEqualTo
series = Series(Start=0, Step=1, Count=lng)
cull_3 = CullPattern(List=series, CullPattern=smaller.SmallerThan)
replace = ReplaceItems(List=pull.Distance, Item="0", Indices=cull_3, Wrap=False)
expression = Expression(x=num, y=replace, Expression="-1*e^(-x*y)")
bnd = Bounds(Numbers=expression)
remap = RemapNumbers(Value=expression, Source=bnd, Target=dom)  # -> Mapped, Clipped
dom_2 = ConstructDomain(DomainStart=0, DomainEnd=remap.Mapped)
remap_2 = RemapNumbers(Value=graft(num_2), Source=Domain(0, 1), Target=dom_2)  # -> simplify(Mapped), Clipped
amp = Amplitude(Vector=meval.Normal, Amplitude=remap_2.Mapped)
move = Move(Geometry=demesh_2.Vertices, Motion=amp)  # -> Geometry, Transform
toggle = BooleanToggle(False)
conmesh_4 = ConstructMesh(Vertices=move.Geometry, Faces=demesh_2.Faces)  # -> flatten(Mesh)
shift = ShiftList(List=flatten(conmesh_4), Shift="1", Wrap=toggle)
shift_2 = ShiftList(List=flatten(conmesh_4), Shift="-1", Wrap=toggle)
demesh_3 = DeconstructMesh(Mesh=shift_2)  # -> Vertices, Faces, Colours, Normals
demesh_4 = DeconstructMesh(Mesh=shift)  # -> Vertices, Faces, Colours, Normals
deface_2 = DeconstructFace(Face=demesh_3.Faces)  # -> CornerA, CornerB, CornerC, CornerD
deface_3 = DeconstructFace(Face=demesh_4.Faces)  # -> CornerA, CornerB, CornerC, CornerD
item_4 = ListItem(List=demesh_4.Vertices, Index=deface_3.CornerA, Wrap=True)
item_5 = ListItem(List=demesh_4.Vertices, Index=deface_3.CornerB, Wrap=True)
item_6 = ListItem(List=demesh_4.Vertices, Index=deface_3.CornerC, Wrap=True)
item_7 = ListItem(List=demesh_4.Vertices, Index=deface_3.CornerD, Wrap=True)
item_8 = ListItem(List=demesh_3.Vertices, Index=deface_2.CornerA, Wrap=True)
item_9 = ListItem(List=demesh_3.Vertices, Index=deface_2.CornerB, Wrap=True)
item_10 = ListItem(List=demesh_3.Vertices, Index=deface_2.CornerC, Wrap=True)
item_11 = ListItem(List=demesh_3.Vertices, Index=deface_2.CornerD, Wrap=True)
tbox = TwistedBox(
    CornerA=item_4,
    CornerB=item_5,
    CornerC=item_6,
    CornerD=item_7,
    CornerE=item_8,
    CornerF=item_9,
    CornerG=item_10,
    CornerH=item_11)  # -> flatten(TwistedBox)
mesh_3 = Mesh(conmesh_4)
quad_meshes = ClusterOutput(mesh_3)  # Quad meshes generated from the input mesh
voxels = ClusterOutput(tbox)  # Voxels to be filled with unit cells

# ==== cluster CrystallonV2MeshOffestParameter: Offset a mesh a uniform distance

triangulated = ClusterInput()  # True if mesh is triangulated. False if mesh is quads.
mesh = ClusterInput()  # Mesh to offset
distance = ClusterInput()  # Offset distance
z_parameter = ClusterInput()  # Range of numbers (0-1) for Z divisions
bool = Boolean(triangulated)
mesh_2 = Mesh(mesh)
not = GateNot(A=bool)
cull = CullPattern(List=mesh_2, CullPattern=bool)
num = Number(z_parameter)
num_2 = Number(distance)
weld = WeldMesh(Mesh=cull, Angle=3.141592654)
demesh = DeconstructMesh(Mesh=weld)  # -> Vertices, Faces, Colours, Normals
deface = DeconstructFace(Face=demesh.Faces)  # -> CornerA, CornerB, CornerC, CornerD
item = ListItem(List=demesh.Vertices, Index=deface.CornerA, Wrap=True)
item_2 = ListItem(List=demesh.Vertices, Index=deface.CornerC, Wrap=True)
item_3 = ListItem(List=demesh.Vertices, Index=deface.CornerB, Wrap=True)
panel = Panel("0")
panel_2 = Panel("1")
panel_3 = Panel("2")
addition = Addition(A=item, B=item_3)
addition_2 = Addition(A=item, B=item_2)
addition_3 = Addition(A=item_3, B=item_2)
bcentric = Barycentric(PointA=item, PointB=item_3, PointC=item_2, CoordinateU=1, CoordinateV=1, CoordinateW=1)
panel_4 = Panel("A")
panel_5 = Panel("B")
panel_6 = Panel("C")
division = Division(A=addition, B="2")
division_2 = Division(A=addition_3, B="2")
division_3 = Division(A=addition_2, B="2")
panel_7 = Panel("Z")
entwine = Entwine(Branch00=item, Branch01=division, Branch02=bcentric, Branch03=division_3, FlattenInputs=True)
entwine_2 = Entwine(Branch00=item_3, Branch01=division_2, Branch02=bcentric, Branch03=division, FlattenInputs=True)
entwine_3 = Entwine(Branch00=item_2, Branch01=division_3, Branch02=bcentric, Branch03=division_2, FlattenInputs=True)
flip = FlipMatrix(Data=entwine)
flip_2 = FlipMatrix(Data=entwine_3)
flip_3 = FlipMatrix(Data=entwine_2)
quad = MeshQuad(CornerA=0, CornerB=1, CornerC=2, CornerD=3)
quad_2 = MeshQuad(CornerA=0, CornerB=1, CornerC=2, CornerD=3)
quad_3 = MeshQuad(CornerA=0, CornerB=1, CornerC=2, CornerD=3)
panel_8 = Panel("MESH OFFSET (parameter)")
conmesh = ConstructMesh(Vertices=flip_2, Faces=quad_2)
conmesh_2 = ConstructMesh(Vertices=flip_3, Faces=quad_3)
conmesh_3 = ConstructMesh(Vertices=flip, Faces=quad)
mjoin = MeshJoin(Meshes=flatten([conmesh_3, conmesh_2, conmesh]))
cull_2 = CullPattern(List=mesh_2, CullPattern=not)
demesh_2 = DeconstructMesh(Mesh=[cull_2, mjoin])  # -> Vertices, Faces, Colours, Normals
dom = ConstructDomain(DomainStart=0, DomainEnd=num_2)
meshcp = MeshClosestPoint(Point=demesh_2.Vertices, Mesh=mesh_2)  # -> Point, Index, Parameter
remap = RemapNumbers(Value=num, Source=Domain(0, 1), Target=dom)  # -> Mapped, Clipped
meval = MeshEval(Mesh=mesh_2, Parameter=meshcp.Parameter)  # -> Point, Normal, Colour
amp = Amplitude(Vector=meval.Normal, Amplitude=graft(remap.Mapped))
toggle = BooleanToggle(False)
move = Move(Geometry=demesh_2.Vertices, Motion=amp)  # -> Geometry, Transform
conmesh_4 = ConstructMesh(Vertices=move.Geometry, Faces=demesh_2.Faces)  # -> flatten(Mesh)
shift = ShiftList(List=flatten(conmesh_4), Shift="1", Wrap=toggle)
shift_2 = ShiftList(List=flatten(conmesh_4), Shift="-1", Wrap=toggle)
demesh_3 = DeconstructMesh(Mesh=shift_2)  # -> Vertices, Faces, Colours, Normals
demesh_4 = DeconstructMesh(Mesh=shift)  # -> Vertices, Faces, Colours, Normals
deface_2 = DeconstructFace(Face=demesh_4.Faces)  # -> CornerA, CornerB, CornerC, CornerD
deface_3 = DeconstructFace(Face=demesh_3.Faces)  # -> CornerA, CornerB, CornerC, CornerD
item_4 = ListItem(List=demesh_4.Vertices, Index=deface_2.CornerA, Wrap=True)
item_5 = ListItem(List=demesh_4.Vertices, Index=deface_2.CornerB, Wrap=True)
item_6 = ListItem(List=demesh_4.Vertices, Index=deface_2.CornerC, Wrap=True)
item_7 = ListItem(List=demesh_4.Vertices, Index=deface_2.CornerD, Wrap=True)
item_8 = ListItem(List=demesh_3.Vertices, Index=deface_3.CornerA, Wrap=True)
item_9 = ListItem(List=demesh_3.Vertices, Index=deface_3.CornerB, Wrap=True)
item_10 = ListItem(List=demesh_3.Vertices, Index=deface_3.CornerC, Wrap=True)
item_11 = ListItem(List=demesh_3.Vertices, Index=deface_3.CornerD, Wrap=True)
tbox = TwistedBox(
    CornerA=item_4,
    CornerB=item_5,
    CornerC=item_6,
    CornerD=item_7,
    CornerE=item_8,
    CornerF=item_9,
    CornerG=item_10,
    CornerH=item_11)  # -> flatten(TwistedBox)
mesh_3 = Mesh(conmesh_4)
quad_meshes = ClusterOutput(mesh_3)  # Quad meshes generated from the input mesh
voxels = ClusterOutput(tbox)  # Voxels to be filled with unit cells
