# Grasshopper definition 05-Voxel Morph.gh (Grasshopper 1.0.7)
# Copyright: ©2019 GNU General Public License

# ---- group: Geometry
planesrf = PlaneSurface(Plane=PlaneXY(0, 0, 0), XSize=Domain(-10, 10), YSize=Domain(-10, 10))
range = Range(Domain=Domain(0, 1), Steps=Slider(7, range=0..10))
move = Move(Geometry=planesrf, Motion=Vector(0, 0, 10))  # -> Geometry, Transform
mbs = CrystallonV2MorphBetweenSurfaces(surfaces=[planesrf, move.Geometry], x_parameter=range, y_parameter=range, z_parameter=range)

# ---- group: Values
neg = Negative(Value="10")
number_slider = Slider(26, range=0..100)
dom = ConstructDomain(DomainStart=neg, DomainEnd="10")
dom_2 = ConstructDomain(DomainStart="0", DomainEnd="10")
box = DomainBox(Base=PlaneXY(0, 0, 0), X=dom, Y=dom, Z=dom_2)
pop3d = Populate3D(Region=box, Count=number_slider, Seed=1)
random = Random(Range=Domain(0, 1), Number=number_slider, Seed=2)
gradient = Gradient(LowerLimit=0, UpperLimit=1, Parameter=random, stops=[0: RGB(255, 255, 255), 1: RGB(0, 0, 0)])
preview = CustomPreview(Geometry=pop3d, Material=gradient)

# ---- group: Attractor
md_slider = MDSlider(
    SliderMode=0,
    slider_value=Point(0.4714615752, 0.503942164, 0.5),
    x_domain=Domain(0, 1),
    y_domain=Domain(0, 1),
    z_domain=Domain(0, 1))
Z = UnitZ(Factor=Slider(5.477, range=0..10))
move_2 = Move(Geometry=planesrf, Motion=Z)  # -> Geometry, Transform
evalsrf = EvaluateSurface(Surface=reparameterize(move_2.Geometry), Point=md_slider)  # -> Point, Normal, UDirection, VDirection, Frame
sph = Sphere(Base=evalsrf.Point, Radius=1)

# ---- group: Voxel Morph Value
vmv = CrystallonV2VoxelMorphValue(
    voxels=mbs,
    points=pop3d,
    values=random,
    distance_influence=Toggle(False),
    influence=Slider(0.131, range=0..1),
    magnitude_min=Slider(0, range=0..5),
    magnitude_max=Slider(0.805, range=0..5))

# ---- group: Voxel Morph Attractor
vma = CrystallonV2VoxelMorphAttractor(voxels=mbs, attractor=evalsrf.Point, influence=Slider(0.131, range=0..1), magnitude=Slider(3.297, range=0..5))

# ==== cluster CrystallonV2VoxelMorphValue: Morph voxels with a point cloud and corrosponding values

voxels = ClusterInput()  # Voxels to be filled with unit cells
points = ClusterInput()  # List of points (flattened)
values = ClusterInput()  # Values that correspond to points (flattened)
distance_influence = ClusterInput()  # If true the distance between the points and voxels will affect the magnitude
influence = ClusterInput()  # Smoothed range of attractor influence (0-1)
magnitude_min = ClusterInput()  # Magnitude of the morph (minimum value)
magnitude_max = ClusterInput()  # Magnitude of the morph (maximum value)
tbox = TwistedBox(voxels)
pt = Point(points)
num = Number(values)
debrep = DeconstructBrep(Brep=tbox)  # -> Faces, Edges, Vertices
cp = ClosestPoint(Point=debrep.Vertices, Cloud=pt)  # -> ClosestPoint, CPIndex, Distance
dom = ConstructDomain(DomainStart=magnitude_min, DomainEnd=magnitude_max)
remap = RemapNumbers(Value=num, Source=Domain(0, 1), Target=dom)  # -> Mapped, Clipped
expression = Expression(x=influence, y=cp.Distance, Expression="-1*e^(-x*y)")
item = ListItem(List=remap.Mapped, Index=cp.CPIndex, Wrap=True)
# CRYSTALLON V2.0 -- Lattice structure tools for Grasshopper3D
# 
# Copyright (C) 2019  Aaron Porterfield
# 
# www.fequalsf.com
# info@fequalsf.com
# 
#     This program is free software: you can redistribute it and/or modify
#     it under the terms of the GNU General Public License as published by
#     the Free Software Foundation, either version 3 of the License, or any later version.
# 
#     This program is distributed in the hope that it will be useful,
#     but WITHOUT ANY WARRANTY; without even the implied warranty of
#     MERCHANTABILITY or FITNESS FOR A PARTICULAR PURPOSE.  See the
#     GNU General Public License for more details.
# 
#     You should have received a copy of the GNU General Public License
#     along with this program.  If not, see <http://www.gnu.org/licenses/>.
panel = Panel("VOXEL MORPH VALUE")
bnd = Bounds(Numbers=flatten(expression))
ln = Line(StartPoint=debrep.Vertices, EndPoint=cp.ClosestPoint)
remap_2 = RemapNumbers(Value=expression, Source=bnd, Target="1 to 0")  # -> Mapped, Clipped
not = GateNot(A=distance_influence)
multiplication = Multiplication(A=item, B=remap_2.Mapped)
cull = CullPattern(List=multiplication, CullPattern=distance_influence)
cull_2 = CullPattern(List=item, CullPattern=not)
amp = Amplitude(Vector=ln, Amplitude=[cull, cull_2])
move = Move(Geometry=debrep.Vertices, Motion=amp)  # -> Geometry, Transform
item_2 = ListItem(List=move.Geometry, Index="0", Wrap=True)
item_3 = ListItem(List=move.Geometry, Index="1", Wrap=True)
item_4 = ListItem(List=move.Geometry, Index="2", Wrap=True)
item_5 = ListItem(List=move.Geometry, Index="3", Wrap=True)
item_6 = ListItem(List=move.Geometry, Index="4", Wrap=True)
item_7 = ListItem(List=move.Geometry, Index="6", Wrap=True)
item_8 = ListItem(List=move.Geometry, Index="5", Wrap=True)
item_9 = ListItem(List=move.Geometry, Index="7", Wrap=True)
tbox_2 = TwistedBox(
    CornerA=item_2,
    CornerB=item_3,
    CornerC=item_4,
    CornerD=item_5,
    CornerE=item_8,
    CornerF=item_6,
    CornerG=item_9,
    CornerH=item_7)
voxels_2 = ClusterOutput(tbox_2)  # Voxels to be filled with unit cells

# ==== cluster CrystallonV2VoxelMorphAttractor: Morph voxels with attractor(s)

voxels = ClusterInput()  # Voxels to be filled with unit cells
attractor = ClusterInput()  # Any geometry to use as attractor(s)
influence = ClusterInput()  # Smoothed range of attractor influence (0-1)
tbox = TwistedBox(voxels)
magnitude = ClusterInput()  # Magnitude of the morph
geo = Geometry(attractor)
debrep = DeconstructBrep(Brep=tbox)  # -> Faces, Edges, Vertices
pull = PullPoint(Point=debrep.Vertices, Geometry=geo, ClosestOnly=True)  # -> ClosestPoint, Distance
bnd = Bounds(Numbers=flatten(pull.Distance))
panel = Panel("VOXEL MORPH ATTRACTOR")
expression = Expression(x=influence, y=pull.Distance, Expression="-1*e^(-x*y)")
dedomain = DeconstructDomain(Domain=bnd)  # -> Start, End
subtraction = Subtraction(A=dedomain.Start, B=magnitude)
bnd_2 = Bounds(Numbers=flatten(expression))
dom = ConstructDomain(DomainStart=subtraction, DomainEnd="0")
ln = Line(StartPoint=debrep.Vertices, EndPoint=pull.ClosestPoint)
remap = RemapNumbers(Value=expression, Source=bnd_2, Target=dom)  # -> Mapped, Clipped
amp = Amplitude(Vector=ln, Amplitude=remap.Mapped)
move = Move(Geometry=debrep.Vertices, Motion=amp)  # -> Geometry, Transform
item = ListItem(List=move.Geometry, Index="0", Wrap=True)
item_2 = ListItem(List=move.Geometry, Index="1", Wrap=True)
item_3 = ListItem(List=move.Geometry, Index="2", Wrap=True)
item_4 = ListItem(List=move.Geometry, Index="3", Wrap=True)
item_5 = ListItem(List=move.Geometry, Index="4", Wrap=True)
item_6 = ListItem(List=move.Geometry, Index="6", Wrap=True)
item_7 = ListItem(List=move.Geometry, Index="5", Wrap=True)
item_8 = ListItem(List=move.Geometry, Index="7", Wrap=True)
tbox_2 = TwistedBox(
    CornerA=item,
    CornerB=item_2,
    CornerC=item_3,
    CornerD=item_4,
    CornerE=item_7,
    CornerF=item_5,
    CornerG=item_8,
    CornerH=item_6)
voxels_2 = ClusterOutput(tbox_2)  # Voxels to be filled with unit cells

# ==== cluster CrystallonV2MorphBetweenSurfaces: Conformal fill of voxels between two or more surfaces

x_parameter = ClusterInput()  # Range of numbers (0-1) for X divisions
z_parameter = ClusterInput()  # Range of numbers (0-1) for Z divisions
surfaces = ClusterInput()  # At least 2 surfaces to morph voxels between
y_parameter = ClusterInput()  # Range of numbers (0-1) for Y divisions
srf = Surface(flatten(surfaces))
num = Number(y_parameter)
num_2 = Number(x_parameter)
num_3 = Number(z_parameter)
pt = ConstructPoint(XCoordinate=simplify(graft(num_2)), YCoordinate=simplify(num), ZCoordinate=0)  # -> simplify(Point)
lng = ListLength(List=num_2)
num_4 = Number(lng)
evalsrf = EvaluateSurface(Surface=reparameterize(simplify(srf)), Point=simplify(graft(pt)))  # -> simplify(Point), Normal, Frame
pline = PolyLine(Vertices=evalsrf.Point, Closed=False)
eval = EvaluateCurve(Curve=reparameterize(pline), Parameter=num_3)  # -> Point, Tangent, Angle
path_mapper = PathMapper(eval.Point, source="{A;B}(i)", target="{B;A}(i)")
path_mapper_2 = PathMapper(path_mapper, source="{A;B}", target="{path_index}")
toggle = BooleanToggle(False)
shift = ShiftList(List=path_mapper_2, Shift="1", Wrap=toggle)
shift_2 = ShiftList(List=path_mapper_2, Shift="-1", Wrap=toggle)
flip = FlipMatrix(Data=shift)
flip_2 = FlipMatrix(Data=shift_2)
partition = PartitionList(List=flip_2, Size=num_4)
partition_2 = PartitionList(List=flip, Size=num_4)
shift_3 = ShiftList(List=partition, Shift="-1", Wrap=toggle)  # -> simplify(List)
shift_4 = ShiftList(List=partition, Shift="1", Wrap=toggle)  # -> simplify(List)
shift_5 = ShiftList(List=partition_2, Shift="1", Wrap=toggle)  # -> simplify(List)
shift_6 = ShiftList(List=partition_2, Shift="-1", Wrap=toggle)  # -> simplify(List)
path_mapper_3 = PathMapper(shift_4, source="{A;B}(i)", target="{A;i}(B)")
path_mapper_4 = PathMapper(shift_3, source="{A;B}(i)", target="{A;i}(B)")
path_mapper_5 = PathMapper(shift_5, source="{A;B}(i)", target="{A;i}(B)")
path_mapper_6 = PathMapper(shift_6, source="{A;B}(i)", target="{A;i}(B)")
shift_7 = ShiftList(List=path_mapper_4, Shift="-1", Wrap=toggle)
shift_8 = ShiftList(List=path_mapper_3, Shift="1", Wrap=toggle)
shift_9 = ShiftList(List=path_mapper_3, Shift="-1", Wrap=toggle)
shift_10 = ShiftList(List=path_mapper_6, Shift="-1", Wrap=toggle)
shift_11 = ShiftList(List=path_mapper_4, Shift="1", Wrap=toggle)
shift_12 = ShiftList(List=path_mapper_5, Shift="1", Wrap=toggle)
shift_13 = ShiftList(List=path_mapper_5, Shift="-1", Wrap=toggle)
shift_14 = ShiftList(List=path_mapper_6, Shift="1", Wrap=toggle)
tbox = TwistedBox(
    CornerA=shift_11,
    CornerB=shift_7,
    CornerC=shift_9,
    CornerD=shift_8,
    CornerE=shift_14,
    CornerF=shift_10,
    CornerG=shift_13,
    CornerH=shift_12)
voxels = ClusterOutput(tbox)  # Voxels to be filled with unit cells
