# Grasshopper definition 02-Cell Morph and Tween Fill.gh (Grasshopper 1.0.7)
# Copyright: ©2019 GNU General Public License

# ---- group: Geometry
pt = ConstructPoint(XCoordinate="20", YCoordinate="20", ZCoordinate=0)
planesrf = PlaneSurface(Plane=pt, XSize=Domain(-10, 10), YSize=Domain(-10, 10))
Z = UnitZ(Factor="20")
range = Range(Domain=Domain(0, 1), Steps=Slider(5, range=0..10))
move = Move(Geometry=planesrf, Motion=Z)  # -> Geometry, Transform
mbs = CrystallonV2MorphBetweenSurfaces(surfaces=[planesrf, move.Geometry], x_parameter=range, y_parameter=range, z_parameter=range)

# ---- group: Values
neg = Negative(Value="10")
number_slider = Slider(25, range=0..100)
dom = ConstructDomain(DomainStart=neg, DomainEnd="10")
dom_2 = ConstructDomain(DomainStart="0", DomainEnd="20")
box = DomainBox(Base=pt, X=dom, Y=dom, Z=dom_2)
pop3d = Populate3D(Region=box, Count=number_slider, Seed=1)
random = Random(Range=Domain(0, 1), Number=number_slider, Seed=2)
gradient = Gradient(LowerLimit=0, UpperLimit=1, Parameter=random, stops=[0: RGB(255, 255, 255), 1: RGB(0, 0, 0)])
preview = CustomPreview(Geometry=pop3d, Material=gradient)

# ---- group: Attractor
md_slider = MDSlider(
    SliderMode=0,
    slider_value=Point(0.1232725702, 0.5500183105, 0.5),
    x_domain=Domain(0, 1),
    y_domain=Domain(0, 1),
    z_domain=Domain(0, 1))
Z_2 = UnitZ(Factor=Slider(16.095, range=0..20))
move_2 = Move(Geometry=planesrf, Motion=Z_2)  # -> Geometry, Transform
evalsrf = EvaluateSurface(Surface=reparameterize(move_2.Geometry), Point=md_slider)  # -> Point, Normal, UDirection, VDirection, Frame
sph = Sphere(Base=evalsrf.Point, Radius=1)

# ---- group: Cell Morph (attractor)
cma = CrystallonV2CellMorphAttractor(
    voxels=mbs,
    attractor=sph,
    influence=Slider(0.006, range=0..1),
    magnitude_min=Slider(1, range=0..1),
    magnitude_max=Slider(0, range=0..1))

# ---- group: Cell Morph (value)
cmv = CrystallonV2CellMorphValue(voxels=mbs, points=pop3d, values=random, distance_influence=Toggle(False), influence=Slider(0.006, range=0..1))

# ----
entwine = Entwine(Branch00=cma, Branch01=cmv, FlattenInputs=True)  # -> simplify(Result)
branch = TreeBranch(Tree=entwine, Path=Slider(0, range=0..1), MaintainPaths=True)
swatch = ColourSwatch(SwatchColor=RGB(120, 120, 120))

# ---- group: Tween Cell Fill
unit_cell_selector = CrystallonV2CellSelector({"Prim. Cubic": 0, "BC": 1, "BC Cubic": 2, "FC Cubic": 3, "Edge Octa.": 4, "Vertex Octa.": 5, "NaCl": 6, "Star Tet.": 7, "BC Star Tet.": 8, "Octa. Tet.": 9, "Dodecahedron": 10, "Trunc. Octa.": 11, "Tetrahedral": 12, "Auxetic": 13, "BC1 (tween)": 14, "BC2 (tween)": 15, "Octa. (shell)": 16, "Dodeca. (shell)": 17, "Trunc. Octa. (shell)": 18, "Gyroid (shell)": 19, "Cubic Center (shell)": 20, "Cubic Face (shell)": 21, "LH Square": 22, "LH Round": 23, "LH Square (shell)": 24, "LH Auxetic (shell)": 25, "MC Tri": 26, "MS Tri (shell)": 27, "MC Quad": 28, "MS Quad (shell)": 29}, selected="BC1 (tween)")
unit_cell_selector_2 = CrystallonV2CellSelector({"Prim. Cubic": 0, "BC": 1, "BC Cubic": 2, "FC Cubic": 3, "Edge Octa.": 4, "Vertex Octa.": 5, "NaCl": 6, "Star Tet.": 7, "BC Star Tet.": 8, "Octa. Tet.": 9, "Dodecahedron": 10, "Trunc. Octa.": 11, "Tetrahedral": 12, "Auxetic": 13, "BC1 (tween)": 14, "BC2 (tween)": 15, "Octa. (shell)": 16, "Dodeca. (shell)": 17, "Trunc. Octa. (shell)": 18, "Gyroid (shell)": 19, "Cubic Center (shell)": 20, "Cubic Face (shell)": 21, "LH Square": 22, "LH Round": 23, "LH Square (shell)": 24, "LH Auxetic (shell)": 25, "MC Tri": 26, "MS Tri (shell)": 27, "MC Quad": 28, "MS Quad (shell)": 29}, selected="BC2 (tween)")
X = UnitX(Factor="10")
ct = CrystallonV2CellType(unit_cell_selector=unit_cell_selector)
ct_2 = CrystallonV2CellType(unit_cell_selector=unit_cell_selector_2)
move_3 = Move(Geometry=ct, Motion=X)  # -> Geometry, Transform
tcf = CrystallonV2TweenCellFill(unit_cell_1=ct, unit_cell_2=ct_2, voxels=mbs, value=branch)
preview_2 = CustomPreview(Geometry=[move_3.Geometry, ct_2], Material=swatch)
preview_3 = CustomPreview(Geometry=tcf, Material=swatch)

# ---- group: Tween Shell Fill
mesh = Mesh(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)
mesh_2 = Mesh(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)
tsf = CrystallonV2TweenShellFIll(unit_cell_shell=mesh, unit_cell_shell_2=mesh_2, voxels=mbs, value=branch, tolerance=".1")
preview_4 = CustomPreview(Geometry=[mesh_2, mesh], Material=swatch)
preview_5 = CustomPreview(Geometry=tsf, Material=swatch)

# ==== cluster CrystallonV2CellMorphValue: Morph unit cells with a point cloud and corrosponding values

distance_influence = ClusterInput()  # If true the distance between the points and voxels will affect the magnitude
influence = ClusterInput()  # Smoothed range of attractor influence (0-1)
values = ClusterInput()  # Values that correspond to points (flattened)
points = ClusterInput()  # List of points (flattened)
voxels = ClusterInput()  # Voxels to be filled with unit cells
brep = Brep(voxels)
num = Number(values)
pt = Point(points)
# CRYSTALLON V2.0 -- Lattice structure tools for Grasshopper3D
# 
# Copyright (C) 2019  Aaron Porterfield
# 
# www.fequalsf.com
# info@fequalsf.com
# 
#     This program is free software: you can redistribute it and/or modify
#     it under the terms of the GNU General Public License as published by
#     the Free Software Foundation, either version 3 of the License, or any later version.
# 
#     This program is distributed in the hope that it will be useful,
#     but WITHOUT ANY WARRANTY; without even the implied warranty of
#     MERCHANTABILITY or FITNESS FOR A PARTICULAR PURPOSE.  See the
#     GNU General Public License for more details.
# 
#     You should have received a copy of the GNU General Public License
#     along with this program.  If not, see <http://www.gnu.org/licenses/>.
area = Area(Geometry=flatten(brep))  # -> Area, Centroid
cp = ClosestPoint(Point=area.Centroid, Cloud=pt)  # -> ClosestPoint, CPIndex, Distance
item = ListItem(List=num, Index=cp.CPIndex, Wrap=True)
panel = Panel("CELL MORPH VALUE")
expression = Expression(x=influence, y=cp.Distance, Expression="-1*e^(-x*y)")
bnd = Bounds(Numbers=item)
remap = RemapNumbers(Value=item, Source=bnd, Target=Domain(0, 1))  # -> Mapped, Clipped
bnd_2 = Bounds(Numbers=expression)
not = GateNot(A=distance_influence)
remap_2 = RemapNumbers(Value=expression, Source=bnd_2, Target="1 to 0")  # -> Mapped, Clipped
cull = CullPattern(List=remap.Mapped, CullPattern=not)
multiplication = Multiplication(A=remap.Mapped, B=remap_2.Mapped)
cull_2 = CullPattern(List=multiplication, CullPattern=distance_influence)
num_2 = Number([cull_2, cull])
value = ClusterOutput(num_2)  # Values (0-1) for morph

# ==== cluster CrystallonV2CellMorphAttractor: Morph unit cells with attractor(s)

voxels = ClusterInput()  # Voxels to be filled with unit cells
attractor = ClusterInput()  # Any geometry to use as attractor(s)
influence = ClusterInput()  # Smoothed range of attractor influence (0-1)
magnitude_min = ClusterInput()  # Magnitude of the morph (minimum value)
magnitude_max = ClusterInput()  # Magnitude of the morph (maximum value)
brep = Brep(voxels)
geo = Geometry(attractor)
volume = Volume(Geometry=flatten(brep))  # -> Volume, Centroid
pull = PullPoint(Point=volume.Centroid, Geometry=geo, ClosestOnly=True)  # -> ClosestPoint, Distance
panel = Panel("CELL MORPH ATTRACTOR")
expression = Expression(x=influence, y=pull.Distance, Expression="-1*e^(-x*y)")
dom = ConstructDomain(DomainStart=magnitude_min, DomainEnd=magnitude_max)
bnd = Bounds(Numbers=expression)
remap = RemapNumbers(Value=expression, Source=bnd, Target=dom)  # -> Mapped, Clipped
value = ClusterOutput(remap.Mapped)  # Values (0-1) for cell morph

# ==== cluster CrystallonV2TweenCellFill: Fill voxels with morphed lattice unit cells

unit_cell_2 = ClusterInput()  # Unit cell to populate voxels
unit_cell_1 = ClusterInput()  # Unit cell to populate voxels
value = ClusterInput()  # Value from 0-1 corresponding to each voxel
voxels = ClusterInput()  # Voxels to be filled with unit cells
num = Number(value)
flip = FlipCurve(Curve=unit_cell_1, Guide=unit_cell_2)  # -> Curve, Flag
tweencrv = TweenCurve(CurveA=flip.Curve, CurveB=unit_cell_2, Factor=graft(num), BlendType=0)
panel = Panel("TWEEN CELL FILL")
bbox = BoundingBox(Content=tweencrv, Plane=PlaneXY(0, 0, 0), UnionBox=True)  # -> Box, Box_2
morph = BoxMorph(Geometry=tweencrv, Reference=bbox.Box, Target=graft(voxels))  # -> flatten(Geometry)
line = Line(morph)
remove_duplicate_lines = RemoveDuplicateLines(lattice_l=flatten(line))
lattice = ClusterOutput(remove_duplicate_lines)  # List of curves that make up the lattice

# ==== cluster CrystallonV2TweenShellFIll: Fill voxels with morphed shell unit cells

unit_cell_shell = ClusterInput()  # Unit cell to populate voxels
unit_cell_shell_2 = ClusterInput()  # Unit cell to populate voxels
voxels = ClusterInput()  # Voxels to be filled with unit cells
value = ClusterInput()  # Value from 0-1 corresponding to each voxel
tolerance = ClusterInput()  # Tolerance for merging faces and vertices (number usually between 0.001 and 0.1)
geo = Geometry(unit_cell_shell_2)
geo_2 = Geometry(unit_cell_shell)
num = Number(value)
num_2 = Number(tolerance)
geo_3 = Geometry(voxels)
demesh = DeconstructMesh(Mesh=geo_2)  # -> Vertices, Faces, Colours, Normals
demesh_2 = DeconstructMesh(Mesh=geo)  # -> Vertices, Faces, Colours, Normals
ln = Line(StartPoint=demesh.Vertices, EndPoint=demesh_2.Vertices)
eval = EvaluateCurve(Curve=reparameterize(graft(ln)), Parameter=num)  # -> simplify(Point), Tangent, Angle
flip = FlipMatrix(Data=eval.Point)
conmesh = ConstructMesh(Vertices=flip, Faces=demesh.Faces)
bbox = BoundingBox(Content=conmesh, Plane=PlaneXY(0, 0, 0), UnionBox=True)  # -> Box, Box_2
morph = BoxMorph(Geometry=conmesh, Reference=bbox.Box, Target=simplify(graft(geo_3)))  # -> flatten(Geometry)
panel = Panel("TWEEN SHELL FILL")
mjoin = MeshJoin(Meshes=morph)
demesh_3 = DeconstructMesh(Mesh=mjoin)  # -> Vertices, Faces, Colours, Normals
facen = FaceNormals(Mesh=mjoin)  # -> Centers, Normals
cullpt = CullDuplicates(Points=facen.Centers, Tolerance=num_2, CullMode=1)  # -> Points, Indices, Valence
item = ListItem(List=demesh_3.Faces, Index=cullpt.Indices, Wrap=True)
conmesh_2 = ConstructMesh(Vertices=demesh_3.Vertices, Faces=item)
weld = WeldMesh(Mesh=conmesh_2, Angle=3.141592654)
c_script = CSharpScript(M=weld, radius=num_2)  # -> out, A; inputs M: Mesh, radius: Double
# ---------- c_script: C# usings ----------
using System.IO;
using System.Linq;
using System.Data;
using System.Drawing;
using System.Reflection;
using System.Windows.Forms;
using System.Xml;
using System.Xml.Linq;
using System.Runtime.InteropServices;

using Rhino.DocObjects;
using Rhino.Collections;
using GH_IO;
using GH_IO.Serialization;
# ---------- c_script: C# ----------
    Component.Message = "Weld Mesh - RTree";


    //Store naked mesh vertices and their ids
    List<Point3f> pts = new List<Point3f>();
    bool[] flag = M.GetNakedEdgePointStatus();

    allPointsFound = new List<List<int>>();

    //History is need to stop searching rtee
    //When all point groups are found
    history.Clear();

    //Create Rtree
    RTree tree = new RTree();

    for(int i = 0; i < flag.Length; i++){
      if(flag[i]){
        tree.Insert(M.Vertices[i], i);
        pts.Add(M.Vertices[i]);
      }
    }

    //Search RTree
    for(int i = 0; i < pts.Count; i++){
      tempIDList = new List<int>();
      tree.Search(new Sphere(pts[i], radius), method);

      if(tempIDList.Count > 1)
        allPointsFound.Add(tempIDList);

      if(history.Count == M.Vertices.Count)
        break;
    }

    //Now move found vertices to one of firs vertex position
    foreach(List<int> i in allPointsFound)
      for(int j = 1; j < i.Count; j++)
        M.Vertices[i[0]] = M.Vertices[i[j]];

    M.Vertices.CombineIdentical(true, true);


    A = M;
# ---------- c_script: C# additional code ----------
  //Rtree collections
  List<int> history = new List<int>();
  List<List<int>> allPointsFound;
  List<int> tempIDList;

  private void method(object sender, RTreeEventArgs e){
    if(!history.Contains(e.Id)){
      tempIDList.Add(e.Id);
      history.Add(e.Id);
    }
  }
# ---------- end c_script ----------
lattice_shell = ClusterOutput(c_script.A)  # Joined mesh that makes up the lattice

# ==== cluster CrystallonV2MorphBetweenSurfaces: Conformal fill of voxels between two or more surfaces

x_parameter = ClusterInput()  # Range of numbers (0-1) for X divisions
z_parameter = ClusterInput()  # Range of numbers (0-1) for Z divisions
surfaces = ClusterInput()  # At least 2 surfaces to morph voxels between
y_parameter = ClusterInput()  # Range of numbers (0-1) for Y divisions
srf = Surface(flatten(surfaces))
num = Number(y_parameter)
num_2 = Number(x_parameter)
num_3 = Number(z_parameter)
pt = ConstructPoint(XCoordinate=simplify(graft(num_2)), YCoordinate=simplify(num), ZCoordinate=0)  # -> simplify(Point)
lng = ListLength(List=num_2)
num_4 = Number(lng)
evalsrf = EvaluateSurface(Surface=reparameterize(simplify(srf)), Point=simplify(graft(pt)))  # -> simplify(Point), Normal, Frame
pline = PolyLine(Vertices=evalsrf.Point, Closed=False)
eval = EvaluateCurve(Curve=reparameterize(pline), Parameter=num_3)  # -> Point, Tangent, Angle
path_mapper = PathMapper(eval.Point, source="{A;B}(i)", target="{B;A}(i)")
path_mapper_2 = PathMapper(path_mapper, source="{A;B}", target="{path_index}")
toggle = BooleanToggle(False)
shift = ShiftList(List=path_mapper_2, Shift="1", Wrap=toggle)
shift_2 = ShiftList(List=path_mapper_2, Shift="-1", Wrap=toggle)
flip = FlipMatrix(Data=shift)
flip_2 = FlipMatrix(Data=shift_2)
partition = PartitionList(List=flip_2, Size=num_4)
partition_2 = PartitionList(List=flip, Size=num_4)
shift_3 = ShiftList(List=partition, Shift="-1", Wrap=toggle)  # -> simplify(List)
shift_4 = ShiftList(List=partition, Shift="1", Wrap=toggle)  # -> simplify(List)
shift_5 = ShiftList(List=partition_2, Shift="1", Wrap=toggle)  # -> simplify(List)
shift_6 = ShiftList(List=partition_2, Shift="-1", Wrap=toggle)  # -> simplify(List)
path_mapper_3 = PathMapper(shift_4, source="{A;B}(i)", target="{A;i}(B)")
path_mapper_4 = PathMapper(shift_3, source="{A;B}(i)", target="{A;i}(B)")
path_mapper_5 = PathMapper(shift_5, source="{A;B}(i)", target="{A;i}(B)")
path_mapper_6 = PathMapper(shift_6, source="{A;B}(i)", target="{A;i}(B)")
shift_7 = ShiftList(List=path_mapper_4, Shift="-1", Wrap=toggle)
shift_8 = ShiftList(List=path_mapper_3, Shift="1", Wrap=toggle)
shift_9 = ShiftList(List=path_mapper_3, Shift="-1", Wrap=toggle)
shift_10 = ShiftList(List=path_mapper_6, Shift="-1", Wrap=toggle)
shift_11 = ShiftList(List=path_mapper_4, Shift="1", Wrap=toggle)
shift_12 = ShiftList(List=path_mapper_5, Shift="1", Wrap=toggle)
shift_13 = ShiftList(List=path_mapper_5, Shift="-1", Wrap=toggle)
shift_14 = ShiftList(List=path_mapper_6, Shift="1", Wrap=toggle)
tbox = TwistedBox(
    CornerA=shift_11,
    CornerB=shift_7,
    CornerC=shift_9,
    CornerD=shift_8,
    CornerE=shift_14,
    CornerF=shift_10,
    CornerG=shift_13,
    CornerH=shift_12)
voxels = ClusterOutput(tbox)  # Voxels to be filled with unit cells

# ==== cluster CrystallonV2CellType: A collection of pre-made unit cells

crv = Curve([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])
crv_2 = Curve([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])
crv_3 = Curve([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])
crv_4 = Curve([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])
crv_5 = Curve([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])
mesh = Mesh(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)
mesh_2 = Mesh(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)
mesh_3 = Mesh(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)
mesh_4 = Mesh([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])
crv_6 = Curve([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])
crv_7 = Curve([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])
crv_8 = Curve([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])
crv_9 = Curve([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])
crv_10 = Curve([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])
crv_11 = Curve([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])
crv_12 = Curve([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])
crv_13 = Curve([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])
crv_14 = Curve([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])
crv_15 = Curve([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])
crv_16 = Curve([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])
mesh_5 = Mesh(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)
mesh_6 = Mesh(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)
mesh_7 = Mesh(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)
mesh_8 = Mesh(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)
crv_17 = Curve([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])
crv_18 = Curve([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])
mesh_9 = Mesh(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)
geo = Geometry([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])
geo_2 = Geometry([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])
mesh_10 = Mesh([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])
panel = Panel("CELL TYPES")
entwine = Entwine(
    Branch00=crv_6,
    Branch01=crv_7,
    Branch02=crv,
    Branch03=crv_8,
    Branch04=crv_2,
    Branch05=crv_9,
    Branch06=crv_3,
    Branch07=crv_10,
    Branch08=crv_11,
    Branch09=crv_12,
    Branch010=crv_4,
    Branch011=crv_5,
    Branch012=crv_13,
    Branch013=crv_14,
    Branch014=crv_15,
    Branch015=crv_16,
    Branch016=mesh,
    Branch017=mesh_5,
    Branch018=mesh_6,
    Branch019=mesh_2,
    Branch020=mesh_7,
    Branch021=mesh_8,
    Branch022=crv_17,
    Branch023=crv_18,
    Branch024=mesh_9,
    Branch025=mesh_3,
    Branch026=geo,
    Branch027=mesh_4,
    Branch028=geo_2,
    Branch029=mesh_10,
    FlattenInputs=True)  # -> simplify(Result)
unit_cell_selector = ClusterInput()
branch = TreeBranch(Tree=entwine, Path=unit_cell_selector, MaintainPaths=True)
unit_cell = ClusterOutput(branch)  # Single unit cell to populate voxels

# ==== cluster RemoveDuplicateLines
lattice_l = ClusterInput()
crv = Curve(lattice_l)
curvepoint = PointOnCurve(crv, parameter=0.5)
cullpt = CullDuplicates(Points=curvepoint, Tolerance=".001", CullMode=1)  # -> Points, Indices, Valence
item = ListItem(List=crv, Index=cullpt.Indices, Wrap=True)
lattice = ClusterOutput(item)
