# Grasshopper definition 03-Voronoi Fill.gh (Grasshopper 1.0.7)
# Copyright: ©2019 GNU General Public License

# ---- group: Geometry
msphere = MeshSphere(Base=PlaneXY(0, 0, 0), Radius=10, UCount=10, VCount=20)

# ---- group: Attractors
pop3d = Populate3D(Region=msphere, Count=Slider(10, range=0..10), Seed=1)
sph = Sphere(Base=pop3d, Radius=1)

# ---- group: Voronoi FIll
vf = CrystallonV2VoronoiFill(
    geometry=msphere,
    number_of_points=Slider(1000, range=0..1000),
    use_attractor=Toggle(True),
    attractor=pop3d,
    magnitude_of_random_filtering=Slider(0, range=0..10),
    number_of_filtered_points=Slider(476, range=0..1000),
    enable_voronoi=Toggle(True))  # -> voronoi_lattice, voronoi_lattice_skin, preview_points

# ---- group: Trim Lattice
tl = CrystallonV2TrimLattice(geometry=msphere, lattice=vf.voronoi_lattice)  # -> trimmed_lattice, unrimmed_lattice
crv = Curve([tl.trimmed_lattice, tl.unrimmed_lattice])
preview = CustomPreview(Geometry=crv, Material=ColourSwatch(SwatchColor=RGB(0, 42, 255)))

# ---- group: Lattice Skin
crv_2 = Curve(vf.voronoi_lattice_skin)
preview_2 = CustomPreview(Geometry=crv_2, Material=ColourSwatch(SwatchColor=RGB(217, 255, 0)))

# ---- group: Preview Points
preview_3 = CustomPreview(Geometry=vf.preview_points, Material=ColourSwatch(SwatchColor=RGB(0, 0, 0)))

# ==== cluster CrystallonV2VoronoiFill: Fill a volume with randomized voronoi cells

geometry = ClusterInput()  # Geometry to fill
number_of_points = ClusterInput()  # The initial number of random points to fill the volume
use_attractor = ClusterInput()  # If true, points will be filtered by distance to attractor(s)
attractor = ClusterInput()  # Any geometry to use as attractor(s)
magnitude_of_random_filtering = ClusterInput()  # Magnitude of random filtering
number_of_filtered_points = ClusterInput()  # The number of points to filter
enable_voronoi = ClusterInput()  # If true, voronoi cells will be generated (can be very slow)
geo = Geometry(geometry)
geo_2 = Geometry(attractor)
# CRYSTALLON V2.0 -- Lattice structure tools for Grasshopper3D
# 
# Copyright (C) 2019  Aaron Porterfield
# 
# www.fequalsf.com
# info@fequalsf.com
# 
#     This program is free software: you can redistribute it and/or modify
#     it under the terms of the GNU General Public License as published by
#     the Free Software Foundation, either version 3 of the License, or any later version.
# 
#     This program is distributed in the hope that it will be useful,
#     but WITHOUT ANY WARRANTY; without even the implied warranty of
#     MERCHANTABILITY or FITNESS FOR A PARTICULAR PURPOSE.  See the
#     GNU General Public License for more details.
# 
#     You should have received a copy of the GNU General Public License
#     along with this program.  If not, see <http://www.gnu.org/licenses/>.
mesh = Mesh(geo)
bbox = BoundingBox(Content=mesh, Plane=PlaneXY(0, 0, 0))  # -> Box, Box_2
pop3d = Populate3D(Region=bbox.Box, Count=number_of_points, Seed=1)
dom = ConstructDomain(DomainStart=expr("x*-1", magnitude_of_random_filtering), DomainEnd=magnitude_of_random_filtering)
pull = PullPoint(Point=pop3d, Geometry=geo_2, ClosestOnly=True)  # -> ClosestPoint, Distance
lng = ListLength(List=pop3d)
random = Random(Range=dom, Number=lng, Seed=2)
addition = Addition(A=random, B=pull.Distance)
sort = SortList(Keys=addition, ValuesA=pop3d)  # -> Keys, ValuesA
not = GateNot(A=use_attractor)
panel = Panel("VORONOI FILL")
subset = SubList(List=sort.ValuesA, Domain=number_of_filtered_points, Wrap=True)  # -> List, Index
cull = CullPattern(List=pop3d, CullPattern=not)
cull_2 = CullPattern(List=subset.List, CullPattern=use_attractor)
pt = Point(flatten([cull_2, cull]))
minc = MeshInclusion(Mesh=mesh, Point=flatten(pt), Strict=False)
cull_3 = CullPattern(List=flatten(pt), CullPattern=minc)
cull_4 = CullPattern(List=cull_3, CullPattern=enable_voronoi)
voronoi³ = Voronoi3D(Points=flatten(cull_4), Box=bbox.Box)  # -> Cells, Boundary
edges = BrepEdges(Brep=voronoi³.Cells)  # -> Naked, Interior, NonManifold
mmx = MeshMesh(MeshA=mesh, MeshB=voronoi³.Cells, UseMeshMeshFast=True)
explode = Explode(Curve=flatten(mmx), Recursive=True)  # -> Segments, flatten(Vertices)
remove_duplicate_lines = RemoveDuplicateLines(lattice_l=flatten(edges.Interior))
remove_duplicate_lines_2 = RemoveDuplicateLines(lattice_l=flatten(explode.Segments))
preview_points = ClusterOutput(cull_3)  # Preview of points that will create the voronoi lattice
voronoi_lattice_skin = ClusterOutput(remove_duplicate_lines_2)  # List of curves that make up the lattice skin
voronoi_lattice = ClusterOutput(remove_duplicate_lines)  # List of curves that make up the lattice

# ==== cluster CrystallonV2TrimLattice: Trim lattice with a closed volume

geometry = ClusterInput()  # Geometry to trim with (closed brep or mesh)
lattice = ClusterInput()  # Lattice curves to trim
geo = Geometry(geometry)
crv = Curve(lattice)
mesh = Mesh(geo)
mcx = MeshCurve(Mesh=mesh, Curve=crv)  # -> Points, Faces
null = NullItem(Item=mcx.Points)  # -> NullFlags, InvalidFlags, Description
crv_cp = CurveClosestPoint(Point=mcx.Points, Curve=graft(crv))  # -> Point, Parameter, Distance
panel = Panel("TRIM LATTICE")
cull = CullPattern(List=graft(crv), CullPattern=null.NullFlags)
shatter = Shatter(Curve=graft(crv), Parameters=crv_cp.Parameter)
curvepoint = PointOnCurve(cull, parameter=0.5)
curvepoint_2 = PointOnCurve(shatter, parameter=0.5)
minc = MeshInclusion(Mesh=mesh, Point=curvepoint, Strict=False)
minc_2 = MeshInclusion(Mesh=mesh, Point=curvepoint_2, Strict=False)
cull_2 = CullPattern(List=shatter, CullPattern=minc_2)
cull_3 = CullPattern(List=cull, CullPattern=minc)
crv_2 = Curve(flatten(cull_2))
crv_3 = Curve(flatten(cull_3))
unrimmed_lattice = ClusterOutput(crv_3)  # Lattice curves that have not been trimmed (Typically removes curves with valence 1)
trimmed_lattice = ClusterOutput(crv_2)  # Lattice curves that have been trimmed

# ==== cluster RemoveDuplicateLines
lattice_l = ClusterInput()
crv = Curve(lattice_l)
curvepoint = PointOnCurve(crv, parameter=0.5)
cullpt = CullDuplicates(Points=curvepoint, Tolerance=".001", CullMode=1)  # -> Points, Indices, Valence
item = ListItem(List=crv, Index=cullpt.Indices, Wrap=True)
lattice = ClusterOutput(item)
