# Grasshopper definition 02-Remove Curves.gh (Grasshopper 1.0.7)
# Copyright: ©2019 GNU General Public License

# ---- group: Geometry
msphere = MeshSphere(Base=PlaneXY(0, 0, 0), Radius=10, UCount=10, VCount=20)

# ---- group: Voxelize (distance)
number_slider = Slider(4, range=0..10)
xy = XYPlane(Origin=Point(0, 0, 0))
vd = CrystallonV2VoxelizeDistance(
    geometry=msphere,
    plane=xy,
    voxel_size_x=number_slider,
    voxel_size_y=number_slider,
    voxel_size_z=number_slider,
    fill_completely=Toggle(True))

# ---- group: Cell Fill
unit_cell_selector = CrystallonV2CellSelector({"Prim. Cubic": 0, "BC": 1, "BC Cubic": 2, "FC Cubic": 3, "Edge Octa.": 4, "Vertex Octa.": 5, "NaCl": 6, "Star Tet.": 7, "BC Star Tet.": 8, "Octa. Tet.": 9, "Dodecahedron": 10, "Trunc. Octa.": 11, "Tetrahedral": 12, "Auxetic": 13, "BC1 (tween)": 14, "BC2 (tween)": 15, "Octa. (shell)": 16, "Dodeca. (shell)": 17, "Trunc. Octa. (shell)": 18, "Gyroid (shell)": 19, "Cubic Center (shell)": 20, "Cubic Face (shell)": 21, "LH Square": 22, "LH Round": 23, "LH Square (shell)": 24, "LH Auxetic (shell)": 25, "MC Tri": 26, "MS Tri (shell)": 27, "MC Quad": 28, "MS Quad (shell)": 29}, selected="BC")
ct = CrystallonV2CellType(unit_cell_selector=unit_cell_selector)
clf = CrystallonV2CellLatticeFill(unit_cell=ct, voxels=vd)

# ---- group: Trim Lattice
tl = CrystallonV2TrimLattice(geometry=msphere, lattice=clf)  # -> trimmed_lattice, unrimmed_lattice
crv = Curve([tl.trimmed_lattice, tl.unrimmed_lattice])

# ---- group: Lattice Topology
lt = CrystallonV2LatticeTopology(lattice_beams=crv, tolerance=".1")  # -> nodes, line_point_connections, point_line_connections
item = ListItem(List=lt.nodes, Index=lt.line_point_connections, Wrap=True)
pline = PolyLine(Vertices=item, Closed=False)  # -> flatten(Polyline)

# ---- group: Remove by Valence
crv_2 = Curve(pline)
rv = CrystallonV2RemoveByValence(lattice=crv_2, valence_number=Slider(1, range=0..10), flip=Toggle(True))
lng = ListLength(List=rv)
lng_2 = ListLength(List=crv_2)
preview = CustomPreview(Geometry=rv, Material=ColourSwatch(SwatchColor=RGB(0, 0, 0)))
panel = Panel(lng_2)
panel_2 = Panel(lng)

# ---- group: Merge Curves
crv_3 = Curve(pline)
mc = CrystallonV2MergeCurves(lattice=crv_3, max_distance=Slider(2.181, range=0..10))
lng_3 = ListLength(List=mc)
lng_4 = ListLength(List=crv_3)
preview_2 = CustomPreview(Geometry=mc, Material=ColourSwatch(SwatchColor=RGB(0, 0, 0)))
panel_3 = Panel(lng_4)
panel_4 = Panel(lng_3)

# ---- group: Remove Duplicates
crv_4 = Curve(pline)
rd = CrystallonV2RemoveDuplicateCurves(lattice=crv_4, tolerance=Slider(0.129, range=0..5))
lng_5 = ListLength(List=rd)
lng_6 = ListLength(List=crv_4)
preview_3 = CustomPreview(Geometry=rd, Material=ColourSwatch(SwatchColor=RGB(0, 0, 0)))
panel_5 = Panel(lng_6)
panel_6 = Panel(lng_5)

# ---- group: Remove Short
crv_5 = Curve(pline)
rs = CrystallonV2RemoveShort(lattice=crv_5, length=Slider(1.041, range=0..10))
lng_7 = ListLength(List=rs)
lng_8 = ListLength(List=crv_5)
preview_4 = CustomPreview(Geometry=rs, Material=ColourSwatch(SwatchColor=RGB(0, 0, 0)))
panel_7 = Panel(lng_8)
panel_8 = Panel(lng_7)

# ---- group: Remove Floating
crv_6 = Curve(pline)
rf = CrystallonV2RemoveFloating(lattice=crv_6)
lng_9 = ListLength(List=rf)
lng_10 = ListLength(List=crv_6)
preview_5 = CustomPreview(Geometry=rf, Material=ColourSwatch(SwatchColor=RGB(0, 0, 0)))
panel_9 = Panel(lng_10)
panel_10 = Panel(lng_9)

# ==== cluster CrystallonV2CellLatticeFill: Fill voxels with lattice unit cells

unit_cell = ClusterInput()  # Unit cell to populate voxels
voxels = ClusterInput()  # Voxels to be filled with unit cells
crv = Curve(unit_cell)
bbox = BoundingBox(Content=crv, Plane=PlaneXY(0, 0, 0), UnionBox=True)  # -> Box, Box_2
# CRYSTALLON V2.0 -- Lattice structure tools for Grasshopper3D
# 
# Copyright (C) 2019  Aaron Porterfield
# 
# www.fequalsf.com
# info@fequalsf.com
# 
#     This program is free software: you can redistribute it and/or modify
#     it under the terms of the GNU General Public License as published by
#     the Free Software Foundation, either version 3 of the License, or any later version.
# 
#     This program is distributed in the hope that it will be useful,
#     but WITHOUT ANY WARRANTY; without even the implied warranty of
#     MERCHANTABILITY or FITNESS FOR A PARTICULAR PURPOSE.  See the
#     GNU General Public License for more details.
# 
#     You should have received a copy of the GNU General Public License
#     along with this program.  If not, see <http://www.gnu.org/licenses/>.
panel = Panel("CELL FILL")
morph = BoxMorph(Geometry=crv, Reference=bbox.Box, Target=graft(voxels))  # -> flatten(Geometry)
remove_duplicate_lines = RemoveDuplicateLines(lattice_l=flatten(morph))
lattice = ClusterOutput(remove_duplicate_lines)  # List of curves that make up the lattice

# ==== cluster CrystallonV2CellType: A collection of pre-made unit cells

crv = Curve([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])
crv_2 = Curve([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])
crv_3 = Curve([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])
crv_4 = Curve([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])
crv_5 = Curve([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])
mesh = Mesh(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)
mesh_2 = Mesh(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)
mesh_3 = Mesh(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)
mesh_4 = Mesh([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])
crv_6 = Curve([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])
crv_7 = Curve([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])
crv_8 = Curve([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])
crv_9 = Curve([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])
crv_10 = Curve([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])
crv_11 = Curve([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])
crv_12 = Curve([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])
crv_13 = Curve([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])
crv_14 = Curve([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])
crv_15 = Curve([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])
crv_16 = Curve([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])
mesh_5 = Mesh(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)
mesh_6 = Mesh(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)
mesh_7 = Mesh(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)
mesh_8 = Mesh(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)
crv_17 = Curve([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])
crv_18 = Curve([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])
mesh_9 = Mesh(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)
geo = Geometry([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])
geo_2 = Geometry([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])
mesh_10 = Mesh([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])
panel = Panel("CELL TYPES")
entwine = Entwine(
    Branch00=crv_6,
    Branch01=crv_7,
    Branch02=crv,
    Branch03=crv_8,
    Branch04=crv_2,
    Branch05=crv_9,
    Branch06=crv_3,
    Branch07=crv_10,
    Branch08=crv_11,
    Branch09=crv_12,
    Branch010=crv_4,
    Branch011=crv_5,
    Branch012=crv_13,
    Branch013=crv_14,
    Branch014=crv_15,
    Branch015=crv_16,
    Branch016=mesh,
    Branch017=mesh_5,
    Branch018=mesh_6,
    Branch019=mesh_2,
    Branch020=mesh_7,
    Branch021=mesh_8,
    Branch022=crv_17,
    Branch023=crv_18,
    Branch024=mesh_9,
    Branch025=mesh_3,
    Branch026=geo,
    Branch027=mesh_4,
    Branch028=geo_2,
    Branch029=mesh_10,
    FlattenInputs=True)  # -> simplify(Result)
unit_cell_selector = ClusterInput()
branch = TreeBranch(Tree=entwine, Path=unit_cell_selector, MaintainPaths=True)
unit_cell = ClusterOutput(branch)  # Single unit cell to populate voxels

# ==== cluster CrystallonV2VoxelizeDistance: Fill a volume with equal sized voxels

voxel_size_x = ClusterInput()  # Voxel size int the X direction
voxel_size_y = ClusterInput()  # Voxel size int the Y direction
voxel_size_z = ClusterInput()  # Voxel size int the Z direction
plane = ClusterInput()  # Base plane for voxels
geometry = ClusterInput()  # Geometry to voxelize
fill_completely = ClusterInput()  # If true, Voxels will fill entire volume. If false, only Voxels with their centroid within the volume will be kept.
mesh = Mesh(geometry)
pln = Plane(plane)
num = Number(voxel_size_x)
num_2 = Number(voxel_size_y)
num_3 = Number(voxel_size_z)
bool = Boolean(fill_completely)
bbox = BoundingBox(Content=mesh, Plane=pln)  # -> Box, Box_2
edges = BrepEdges(Brep=bbox.Box)  # -> Naked, Interior, NonManifold
item = ListItem(List=edges.Interior, Index="8", Wrap=True)
item_2 = ListItem(List=edges.Interior, Index="1", Wrap=True)
item_3 = ListItem(List=edges.Interior, Index="0", Wrap=True)
divlength = DivideLength(Curve=reparameterize(item_2), Length=num_2)  # -> Points, Tangents, Parameters
divlength_2 = DivideLength(Curve=reparameterize(item_3), Length=num)  # -> Points, Tangents, Parameters
divlength_3 = DivideLength(Curve=reparameterize(item), Length=num_3)  # -> Points, Tangents, Parameters
reldif = RelativeDifferences(Values=divlength.Parameters)
reldif_2 = RelativeDifferences(Values=divlength_2.Parameters)
reldif_3 = RelativeDifferences(Values=divlength_3.Parameters)
item_4 = ListItem(List=reverse(divlength.Parameters), Index=0, Wrap=True)
item_5 = ListItem(List=reverse(reldif), Index=0, Wrap=True)
item_6 = ListItem(List=reverse(divlength_2.Parameters), Index=0, Wrap=True)
item_7 = ListItem(List=reverse(reldif_2), Index=0, Wrap=True)
item_8 = ListItem(List=reverse(divlength_3.Parameters), Index=0, Wrap=True)
item_9 = ListItem(List=reverse(reldif_3), Index=0, Wrap=True)
addition = Addition(A=item_5, B=item_4)
addition_2 = Addition(A=item_7, B=item_6)
addition_3 = Addition(A=item_9, B=item_8)
merge = Merge(Data1=divlength.Parameters, Data2=addition)
merge_2 = Merge(Data1=divlength_2.Parameters, Data2=addition_2)
merge_3 = Merge(Data1=divlength_3.Parameters, Data2=addition_3)
crossref = CrossReference(ListA=merge, ListB=merge_3, CrossMode=1)  # -> ListA, ListB
box = EvaluateBox(Box=bbox.Box, UParameter=graft(merge_2), VParameter=crossref.ListA, WParameter=crossref.ListB)  # -> Plane, Point, Include
panel = Panel("Voxelize")
division = Division(A=num_3, B="2")
division_2 = Division(A=num_2, B="2")
division_3 = Division(A=num, B="2")
neg = Negative(Value=division)
neg_2 = Negative(Value=division_2)
neg_3 = Negative(Value=division_3)
dom = ConstructDomain(DomainStart=neg, DomainEnd=division)
dom_2 = ConstructDomain(DomainStart=neg_2, DomainEnd=division_2)
dom_3 = ConstructDomain(DomainStart=neg_3, DomainEnd=division_3)
crossref_2 = CrossReference(ListA=dom_2, ListB=dom, CrossMode=1)  # -> ListA, ListB
box_2 = DomainBox(Base=simplify(box.Plane), X=graft(dom_3), Y=crossref_2.ListA, Z=crossref_2.ListB)
minc = MeshInclusion(Mesh=mesh, Point=box.Plane, Strict=False)
sort = SortList(Keys=[num, num_2, num_3])  # -> Keys, ValuesA
cull = CullPattern(List=box_2, CullPattern=minc)
meshcp = MeshClosestPoint(Point=box.Plane, Mesh=mesh)  # -> Point, Index, Parameter
dist = Distance(PointA=box.Plane, PointB=meshcp.Point)
expression = Expression(a=sort.Keys, d=dist, Expression="if(d<sqrt(2*(a/2)^2),True,False)")
cull_2 = CullPattern(List=box_2, CullPattern=expression)
cull_3 = CullPattern(List=cull_2, CullPattern=bool)
merge_4 = Merge(Data1=cull, Data2=cull_3)
voxels = ClusterOutput(merge_4)  # Voxels to be filled with unit cells

# ==== cluster CrystallonV2TrimLattice: Trim lattice with a closed volume

geometry = ClusterInput()  # Geometry to trim with (closed brep or mesh)
lattice = ClusterInput()  # Lattice curves to trim
geo = Geometry(geometry)
crv = Curve(lattice)
mesh = Mesh(geo)
mcx = MeshCurve(Mesh=mesh, Curve=crv)  # -> Points, Faces
null = NullItem(Item=mcx.Points)  # -> NullFlags, InvalidFlags, Description
crv_cp = CurveClosestPoint(Point=mcx.Points, Curve=graft(crv))  # -> Point, Parameter, Distance
panel = Panel("TRIM LATTICE")
cull = CullPattern(List=graft(crv), CullPattern=null.NullFlags)
shatter = Shatter(Curve=graft(crv), Parameters=crv_cp.Parameter)
curvepoint = PointOnCurve(cull, parameter=0.5)
curvepoint_2 = PointOnCurve(shatter, parameter=0.5)
minc = MeshInclusion(Mesh=mesh, Point=curvepoint, Strict=False)
minc_2 = MeshInclusion(Mesh=mesh, Point=curvepoint_2, Strict=False)
cull_2 = CullPattern(List=shatter, CullPattern=minc_2)
cull_3 = CullPattern(List=cull, CullPattern=minc)
crv_2 = Curve(flatten(cull_2))
crv_3 = Curve(flatten(cull_3))
unrimmed_lattice = ClusterOutput(crv_3)  # Lattice curves that have not been trimmed (Typically removes curves with valence 1)
trimmed_lattice = ClusterOutput(crv_2)  # Lattice curves that have been trimmed

# ==== cluster CrystallonV2RemoveDuplicateCurves: Remove duplicate curves (that share the same midpoint)

tolerance = ClusterInput()  # Tolerance for merging curves (number usually between 0.001 and 0.1)
lattice = ClusterInput()  # Lattice curves to filter
crv = Curve(lattice)
curvepoint = PointOnCurve(crv, parameter=0.5)
panel = Panel("REMOVE DUPLICATE CURVES")
cullpt = CullDuplicates(Points=curvepoint, Tolerance=tolerance, CullMode=1)  # -> Points, Indices, Valence
item = ListItem(List=crv, Index=cullpt.Indices, Wrap=True)
lattice_2 = ClusterOutput(item)  # Filtered lattice

# ==== cluster CrystallonV2RemoveFloating: Remove floating curves with no connections

lattice = ClusterInput()  # Lattice curves to filter
crv = Curve(flatten(lattice))
join = JoinCurves(Curves=crv, Preserve=False)
cp = ControlPoints(Curve=join)  # -> Points, Weights, Knots
panel = Panel("REMOVE FLOATING CURVES")
lng = ListLength(List=cp.Points)
larger = LargerThan(FirstNumber=lng, SecondNumber="3")  # -> flatten(LargerThan), OrEqualTo
cull = CullPattern(List=join, CullPattern=larger.LargerThan)
explode = Explode(Curve=cull, Recursive=True)  # -> flatten(Segments), Vertices
lattice_2 = ClusterOutput(explode.Segments)  # Filtered lattice

# ==== cluster CrystallonV2RemoveShort: Remove curves by length

lattice = ClusterInput()  # Lattice curves to filter
length = ClusterInput()  # Minimum lenth of lattice curves
crv = Curve(lattice)
len = Length(Curve=crv)
panel = Panel("REMOVE SHORT LINES")
larger = LargerThan(FirstNumber=len, SecondNumber=length)  # -> LargerThan, OrEqualTo
cull = CullPattern(List=crv, CullPattern=larger.LargerThan)
lattice_2 = ClusterOutput(cull)  # Filtered lattice

# ==== cluster CrystallonV2RemoveByValence: Remove curves by number of connections

lattice = ClusterInput()  # Lattice curves to filter
flip = ClusterInput()  # If true curves under valence number are removed. If false curves over valence number are removed.
valence_number = ClusterInput()  # The number of connections each curve has
num = Number(valence_number)
crv = Curve(lattice)
bool = Boolean(flip)
cp = ControlPoints(Curve=crv)  # -> Points, Weights, Knots
cps = ClosestPoints(Point=cp.Points, Cloud=flatten(cp.Points), Count=expr("x+1", num))  # -> ClosestPoint, CPIndex, simplify(Distance)
panel = Panel("REMOVE BY VALENCE")
trim = TrimTree(Tree=cps.Distance, Depth=1)
not = GateNot(A=bool)
ma = MassAddition(Input=trim)  # -> Result, PartialResults
smaller = SmallerThan(FirstNumber=ma.Result, SecondNumber="0")  # -> SmallerThan, OrEqualTo
not_2 = GateNot(A=smaller.OrEqualTo)
cull = CullPattern(List=smaller.OrEqualTo, CullPattern=bool)
cull_2 = CullPattern(List=not_2, CullPattern=not)
cull_3 = CullPattern(List=graft(crv), CullPattern=[cull_2, cull])  # -> flatten(List)
lattice_2 = ClusterOutput(cull_3)  # Filtered lattice

# ==== cluster CrystallonV2LatticeTopology: Creates a clean graph from a lattice with unique nodes and their connections

tolerance = ClusterInput()  # Tolerance to merge points
lattice_beams = ClusterInput()  # Lattice Curves
num = Number(tolerance)
crv = Curve(lattice_beams)
cp = ControlPoints(Curve=crv)  # -> simplify(Points), Weights, Knots
cullpt = CullDuplicates(Points=flatten(cp.Points), Tolerance=num, CullMode=3)  # -> Points, Indices, Valence
sort_pt = SortPoints(Points=cullpt.Points)  # -> Points, Indices
lng = ListLength(List=crv)
lng_2 = ListLength(List=sort_pt.Points)
fsim = FindSimilarMember(Data=cp.Points, Set=sort_pt.Points)  # -> Hit, simplify(Index)
series = Series(Start=0, Step=1, Count=lng)  # -> simplify(Series)
series_2 = Series(Start=0, Step=1, Count=lng_2)  # -> simplify(Series)
panel = Panel("LATTICE TOPOLOGY")
num_2 = Number(fsim.Index)
pt = Point(sort_pt.Points)
equals = Equality(FirstNumber=series_2, SecondNumber=graft(num_2))  # -> Equality, Inequality
flip = FlipMatrix(Data=equals.Equality)
partition = PartitionList(List=flip, Size="2")  # -> simplify(Chunks)
item = ListItem(List=partition, Index=0, Wrap=True)  # -> Item, Item1
or = GateOr(A=item.Item, B=item.Item1)
trim = TrimTree(Tree=or, Depth=1)
cull = CullPattern(List=series, CullPattern=trim)  # -> simplify(List)
nodes = ClusterOutput(pt)  # Unique points in the network
line_point_connections = ClusterOutput(num_2)  # Index of points that make up each beam
point_line_connections = ClusterOutput(cull)  # For each point, lists the index of each line connected to it

# ==== cluster CrystallonV2MergeCurves: Merge endpoints of curves by distance.

max_distance = ClusterInput()  # Maximum distance to merge
lattice = ClusterInput()  # Lattice to merge
crv = Curve(lattice)
num = Number(max_distance)
cp = ControlPoints(Curve=crv)  # -> Points, Weights, Knots
cullpt = CullDuplicates(Points=flatten(cp.Points), Tolerance=num, CullMode=3)  # -> Points, Indices, Valence
fsim = FindSimilarMember(Data=cp.Points, Set=cullpt.Points)  # -> Hit, Index
panel = Panel("MERGE CURVES")
pline = PolyLine(Vertices=fsim.Hit, Closed=False)  # -> flatten(Polyline)
len = Length(Curve=pline)
larger = LargerThan(FirstNumber=len, SecondNumber="0")  # -> LargerThan, OrEqualTo
cull = CullPattern(List=pline, CullPattern=larger.LargerThan)
lattice_2 = ClusterOutput(cull)  # Merged lattice

# ==== cluster RemoveDuplicateLines
lattice_l = ClusterInput()
crv = Curve(lattice_l)
curvepoint = PointOnCurve(crv, parameter=0.5)
cullpt = CullDuplicates(Points=curvepoint, Tolerance=".001", CullMode=1)  # -> Points, Indices, Valence
item = ListItem(List=crv, Index=cullpt.Indices, Wrap=True)
lattice = ClusterOutput(item)
