# Grasshopper definition 03-Morph Lattice.gh (Grasshopper 1.0.7)
# Copyright: ©2019 GNU General Public License

# ---- group: Geometry
msphere = MeshSphere(Base=PlaneXY(0, 0, 0), Radius=10, UCount=10, VCount=20)

# ---- group: Voxelize (distance)
number_slider = Slider(3, range=0..10)
xy = XYPlane(Origin=Point(0, 0, 0))
vd = CrystallonV2VoxelizeDistance(
    geometry=msphere,
    plane=xy,
    voxel_size_x=number_slider,
    voxel_size_y=number_slider,
    voxel_size_z=number_slider,
    fill_completely=Toggle(True))

# ---- group: Cell Fill
unit_cell_selector = CrystallonV2CellSelector({"Prim. Cubic": 0, "BC": 1, "BC Cubic": 2, "FC Cubic": 3, "Edge Octa.": 4, "Vertex Octa.": 5, "NaCl": 6, "Star Tet.": 7, "BC Star Tet.": 8, "Octa. Tet.": 9, "Dodecahedron": 10, "Trunc. Octa.": 11, "Tetrahedral": 12, "Auxetic": 13, "BC1 (tween)": 14, "BC2 (tween)": 15, "Octa. (shell)": 16, "Dodeca. (shell)": 17, "Trunc. Octa. (shell)": 18, "Gyroid (shell)": 19, "Cubic Center (shell)": 20, "Cubic Face (shell)": 21, "LH Square": 22, "LH Round": 23, "LH Square (shell)": 24, "LH Auxetic (shell)": 25, "MC Tri": 26, "MS Tri (shell)": 27, "MC Quad": 28, "MS Quad (shell)": 29}, selected="BC")
ct = CrystallonV2CellType(unit_cell_selector=unit_cell_selector)
clf = CrystallonV2CellLatticeFill(unit_cell=ct, voxels=vd)

# ---- group: Shell Fill
unit_cell_selector_2 = CrystallonV2CellSelector({"Prim. Cubic": 0, "BC": 1, "BC Cubic": 2, "FC Cubic": 3, "Edge Octa.": 4, "Vertex Octa.": 5, "NaCl": 6, "Star Tet.": 7, "BC Star Tet.": 8, "Octa. Tet.": 9, "Dodecahedron": 10, "Trunc. Octa.": 11, "Tetrahedral": 12, "Auxetic": 13, "BC1 (tween)": 14, "BC2 (tween)": 15, "Octa. (shell)": 16, "Dodeca. (shell)": 17, "Trunc. Octa. (shell)": 18, "Gyroid (shell)": 19, "Cubic Center (shell)": 20, "Cubic Face (shell)": 21, "LH Square": 22, "LH Round": 23, "LH Square (shell)": 24, "LH Auxetic (shell)": 25, "MC Tri": 26, "MS Tri (shell)": 27, "MC Quad": 28, "MS Quad (shell)": 29}, selected="Gyroid (shell)")
ct_2 = CrystallonV2CellType(unit_cell_selector=unit_cell_selector_2)
csf = CrystallonV2CellShellFill(unit_cell_shell=ct_2, voxels=vd, tolerance=".1")

# ----
mesh = Mesh(msphere)

# ---- group: Trim Lattice
tl = CrystallonV2TrimLattice(geometry=msphere, lattice=clf)  # -> trimmed_lattice, unrimmed_lattice
crv = Curve(tl.unrimmed_lattice)
preview = CustomPreview(Geometry=crv, Material=ColourSwatch(SwatchColor=RGB(0, 0, 0)))

# ----
demesh = DeconstructMesh(Mesh=mesh)  # -> Vertices, Faces, Colours, Normals

# ---- group: Skin
medges = MeshEdges(Mesh=mesh)  # -> NakedEdges, InteriorEdges, NonManifoldEdges
crv_2 = Curve(medges.InteriorEdges)
preview_2 = CustomPreview(Geometry=[crv_2, demesh.Vertices], Material=ColourSwatch(SwatchColor=RGB(0, 30, 255)))

# ---- group: Trim Shell
ts = CrystallonV2TrimShell(geometry=mesh, lattice_shell=csf)

# ---- group: Lattice Connections
lc = CrystallonV2LatticeConnections(lattice_a=crv, lattice_b=crv_2, number_of_connections=Slider(3, range=0..10), max_distance=Slider(2.837, range=0..10))
preview_3 = CustomPreview(Geometry=lc, Material=ColourSwatch(SwatchColor=RGB(255, 0, 0)))

# ---- group: Morph Shell to Skin
mss = CrystallonV2MorphShellToSkin(lattice_shell=ts, geometry=mesh, max_distance=Slider(0.591, range=0..10))
preview_4 = CustomPreview(Geometry=mss, Material=ColourSwatch(SwatchColor=RGB(150, 150, 150)))

# ---- group: Morph Lattice to Skin
mls = CrystallonV2MorphLatticeToSkin(
    lattice=crv,
    geometry=mesh,
    max_distance=Slider(1.044, range=0..10),
    geometry_2=demesh.Vertices,
    max_distance_2=Slider(6.008, range=0..10))
preview_5 = CustomPreview(Geometry=mls, Material=ColourSwatch(SwatchColor=RGB(255, 0, 0)))

# ==== cluster CrystallonV2LatticeConnections: Create connections between two lattices

lattice_b = ClusterInput()  # Second lattice to make connections between
lattice_a = ClusterInput()  # First lattice to make connections between
number_of_connections = ClusterInput()  # Number of Connections
max_distance = ClusterInput()  # Maximum distance between connections
crv = Curve(lattice_a)
crv_2 = Curve(lattice_b)
cp = ControlPoints(Curve=crv)  # -> Points, Weights, Knots
cp_2 = ControlPoints(Curve=crv_2)  # -> Points, Weights, Knots
cullpt = CullDuplicates(Points=flatten(cp.Points), Tolerance=0.1, CullMode=1)  # -> Points, Indices, Valence
cullpt_2 = CullDuplicates(Points=flatten(cp_2.Points), Tolerance=0.1, CullMode=1)  # -> Points, Indices, Valence
# CRYSTALLON V2.0 -- Lattice structure tools for Grasshopper3D
# 
# Copyright (C) 2019  Aaron Porterfield
# 
# www.fequalsf.com
# info@fequalsf.com
# 
#     This program is free software: you can redistribute it and/or modify
#     it under the terms of the GNU General Public License as published by
#     the Free Software Foundation, either version 3 of the License, or any later version.
# 
#     This program is distributed in the hope that it will be useful,
#     but WITHOUT ANY WARRANTY; without even the implied warranty of
#     MERCHANTABILITY or FITNESS FOR A PARTICULAR PURPOSE.  See the
#     GNU General Public License for more details.
# 
#     You should have received a copy of the GNU General Public License
#     along with this program.  If not, see <http://www.gnu.org/licenses/>.
panel = Panel("LATTICE CONNECTIONS")
cps = ClosestPoints(Point=cullpt.Points, Cloud=cullpt_2.Points, Count=number_of_connections)  # -> ClosestPoint, CPIndex, Distance
smaller = SmallerThan(FirstNumber=cps.Distance, SecondNumber=max_distance)  # -> SmallerThan, OrEqualTo
cull = CullPattern(List=cps.ClosestPoint, CullPattern=smaller.SmallerThan)
ln = Line(StartPoint=graft(cullpt.Points), EndPoint=cull)
lattice = ClusterOutput(ln)  # Lattice connections

# ==== cluster CrystallonV2MorphLatticeToSkin: Morph lattice to connect to skin

geometry = ClusterInput()  # Geometry to morph to
lattice = ClusterInput()  # Lattice to morph to skin
geometry_2 = ClusterInput()  # Geometry to morph to
max_distance = ClusterInput()  # Maximum distance from geometry
max_distance_2 = ClusterInput()  # Maximum distance to moprh
geo = Geometry(geometry_2)
crv = Curve(lattice)
geo_2 = Geometry(geometry)
cp = ControlPoints(Curve=crv)  # -> simplify(Points), Weights, Knots
pull = PullPoint(Point=cp.Points, Geometry=geo_2, ClosestOnly=True)  # -> ClosestPoint, Distance
smaller = SmallerThan(FirstNumber=pull.Distance, SecondNumber=max_distance)  # -> SmallerThan, OrEqualTo
not = GateNot(A=smaller.SmallerThan)
cull = CullPattern(List=cp.Points, CullPattern=smaller.SmallerThan)
cull_2 = CullPattern(List=cp.Points, CullPattern=not)  # -> simplify(List)
pull_2 = PullPoint(Point=cull, Geometry=geo, ClosestOnly=True)  # -> simplify(ClosestPoint), simplify(Distance)
smaller_2 = SmallerThan(FirstNumber=pull_2.Distance, SecondNumber=max_distance_2)  # -> SmallerThan, OrEqualTo
not_2 = GateNot(A=smaller_2.SmallerThan)
panel = Panel("MORPH TO SKIN")
cull_3 = CullPattern(List=pull_2.ClosestPoint, CullPattern=smaller_2.SmallerThan)  # -> simplify(List)
cull_4 = CullPattern(List=cull, CullPattern=not_2)  # -> simplify(List)
merge = Merge(Data1=cull_2, Data2=cull_4, Data3=cull_3)
item = ListItem(List=merge, Index=0, Wrap=True)  # -> Item1, Item, Item1_2
ln = Line(StartPoint=item.Item1, EndPoint=item.Item)
remove_duplicate_lines = RemoveDuplicateLines(lattice_l=flatten(ln))
len = Length(Curve=remove_duplicate_lines)
larger = LargerThan(FirstNumber=len, SecondNumber=0)  # -> LargerThan, OrEqualTo
cull_5 = CullPattern(List=remove_duplicate_lines, CullPattern=larger.LargerThan)
crv_2 = Curve(cull_5)
lattice_2 = ClusterOutput(crv_2)  # Morphed lattice

# ==== cluster CrystallonV2MorphShellToSkin: Morph shell lattice to connect to skin

# ----
# MORPH SHELL TO SKIN
lattice_shell = ClusterInput()  # Lattice shell to moprh
geometry = ClusterInput()  # Geometry to morph to
max_distance = ClusterInput()  # Maximum distance from geometry
mesh = Mesh(lattice_shell)
geo = Geometry(geometry)
mesh_2 = Mesh(geo)
demesh = DeconstructMesh(Mesh=mesh)  # -> Vertices, Faces, Colours, Normals
pull = PullPoint(Point=demesh.Vertices, Geometry=mesh_2, ClosestOnly=True)  # -> ClosestPoint, Distance
lng = ListLength(List=demesh.Vertices)
smaller = SmallerThan(FirstNumber=pull.Distance, SecondNumber=max_distance)  # -> SmallerThan, OrEqualTo
series = Series(Start=0, Step=1, Count=lng)
cull = CullPattern(List=pull.ClosestPoint, CullPattern=smaller.SmallerThan)
cull_2 = CullPattern(List=series, CullPattern=smaller.SmallerThan)
replace = ReplaceItems(List=demesh.Vertices, Item=cull, Indices=cull_2, Wrap=False)
conmesh = ConstructMesh(Vertices=replace, Faces=demesh.Faces)
trimmed_lattice_shell = ClusterOutput(conmesh)  # Trimmed lattice shell

# ==== cluster CrystallonV2CellLatticeFill: Fill voxels with lattice unit cells

unit_cell = ClusterInput()  # Unit cell to populate voxels
voxels = ClusterInput()  # Voxels to be filled with unit cells
crv = Curve(unit_cell)
bbox = BoundingBox(Content=crv, Plane=PlaneXY(0, 0, 0), UnionBox=True)  # -> Box, Box_2
panel = Panel("CELL FILL")
morph = BoxMorph(Geometry=crv, Reference=bbox.Box, Target=graft(voxels))  # -> flatten(Geometry)
remove_duplicate_lines = RemoveDuplicateLines(lattice_l=flatten(morph))
lattice = ClusterOutput(remove_duplicate_lines)  # List of curves that make up the lattice

# ==== cluster CrystallonV2CellType: A collection of pre-made unit cells

crv = Curve([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])
crv_2 = Curve([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])
crv_3 = Curve([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])
crv_4 = Curve([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])
crv_5 = Curve([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])
mesh = Mesh(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)
mesh_2 = Mesh(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)
mesh_3 = Mesh(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)
mesh_4 = Mesh([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])
crv_6 = Curve([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])
crv_7 = Curve([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])
crv_8 = Curve([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])
crv_9 = Curve([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])
crv_10 = Curve([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])
crv_11 = Curve([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])
crv_12 = Curve([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])
crv_13 = Curve([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])
crv_14 = Curve([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])
crv_15 = Curve([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])
crv_16 = Curve([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])
mesh_5 = Mesh(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)
mesh_6 = Mesh(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)
mesh_7 = Mesh(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)
mesh_8 = Mesh(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)
crv_17 = Curve([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])
crv_18 = Curve([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])
mesh_9 = Mesh(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)
geo = Geometry([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])
geo_2 = Geometry([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])
mesh_10 = Mesh([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])
panel = Panel("CELL TYPES")
entwine = Entwine(
    Branch00=crv_6,
    Branch01=crv_7,
    Branch02=crv,
    Branch03=crv_8,
    Branch04=crv_2,
    Branch05=crv_9,
    Branch06=crv_3,
    Branch07=crv_10,
    Branch08=crv_11,
    Branch09=crv_12,
    Branch010=crv_4,
    Branch011=crv_5,
    Branch012=crv_13,
    Branch013=crv_14,
    Branch014=crv_15,
    Branch015=crv_16,
    Branch016=mesh,
    Branch017=mesh_5,
    Branch018=mesh_6,
    Branch019=mesh_2,
    Branch020=mesh_7,
    Branch021=mesh_8,
    Branch022=crv_17,
    Branch023=crv_18,
    Branch024=mesh_9,
    Branch025=mesh_3,
    Branch026=geo,
    Branch027=mesh_4,
    Branch028=geo_2,
    Branch029=mesh_10,
    FlattenInputs=True)  # -> simplify(Result)
unit_cell_selector = ClusterInput()
branch = TreeBranch(Tree=entwine, Path=unit_cell_selector, MaintainPaths=True)
unit_cell = ClusterOutput(branch)  # Single unit cell to populate voxels

# ==== cluster CrystallonV2VoxelizeDistance: Fill a volume with equal sized voxels

voxel_size_x = ClusterInput()  # Voxel size int the X direction
voxel_size_y = ClusterInput()  # Voxel size int the Y direction
voxel_size_z = ClusterInput()  # Voxel size int the Z direction
plane = ClusterInput()  # Base plane for voxels
geometry = ClusterInput()  # Geometry to voxelize
fill_completely = ClusterInput()  # If true, Voxels will fill entire volume. If false, only Voxels with their centroid within the volume will be kept.
mesh = Mesh(geometry)
pln = Plane(plane)
num = Number(voxel_size_x)
num_2 = Number(voxel_size_y)
num_3 = Number(voxel_size_z)
bool = Boolean(fill_completely)
bbox = BoundingBox(Content=mesh, Plane=pln)  # -> Box, Box_2
edges = BrepEdges(Brep=bbox.Box)  # -> Naked, Interior, NonManifold
item = ListItem(List=edges.Interior, Index="8", Wrap=True)
item_2 = ListItem(List=edges.Interior, Index="1", Wrap=True)
item_3 = ListItem(List=edges.Interior, Index="0", Wrap=True)
divlength = DivideLength(Curve=reparameterize(item_2), Length=num_2)  # -> Points, Tangents, Parameters
divlength_2 = DivideLength(Curve=reparameterize(item_3), Length=num)  # -> Points, Tangents, Parameters
divlength_3 = DivideLength(Curve=reparameterize(item), Length=num_3)  # -> Points, Tangents, Parameters
reldif = RelativeDifferences(Values=divlength.Parameters)
reldif_2 = RelativeDifferences(Values=divlength_2.Parameters)
reldif_3 = RelativeDifferences(Values=divlength_3.Parameters)
item_4 = ListItem(List=reverse(divlength.Parameters), Index=0, Wrap=True)
item_5 = ListItem(List=reverse(reldif), Index=0, Wrap=True)
item_6 = ListItem(List=reverse(divlength_2.Parameters), Index=0, Wrap=True)
item_7 = ListItem(List=reverse(reldif_2), Index=0, Wrap=True)
item_8 = ListItem(List=reverse(divlength_3.Parameters), Index=0, Wrap=True)
item_9 = ListItem(List=reverse(reldif_3), Index=0, Wrap=True)
addition = Addition(A=item_5, B=item_4)
addition_2 = Addition(A=item_7, B=item_6)
addition_3 = Addition(A=item_9, B=item_8)
merge = Merge(Data1=divlength.Parameters, Data2=addition)
merge_2 = Merge(Data1=divlength_2.Parameters, Data2=addition_2)
merge_3 = Merge(Data1=divlength_3.Parameters, Data2=addition_3)
crossref = CrossReference(ListA=merge, ListB=merge_3, CrossMode=1)  # -> ListA, ListB
box = EvaluateBox(Box=bbox.Box, UParameter=graft(merge_2), VParameter=crossref.ListA, WParameter=crossref.ListB)  # -> Plane, Point, Include
panel = Panel("Voxelize")
division = Division(A=num_3, B="2")
division_2 = Division(A=num_2, B="2")
division_3 = Division(A=num, B="2")
neg = Negative(Value=division)
neg_2 = Negative(Value=division_2)
neg_3 = Negative(Value=division_3)
dom = ConstructDomain(DomainStart=neg, DomainEnd=division)
dom_2 = ConstructDomain(DomainStart=neg_2, DomainEnd=division_2)
dom_3 = ConstructDomain(DomainStart=neg_3, DomainEnd=division_3)
crossref_2 = CrossReference(ListA=dom_2, ListB=dom, CrossMode=1)  # -> ListA, ListB
box_2 = DomainBox(Base=simplify(box.Plane), X=graft(dom_3), Y=crossref_2.ListA, Z=crossref_2.ListB)
minc = MeshInclusion(Mesh=mesh, Point=box.Plane, Strict=False)
sort = SortList(Keys=[num, num_2, num_3])  # -> Keys, ValuesA
cull = CullPattern(List=box_2, CullPattern=minc)
meshcp = MeshClosestPoint(Point=box.Plane, Mesh=mesh)  # -> Point, Index, Parameter
dist = Distance(PointA=box.Plane, PointB=meshcp.Point)
expression = Expression(a=sort.Keys, d=dist, Expression="if(d<sqrt(2*(a/2)^2),True,False)")
cull_2 = CullPattern(List=box_2, CullPattern=expression)
cull_3 = CullPattern(List=cull_2, CullPattern=bool)
merge_4 = Merge(Data1=cull, Data2=cull_3)
voxels = ClusterOutput(merge_4)  # Voxels to be filled with unit cells

# ==== cluster CrystallonV2TrimLattice: Trim lattice with a closed volume

geometry = ClusterInput()  # Geometry to trim with (closed brep or mesh)
lattice = ClusterInput()  # Lattice curves to trim
geo = Geometry(geometry)
crv = Curve(lattice)
mesh = Mesh(geo)
mcx = MeshCurve(Mesh=mesh, Curve=crv)  # -> Points, Faces
null = NullItem(Item=mcx.Points)  # -> NullFlags, InvalidFlags, Description
crv_cp = CurveClosestPoint(Point=mcx.Points, Curve=graft(crv))  # -> Point, Parameter, Distance
panel = Panel("TRIM LATTICE")
cull = CullPattern(List=graft(crv), CullPattern=null.NullFlags)
shatter = Shatter(Curve=graft(crv), Parameters=crv_cp.Parameter)
curvepoint = PointOnCurve(cull, parameter=0.5)
curvepoint_2 = PointOnCurve(shatter, parameter=0.5)
minc = MeshInclusion(Mesh=mesh, Point=curvepoint, Strict=False)
minc_2 = MeshInclusion(Mesh=mesh, Point=curvepoint_2, Strict=False)
cull_2 = CullPattern(List=shatter, CullPattern=minc_2)
cull_3 = CullPattern(List=cull, CullPattern=minc)
crv_2 = Curve(flatten(cull_2))
crv_3 = Curve(flatten(cull_3))
unrimmed_lattice = ClusterOutput(crv_3)  # Lattice curves that have not been trimmed (Typically removes curves with valence 1)
trimmed_lattice = ClusterOutput(crv_2)  # Lattice curves that have been trimmed

# ==== cluster CrystallonV2CellShellFill: Fill voxels with shell unit cells

unit_cell_shell = ClusterInput()  # Unit cell to populate voxels
tolerance = ClusterInput()  # Tolerance for merging faces and vertices (number usually between 0.001 and 0.1)
voxels = ClusterInput()  # Voxels to be filled with unit cells
geo = Geometry(unit_cell_shell)
bbox = BoundingBox(Content=geo, Plane=PlaneXY(0, 0, 0), UnionBox=True)  # -> Box, Box_2
morph = BoxMorph(Geometry=geo, Reference=bbox.Box, Target=graft(voxels))  # -> flatten(Geometry)
mjoin = MeshJoin(Meshes=morph)
panel = Panel("CELL SHELL FILL")
demesh = DeconstructMesh(Mesh=mjoin)  # -> Vertices, Faces, Colours, Normals
facen = FaceNormals(Mesh=mjoin)  # -> Centers, Normals
cullpt = CullDuplicates(Points=facen.Centers, Tolerance=tolerance, CullMode=1)  # -> Points, Indices, Valence
item = ListItem(List=demesh.Faces, Index=cullpt.Indices, Wrap=True)
conmesh = ConstructMesh(Vertices=demesh.Vertices, Faces=item)
weld = WeldMesh(Mesh=conmesh, Angle=3.141592654)
c_script = CSharpScript(M=weld, radius=tolerance)  # -> out, A; inputs M: Mesh, radius: Double
# ---------- c_script: C# usings ----------
using System.IO;
using System.Linq;
using System.Data;
using System.Drawing;
using System.Reflection;
using System.Windows.Forms;
using System.Xml;
using System.Xml.Linq;
using System.Runtime.InteropServices;

using Rhino.DocObjects;
using Rhino.Collections;
using GH_IO;
using GH_IO.Serialization;
# ---------- c_script: C# ----------
    Component.Message = "Weld Mesh - RTree";


    //Store naked mesh vertices and their ids
    List<Point3f> pts = new List<Point3f>();
    bool[] flag = M.GetNakedEdgePointStatus();

    allPointsFound = new List<List<int>>();

    //History is need to stop searching rtee
    //When all point groups are found
    history.Clear();

    //Create Rtree
    RTree tree = new RTree();

    for(int i = 0; i < flag.Length; i++){
      if(flag[i]){
        tree.Insert(M.Vertices[i], i);
        pts.Add(M.Vertices[i]);
      }
    }

    //Search RTree
    for(int i = 0; i < pts.Count; i++){
      tempIDList = new List<int>();
      tree.Search(new Sphere(pts[i], radius), method);

      if(tempIDList.Count > 1)
        allPointsFound.Add(tempIDList);

      if(history.Count == M.Vertices.Count)
        break;
    }

    //Now move found vertices to one of firs vertex position
    foreach(List<int> i in allPointsFound)
      for(int j = 1; j < i.Count; j++)
        M.Vertices[i[0]] = M.Vertices[i[j]];

    M.Vertices.CombineIdentical(true, true);


    A = M;
# ---------- c_script: C# additional code ----------
  //Rtree collections
  List<int> history = new List<int>();
  List<List<int>> allPointsFound;
  List<int> tempIDList;

  private void method(object sender, RTreeEventArgs e){
    if(!history.Contains(e.Id)){
      tempIDList.Add(e.Id);
      history.Add(e.Id);
    }
  }
# ---------- end c_script ----------
lattice_shell = ClusterOutput(c_script.A)  # Joined mesh that makes up the lattice

# ==== cluster CrystallonV2TrimShell: Trim shell lattice with a closed volume

lattice_shell = ClusterInput()  # Lattice shell to trim
geometry = ClusterInput()  # Geometry to trim with (closed brep or mesh)
geo = Geometry(geometry)
mjoin = MeshJoin(Meshes=flatten(lattice_shell))
mesh = Mesh(geo)
weld = WeldMesh(Mesh=mjoin, Angle=3.141592654)
panel = Panel("TRIM SHELL")
demesh = DeconstructMesh(Mesh=weld)  # -> Vertices, Faces, Colours, Normals
minc = MeshInclusion(Mesh=mesh, Point=demesh.Vertices, Strict=False)
not = GateNot(A=minc)
cullv = CullVertices(Mesh=weld, Pattern=not, Shrink=True)
trimmed_lattice_shell = ClusterOutput(cullv)  # Trimmed lattice shell

# ==== cluster RemoveDuplicateLines
lattice_l = ClusterInput()
crv = Curve(lattice_l)
curvepoint = PointOnCurve(crv, parameter=0.5)
cullpt = CullDuplicates(Points=curvepoint, Tolerance=".001", CullMode=1)  # -> Points, Indices, Valence
item = ListItem(List=crv, Index=cullpt.Indices, Wrap=True)
lattice = ClusterOutput(item)
