# Grasshopper definition 01-Lattice Hinge.gh (Grasshopper 1.0.7)
# Copyright: ©2019 GNU General Public License

# ---- group: Lattice Hinge
crv = Curve(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)
crv_2 = Curve(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)
lh = CrystallonV2LatticeHinge(
    curve1=crv,
    curve2=crv_2,
    u_divisions=Slider(50, range=0..100),
    v_divisions=Slider(10, range=0..100),
    influence=Slider(0.17, range=0..1),
    voxel_height=Slider(1, range=0..1))  # -> voxels_rolled, voxels_unrolled, panels_rolled, panels_unrolled, panel_values, unrolled_surface
gradient = Gradient(
    LowerLimit=0,
    UpperLimit=1,
    Parameter=lh.panel_values,
    stops=[0: RGB(234, 38, 0), 0.25: RGB(234, 126, 0), 0.5: RGB(254, 244, 84), 0.75: RGB(173, 203, 249), 1: RGB(75, 107, 169)])
srf = Surface(lh.panels_rolled)
srf_2 = Surface(lh.unrolled_surface)
preview = CustomPreview(Geometry=srf, Material=gradient)
preview_2 = CustomPreview(Geometry=srf_2, Material=ColourSwatch(SwatchColor=RGBA(0, 255, 255, 57)))

# ---- group: LH Cell Fill
unit_cell_selector = CrystallonV2CellSelector({"Prim. Cubic": 0, "BC": 1, "BC Cubic": 2, "FC Cubic": 3, "Edge Octa.": 4, "Vertex Octa.": 5, "NaCl": 6, "Star Tet.": 7, "BC Star Tet.": 8, "Octa. Tet.": 9, "Dodecahedron": 10, "Trunc. Octa.": 11, "Tetrahedral": 12, "Auxetic": 13, "BC1 (tween)": 14, "BC2 (tween)": 15, "Octa. (shell)": 16, "Dodeca. (shell)": 17, "Trunc. Octa. (shell)": 18, "Gyroid (shell)": 19, "Cubic Center (shell)": 20, "Cubic Face (shell)": 21, "LH Square": 22, "LH Round": 23, "LH Square (shell)": 24, "LH Auxetic (shell)": 25, "MC Tri": 26, "MS Tri (shell)": 27, "MC Quad": 28, "MS Quad (shell)": 29}, selected="LH Round")
ct = CrystallonV2CellType(unit_cell_selector=unit_cell_selector)
lhc = CrystallonV2LatticeHingeCellFill(unit_cell_c=ct, panels=lh.panels_unrolled)
preview_3 = CustomPreview(Geometry=lhc, Material=ColourSwatch(SwatchColor=RGBA(0, 0, 0, 57)))

# ---- group: LH Tween Shell Fill
unit_cell_selector_2 = CrystallonV2CellSelector({"Prim. Cubic": 0, "BC": 1, "BC Cubic": 2, "FC Cubic": 3, "Edge Octa.": 4, "Vertex Octa.": 5, "NaCl": 6, "Star Tet.": 7, "BC Star Tet.": 8, "Octa. Tet.": 9, "Dodecahedron": 10, "Trunc. Octa.": 11, "Tetrahedral": 12, "Auxetic": 13, "BC1 (tween)": 14, "BC2 (tween)": 15, "Octa. (shell)": 16, "Dodeca. (shell)": 17, "Trunc. Octa. (shell)": 18, "Gyroid (shell)": 19, "Cubic Center (shell)": 20, "Cubic Face (shell)": 21, "LH Square": 22, "LH Round": 23, "LH Square (shell)": 24, "LH Auxetic (shell)": 25, "MC Tri": 26, "MS Tri (shell)": 27, "MC Quad": 28, "MS Quad (shell)": 29}, selected="LH Square (shell)")
unit_cell_selector_3 = CrystallonV2CellSelector({"Prim. Cubic": 0, "BC": 1, "BC Cubic": 2, "FC Cubic": 3, "Edge Octa.": 4, "Vertex Octa.": 5, "NaCl": 6, "Star Tet.": 7, "BC Star Tet.": 8, "Octa. Tet.": 9, "Dodecahedron": 10, "Trunc. Octa.": 11, "Tetrahedral": 12, "Auxetic": 13, "BC1 (tween)": 14, "BC2 (tween)": 15, "Octa. (shell)": 16, "Dodeca. (shell)": 17, "Trunc. Octa. (shell)": 18, "Gyroid (shell)": 19, "Cubic Center (shell)": 20, "Cubic Face (shell)": 21, "LH Square": 22, "LH Round": 23, "LH Square (shell)": 24, "LH Auxetic (shell)": 25, "MC Tri": 26, "MS Tri (shell)": 27, "MC Quad": 28, "MS Quad (shell)": 29}, selected="LH Auxetic (shell)")
ct_2 = CrystallonV2CellType(unit_cell_selector=unit_cell_selector_2)
ct_3 = CrystallonV2CellType(unit_cell_selector=unit_cell_selector_3)
lht_s = CrystallonV2LatticeHingeTweenShellFill(unit_cell_shell=ct_2, unit_cell_shell_2=ct_3, voxels=lh.voxels_unrolled, value=lh.panel_values, tolerance=".01")
preview_4 = CustomPreview(Geometry=lht_s, Material=ColourSwatch(SwatchColor=RGB(0, 0, 0)))

# ---- group: LH Shell Fill
unit_cell_selector_4 = CrystallonV2CellSelector({"Prim. Cubic": 0, "BC": 1, "BC Cubic": 2, "FC Cubic": 3, "Edge Octa.": 4, "Vertex Octa.": 5, "NaCl": 6, "Star Tet.": 7, "BC Star Tet.": 8, "Octa. Tet.": 9, "Dodecahedron": 10, "Trunc. Octa.": 11, "Tetrahedral": 12, "Auxetic": 13, "BC1 (tween)": 14, "BC2 (tween)": 15, "Octa. (shell)": 16, "Dodeca. (shell)": 17, "Trunc. Octa. (shell)": 18, "Gyroid (shell)": 19, "Cubic Center (shell)": 20, "Cubic Face (shell)": 21, "LH Square": 22, "LH Round": 23, "LH Square (shell)": 24, "LH Auxetic (shell)": 25, "MC Tri": 26, "MS Tri (shell)": 27, "MC Quad": 28, "MS Quad (shell)": 29}, selected="LH Square (shell)")
ct_4 = CrystallonV2CellType(unit_cell_selector=unit_cell_selector_4)
lhc_s = CrystallonV2LatticeHingeShellFill(unit_cell_shell=ct_4, voxels=lh.voxels_unrolled, tolerance=".01")
preview_5 = CustomPreview(Geometry=lhc_s, Material=ColourSwatch(SwatchColor=RGB(0, 0, 0)))

# ---- group: LH Tween Cell Fill
crv_3 = Curve([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])
crv_4 = Curve([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])
lht = CrystallonV2LatticeHingeTweenCellFill(unit_cell_c_1=crv_3, unit_cell_c_2=crv_4, value=lh.panel_values, panels=lh.panels_unrolled)
preview_6 = CustomPreview(Geometry=lht, Material=ColourSwatch(SwatchColor=RGBA(0, 0, 0, 57)))

# ==== cluster CrystallonV2LatticeHinge: Create a ruled surface between two curves and unroll to apply kerf bending patterns (requires Kangaroo)

u_divisions = ClusterInput()  # Divisions in the U direction
curve1 = ClusterInput()  # Curve to loft between
curve2 = ClusterInput()  # Curve to loft between
v_divisions = ClusterInput()  # Divisions in the V direction
influence = ClusterInput()  # Influence from surface curvature (0-1)
voxel_height = ClusterInput()  # Height of voxels on surface
crv = Curve(curve1)
crv_2 = Curve(curve2)
num = Number(u_divisions)
num_2 = Number(v_divisions)
num_3 = Number(influence)
num_4 = Number(voxel_height)
divide = DivideCurve(Curve=crv_2, Count=num, Kinks=False)  # -> simplify(Points), Tangents, simplify(Parameters)
divide_2 = DivideCurve(Curve=crv, Count=num, Kinks=False)  # -> simplify(Points), Tangents, simplify(Parameters)
toggle = BooleanToggle(False)
# CRYSTALLON V2.0 -- Lattice structure tools for Grasshopper3D
# 
# Copyright (C) 2019  Aaron Porterfield
# 
# www.fequalsf.com
# info@fequalsf.com
# 
#     This program is free software: you can redistribute it and/or modify
#     it under the terms of the GNU General Public License as published by
#     the Free Software Foundation, either version 3 of the License, or any later version.
# 
#     This program is distributed in the hope that it will be useful,
#     but WITHOUT ANY WARRANTY; without even the implied warranty of
#     MERCHANTABILITY or FITNESS FOR A PARTICULAR PURPOSE.  See the
#     GNU General Public License for more details.
# 
#     You should have received a copy of the GNU General Public License
#     along with this program.  If not, see <http://www.gnu.org/licenses/>.
intcrv = Interpolate(Vertices=divide_2.Points, Degree=3, Periodic=False, KnotStyle=1)  # -> Curve, Length, Domain
shift = ShiftList(List=divide_2.Points, Shift="-1", Wrap=toggle)
intcrv_2 = Interpolate(Vertices=divide.Points, Degree=3, Periodic=False, KnotStyle=1)  # -> Curve, Length, Domain
shift_2 = ShiftList(List=divide.Points, Shift="-1", Wrap=toggle)
shift_3 = ShiftList(List=divide_2.Points, Shift="1", Wrap=toggle)
shift_4 = ShiftList(List=divide.Points, Shift="1", Wrap=toggle)
loft = Loft(
    Curves=[intcrv.Curve, intcrv_2.Curve],
    Options={Adjust=False, Closed=False, LoftEnds=0, LoftSimp=0, LoftType=0, Rebuild=10, Refit=0.01})
entwine = Entwine(Branch00=shift, Branch01=shift_3, Branch02=shift_4, Branch03=shift_2, FlattenInputs=True)  # -> simplify(Result)
sdivide = DivideSurface(Surface=reparameterize(loft), UCount=num_2, VCount=num)  # -> Points, Normals, simplify(Parameters)
flip = FlipMatrix(Data=entwine)
curvature = SurfaceCurvature(Surface=reparameterize(loft), Point=sdivide.Parameters)  # -> Frame, Gaussian, Mean
conmesh = ConstructMesh(Vertices=flip, Faces={A=0, B=1, C=2, D=3})
abs = Absolute(Value=curvature.Gaussian)
abs_2 = Absolute(Value=curvature.Mean)
mjoin = MeshJoin(Meshes=flatten(conmesh))
num_5 = Number(simplify(graft(abs_2)))
num_6 = Number(simplify(graft(abs)))
num_7 = Number("1")
weld = WeldMesh(Mesh=mjoin, Angle=3.141592654)
bnd = Bounds(Numbers=flatten(num_5))
bnd_2 = Bounds(Numbers=flatten(num_6))
unroller = Unroller(Strip=weld, Unroll=num_7)
remap = RemapNumbers(Value=num_5, Source=bnd, Target=Domain(0, 1))  # -> Mapped, Clipped
remap_2 = RemapNumbers(Value=num_6, Source=bnd_2, Target=Domain(0, 1))  # -> Mapped, Clipped
weld_2 = WeldMesh(Mesh=unroller, Angle=3.141592654)
addition = Addition(A=remap_2.Mapped, B=remap.Mapped)
faceb = FaceBoundaries(Mesh=weld_2)
bnd_3 = Bounds(Numbers=flatten(addition))
dom = ConstructDomain(DomainStart="1", DomainEnd=num_3)
explode = Explode(Curve=faceb, Recursive=True)  # -> Segments, Vertices
remap_3 = RemapNumbers(Value=addition, Source=bnd_3, Target=dom)  # -> Mapped, Clipped
item = ListItem(List=explode.Segments, Index="0", Wrap=True)
item_2 = ListItem(List=explode.Segments, Index="2", Wrap=True)
trim = TrimTree(Tree=remap_3.Mapped, Depth=1)
item_3 = ListItem(List=flatten(item), Index=0, Wrap=True)
replace = ReplaceItems(List=trim, Item="0", Indices="0", Wrap=False)
ma = MassAddition(Input=replace)  # -> Result, PartialResults
flip_2 = FlipCurve(Curve=flatten(item), Guide=item_3)  # -> Curve, Flag
flip_3 = FlipCurve(Curve=flatten(item_2), Guide=item_3)  # -> Curve, Flag
bnd_4 = Bounds(Numbers=ma.PartialResults)
cp = ControlPoints(Curve=flip_2.Curve)  # -> Points, Weights, Knots
cp_2 = ControlPoints(Curve=flip_3.Curve)  # -> Points, Weights, Knots
remap_4 = RemapNumbers(Value=ma.PartialResults, Source=bnd_4, Target=Domain(0, 1))  # -> Mapped, Clipped
pdecon = Deconstruct(Point=sdivide.Parameters)  # -> XComponent, YComponent, ZComponent
cullpt = CullDuplicates(Points=flatten(cp_2.Points), Tolerance=0.1, CullMode=3)  # -> Points, Indices, Valence
cullpt_2 = CullDuplicates(Points=flatten(cp.Points), Tolerance=0.1, CullMode=3)  # -> Points, Indices, Valence
pt = ConstructPoint(XCoordinate=pdecon.XComponent, YCoordinate=remap_4.Mapped, ZCoordinate=pdecon.ZComponent)  # -> simplify(Point)
loft_opt = LoftOptions(Closed=False, Adjust=Toggle(True), Rebuild=num, Refit=0, Type=0)
pline = PolyLine(Vertices=flatten(cullpt.Points), Closed=False)
pline_2 = PolyLine(Vertices=flatten(cullpt_2.Points), Closed=False)
evalsrf = EvaluateSurface(Surface=reparameterize(loft), Point=pt)  # -> Point, Normal, Frame
loft_2 = Loft(Curves=[pline_2, pline], Options=loft_opt)
pt_2 = Point(evalsrf.Point)
panel = Panel("Lattice Hinges")
srf_cp = SurfaceClosestPoint(Point=pt_2, Surface=reparameterize(loft))  # -> Point, UVPoint, Distance
evalsrf_2 = EvaluateSurface(Surface=reparameterize(loft_2), Point=srf_cp.UVPoint)  # -> Point, Normal, Frame
vec = Vector(evalsrf.Normal)
pt_3 = Point(evalsrf.Point)
vec_2 = Vector(evalsrf_2.Normal)
amp = Amplitude(Vector=vec, Amplitude=num_4)
pt_4 = Point(evalsrf_2.Point)
amp_2 = Amplitude(Vector=vec_2, Amplitude=num_4)
move = Move(Geometry=pt_3, Motion=amp)  # -> Geometry, Transform
move_2 = Move(Geometry=pt_4, Motion=amp_2)  # -> Geometry, Transform
toggle_2 = BooleanToggle(False)
flip_4 = FlipMatrix(Data=pt_3)
toggle_3 = BooleanToggle(False)
flip_5 = FlipMatrix(Data=pt_3)
flip_6 = FlipMatrix(Data=move.Geometry)
flip_7 = FlipMatrix(Data=move.Geometry)
toggle_4 = BooleanToggle(False)
flip_8 = FlipMatrix(Data=move_2.Geometry)
flip_9 = FlipMatrix(Data=move_2.Geometry)
toggle_5 = BooleanToggle(False)
flip_10 = FlipMatrix(Data=pt_4)
flip_11 = FlipMatrix(Data=pt_4)
shift_5 = ShiftList(List=flip_4, Shift="1", Wrap=toggle_3)
shift_6 = ShiftList(List=flip_5, Shift="-1", Wrap=toggle_3)
shift_7 = ShiftList(List=flip_6, Shift="-1", Wrap=toggle_2)
shift_8 = ShiftList(List=flip_7, Shift="1", Wrap=toggle_2)
shift_9 = ShiftList(List=flip_8, Shift="1", Wrap=toggle_4)
shift_10 = ShiftList(List=flip_9, Shift="-1", Wrap=toggle_4)
shift_11 = ShiftList(List=flip_10, Shift="-1", Wrap=toggle_5)
shift_12 = ShiftList(List=flip_11, Shift="1", Wrap=toggle_5)
flip_12 = FlipMatrix(Data=shift_5)  # -> simplify(Data)
flip_13 = FlipMatrix(Data=shift_7)  # -> simplify(Data)
flip_14 = FlipMatrix(Data=shift_6)  # -> simplify(Data)
flip_15 = FlipMatrix(Data=shift_8)  # -> simplify(Data)
flip_16 = FlipMatrix(Data=shift_9)  # -> simplify(Data)
flip_17 = FlipMatrix(Data=shift_10)  # -> simplify(Data)
flip_18 = FlipMatrix(Data=shift_11)  # -> simplify(Data)
flip_19 = FlipMatrix(Data=shift_12)  # -> simplify(Data)
shift_13 = ShiftList(List=flip_12, Shift="1", Wrap=toggle_3)  # -> simplify(List)
shift_14 = ShiftList(List=flip_12, Shift="-1", Wrap=toggle_3)  # -> simplify(List)
shift_15 = ShiftList(List=flip_14, Shift="1", Wrap=toggle_3)  # -> simplify(List)
shift_16 = ShiftList(List=flip_14, Shift="-1", Wrap=toggle_3)  # -> simplify(List)
shift_17 = ShiftList(List=flip_15, Shift="1", Wrap=toggle_2)  # -> simplify(List)
shift_18 = ShiftList(List=flip_13, Shift="1", Wrap=toggle_2)  # -> simplify(List)
shift_19 = ShiftList(List=flip_13, Shift="-1", Wrap=toggle_2)  # -> simplify(List)
shift_20 = ShiftList(List=flip_15, Shift="-1", Wrap=toggle_2)  # -> simplify(List)
shift_21 = ShiftList(List=flip_17, Shift="-1", Wrap=toggle_4)  # -> simplify(List)
shift_22 = ShiftList(List=flip_17, Shift="1", Wrap=toggle_4)  # -> simplify(List)
shift_23 = ShiftList(List=flip_16, Shift="-1", Wrap=toggle_4)  # -> simplify(List)
shift_24 = ShiftList(List=flip_18, Shift="-1", Wrap=toggle_5)  # -> simplify(List)
shift_25 = ShiftList(List=flip_18, Shift="1", Wrap=toggle_5)  # -> simplify(List)
shift_26 = ShiftList(List=flip_16, Shift="1", Wrap=toggle_4)  # -> simplify(List)
shift_27 = ShiftList(List=flip_19, Shift="-1", Wrap=toggle_5)  # -> simplify(List)
shift_28 = ShiftList(List=flip_19, Shift="1", Wrap=toggle_5)  # -> simplify(List)
srf4pt = _4PointSurface(CornerA=shift_24, CornerB=shift_25, CornerC=shift_28, CornerD=shift_27)  # -> flatten(Surface)
tbox = TwistedBox(
    CornerA=shift_24,
    CornerB=shift_25,
    CornerC=shift_28,
    CornerD=shift_27,
    CornerE=shift_21,
    CornerF=shift_22,
    CornerG=shift_26,
    CornerH=shift_23)  # -> flatten(TwistedBox)
srf4pt_2 = _4PointSurface(CornerA=shift_16, CornerB=shift_15, CornerC=shift_13, CornerD=shift_14)  # -> flatten(Surface)
tbox_2 = TwistedBox(
    CornerA=shift_16,
    CornerB=shift_15,
    CornerC=shift_13,
    CornerD=shift_14,
    CornerE=shift_19,
    CornerF=shift_18,
    CornerG=shift_17,
    CornerH=shift_20)  # -> flatten(TwistedBox)
num_8 = Number(trim)
toggle_6 = BooleanToggle(False)
flip_20 = FlipMatrix(Data=num_8)
flip_21 = FlipMatrix(Data=num_8)
shift_29 = ShiftList(List=flip_20, Shift="1", Wrap=toggle_6)
shift_30 = ShiftList(List=flip_21, Shift="-1", Wrap=toggle_6)
flip_22 = FlipMatrix(Data=shift_29)  # -> simplify(Data)
flip_23 = FlipMatrix(Data=shift_30)  # -> simplify(Data)
shift_31 = ShiftList(List=flip_23, Shift="1", Wrap=toggle_6)  # -> simplify(List)
shift_32 = ShiftList(List=flip_22, Shift="1", Wrap=toggle_6)  # -> simplify(List)
shift_33 = ShiftList(List=flip_22, Shift="-1", Wrap=toggle_6)  # -> simplify(List)
shift_34 = ShiftList(List=flip_23, Shift="-1", Wrap=toggle_6)  # -> simplify(List)
entwine_2 = Entwine(
    Branch00=graft(shift_34),
    Branch01=graft(shift_31),
    Branch02=graft(shift_33),
    Branch03=graft(shift_32),
    FlattenInputs=True)
flip_24 = FlipMatrix(Data=entwine_2)
ma_2 = MassAddition(Input=flip_24)  # -> Result, PartialResults
bnd_5 = Bounds(Numbers=flatten(ma_2.Result))
remap_5 = RemapNumbers(Value=ma_2.Result, Source=bnd_5, Target=Domain(0, 1))  # -> flatten(Mapped), Clipped
tbox_3 = TwistedBox(tbox)
tbox_4 = TwistedBox(tbox_2)
srf = Surface(srf4pt_2)
srf_2 = Surface(srf4pt)
num_9 = Number(remap_5.Mapped)
srf_3 = Surface(loft_2)
voxels_rolled = ClusterOutput(tbox_4)  # Voxels of the rolled surface (for preview)
voxels_unrolled = ClusterOutput(tbox_3)  # Voxels of the unrolled surface (for mapping)
panels_rolled = ClusterOutput(srf)  # Panels of the rolled surface (for preview)
panel_values = ClusterOutput(num_9)  # Values measuring curvature (0-1)
unrolled_surface = ClusterOutput(srf_3)  # The unrolled surface
panels_unrolled = ClusterOutput(srf_2)  # Panels of the unrolled surface (for mapping)

# ==== cluster CrystallonV2LatticeHingeCellFill: Populate lattice hinge panels with a curve based unit cell

# ----
# LATTICE HINGE CELL FILL
unit_cell_c = ClusterInput()  # Unit cell to populate Lattice Hinge panels
panels = ClusterInput()  # Panels to be filled with unit cells
crv = Curve(unit_cell_c)
srf = Surface(panels)
bbox = BoundingBox(Content=crv, Plane=PlaneXY(0, 0, 0), UnionBox=True)  # -> Box, Box_2
map_srf = MapToSurface(Curve=crv, Source=bbox.Box, Target=graft(srf))  # -> flatten(Curve)
remove_duplicate_lines = RemoveDuplicateLines(lattice_l=flatten(map_srf))
join = JoinCurves(Curves=remove_duplicate_lines, Preserve=False)
lattice_hinge = ClusterOutput(join)  # List of curves that make up the lattice hinge

# ==== cluster CrystallonV2LatticeHingeShellFill: Populate lattice hinge panels with a shell based unit cell

# ----
# LATTICE HINGE SHELL FILL
unit_cell_shell = ClusterInput()  # Unit cell to populate voxels
voxels = ClusterInput()  # Voxels to be filled with unit cells
tolerance = ClusterInput()  # Tolerance for merging faces and vertices (number usually between 0.001 and 0.1)
geo = Geometry(unit_cell_shell)
geo_2 = Geometry(voxels)
num = Number(tolerance)
mesh = Mesh(geo)
demesh = DeconstructMesh(Mesh=mesh)  # -> Vertices, Faces, Colours, Normals
avr = Average(Input=demesh.Vertices)
avr_2 = Average(Input=demesh.Normals)
move = Move(Geometry=avr, Motion=avr_2)  # -> simplify(Geometry), Transform
merge = Merge(Data1=mesh, Data2=move.Geometry)  # -> flatten(Result)
bbox = BoundingBox(Content=merge, Plane=PlaneXY(0, 0, 0), UnionBox=True)  # -> simplify(Box), Box_2
morph = BoxMorph(Geometry=mesh, Reference=bbox.Box, Target=flatten(geo_2))
mjoin = MeshJoin(Meshes=morph)
demesh_2 = DeconstructMesh(Mesh=mjoin)  # -> Vertices, Faces, Colours, Normals
facen = FaceNormals(Mesh=mjoin)  # -> Centers, Normals
cullpt = CullDuplicates(Points=facen.Centers, Tolerance=num, CullMode=1)  # -> Points, Indices, Valence
item = ListItem(List=demesh_2.Faces, Index=cullpt.Indices, Wrap=True)
conmesh = ConstructMesh(Vertices=demesh_2.Vertices, Faces=item)
weld = WeldMesh(Mesh=conmesh, Angle=3.141592654)
c_script = CSharpScript(M=weld, radius=num)  # -> out, A; inputs M: Mesh, radius: Double
# ---------- c_script: C# usings ----------
using System.IO;
using System.Linq;
using System.Data;
using System.Drawing;
using System.Reflection;
using System.Windows.Forms;
using System.Xml;
using System.Xml.Linq;
using System.Runtime.InteropServices;

using Rhino.DocObjects;
using Rhino.Collections;
using GH_IO;
using GH_IO.Serialization;
# ---------- c_script: C# ----------
    Component.Message = "Weld Mesh - RTree";


    //Store naked mesh vertices and their ids
    List<Point3f> pts = new List<Point3f>();
    bool[] flag = M.GetNakedEdgePointStatus();

    allPointsFound = new List<List<int>>();

    //History is need to stop searching rtee
    //When all point groups are found
    history.Clear();

    //Create Rtree
    RTree tree = new RTree();

    for(int i = 0; i < flag.Length; i++){
      if(flag[i]){
        tree.Insert(M.Vertices[i], i);
        pts.Add(M.Vertices[i]);
      }
    }

    //Search RTree
    for(int i = 0; i < pts.Count; i++){
      tempIDList = new List<int>();
      tree.Search(new Sphere(pts[i], radius), method);

      if(tempIDList.Count > 1)
        allPointsFound.Add(tempIDList);

      if(history.Count == M.Vertices.Count)
        break;
    }

    //Now move found vertices to one of firs vertex position
    foreach(List<int> i in allPointsFound)
      for(int j = 1; j < i.Count; j++)
        M.Vertices[i[0]] = M.Vertices[i[j]];

    M.Vertices.CombineIdentical(true, true);


    A = M;
# ---------- c_script: C# additional code ----------
  //Rtree collections
  List<int> history = new List<int>();
  List<List<int>> allPointsFound;
  List<int> tempIDList;

  private void method(object sender, RTreeEventArgs e){
    if(!history.Contains(e.Id)){
      tempIDList.Add(e.Id);
      history.Add(e.Id);
    }
  }
# ---------- end c_script ----------
lattice_hinge_shell = ClusterOutput(c_script.A)  # Joined mesh that makes up the lattice hinge

# ==== cluster CrystallonV2CellType: A collection of pre-made unit cells

crv = Curve([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])
crv_2 = Curve([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])
crv_3 = Curve([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])
crv_4 = Curve([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])
crv_5 = Curve([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])
mesh = Mesh(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)
mesh_2 = Mesh(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)
mesh_3 = Mesh(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)
mesh_4 = Mesh([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])
crv_6 = Curve([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])
crv_7 = Curve([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])
crv_8 = Curve([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])
crv_9 = Curve([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])
crv_10 = Curve([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])
crv_11 = Curve([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])
crv_12 = Curve([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])
crv_13 = Curve([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])
crv_14 = Curve([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])
crv_15 = Curve([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])
crv_16 = Curve([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])
mesh_5 = Mesh(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)
mesh_6 = Mesh(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)
mesh_7 = Mesh(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)
mesh_8 = Mesh(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)
crv_17 = Curve([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])
crv_18 = Curve([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])
mesh_9 = Mesh(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)
geo = Geometry([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])
geo_2 = Geometry([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])
mesh_10 = Mesh([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])
panel = Panel("CELL TYPES")
entwine = Entwine(
    Branch00=crv_6,
    Branch01=crv_7,
    Branch02=crv,
    Branch03=crv_8,
    Branch04=crv_2,
    Branch05=crv_9,
    Branch06=crv_3,
    Branch07=crv_10,
    Branch08=crv_11,
    Branch09=crv_12,
    Branch010=crv_4,
    Branch011=crv_5,
    Branch012=crv_13,
    Branch013=crv_14,
    Branch014=crv_15,
    Branch015=crv_16,
    Branch016=mesh,
    Branch017=mesh_5,
    Branch018=mesh_6,
    Branch019=mesh_2,
    Branch020=mesh_7,
    Branch021=mesh_8,
    Branch022=crv_17,
    Branch023=crv_18,
    Branch024=mesh_9,
    Branch025=mesh_3,
    Branch026=geo,
    Branch027=mesh_4,
    Branch028=geo_2,
    Branch029=mesh_10,
    FlattenInputs=True)  # -> simplify(Result)
unit_cell_selector = ClusterInput()
branch = TreeBranch(Tree=entwine, Path=unit_cell_selector, MaintainPaths=True)
unit_cell = ClusterOutput(branch)  # Single unit cell to populate voxels

# ==== cluster CrystallonV2LatticeHingeTweenCellFill: Tween between lattice hinge panels with curve based unit cells

# ----
# TWEEN LATTICE HINGE CELL FILL
unit_cell_c_1 = ClusterInput()  # Unit cell to populate Lattice Hinge panels
unit_cell_c_2 = ClusterInput()  # Unit cell to populate Lattice Hinge panels
value = ClusterInput()  # Value from 0-1 corresponding to each panel
panels = ClusterInput()  # Panels to be filled with unit cells
num = Number(value)
srf = Surface(panels)
crv = Curve(unit_cell_c_2)
crv_2 = Curve(unit_cell_c_1)
tweencrv = TweenCurve(CurveA=graft(crv_2), CurveB=graft(crv), Factor=flatten(num), BlendType=0)
flip = FlipMatrix(Data=tweencrv)
bbox = BoundingBox(Content=flip, Plane=PlaneXY(0, 0, 0), UnionBox=True)  # -> Box, Box_2
map_srf = MapToSurface(Curve=flip, Source=bbox.Box, Target=graft(srf))
remove_duplicate_lines = RemoveDuplicateLines(lattice_l=flatten(map_srf))
join = JoinCurves(Curves=remove_duplicate_lines, Preserve=False)
lattice_hinge = ClusterOutput(join)  # List of curves that make up the lattice hinge

# ==== cluster CrystallonV2LatticeHingeTweenShellFill: Tween between lattice hinge panels with shell based unit cells

# ----
# LATTICE HINGE TWEEN SHELL FILL
tolerance = ClusterInput()  # Tolerance for merging faces and vertices (number usually between 0.001 and 0.1)
value = ClusterInput()  # Value from 0-1 corresponding to each voxel
unit_cell_shell = ClusterInput()  # Unit cell to populate voxels
voxels = ClusterInput()  # Voxels to be filled with unit cells
unit_cell_shell_2 = ClusterInput()  # Unit cell to populate voxels
geo = Geometry(flatten(voxels))
geo_2 = Geometry(unit_cell_shell_2)
num = Number(tolerance)
geo_3 = Geometry(unit_cell_shell)
num_2 = Number(value)
demesh = DeconstructMesh(Mesh=geo_3)  # -> Vertices, Faces, Colours, Normals
demesh_2 = DeconstructMesh(Mesh=geo_2)  # -> Vertices, Faces, Colours, Normals
ln = Line(StartPoint=demesh.Vertices, EndPoint=demesh_2.Vertices)
eval = EvaluateCurve(Curve=reparameterize(graft(ln)), Parameter=num_2)  # -> simplify(Point), Tangent, Angle
flip = FlipMatrix(Data=eval.Point)
conmesh = ConstructMesh(Vertices=flip, Faces=demesh.Faces)  # -> simplify(Mesh)
demesh_3 = DeconstructMesh(Mesh=conmesh)  # -> Vertices, Faces, Colours, Normals
avr = Average(Input=demesh_3.Vertices)
avr_2 = Average(Input=demesh_3.Normals)
move = Move(Geometry=avr, Motion=avr_2)  # -> simplify(Geometry), Transform
merge = Merge(Data1=conmesh, Data2=move.Geometry)
bbox = BoundingBox(Content=merge, Plane=PlaneXY(0, 0, 0), UnionBox=True)  # -> simplify(Box), Box_2
morph = BoxMorph(Geometry=conmesh, Reference=bbox.Box, Target=simplify(graft(geo)))  # -> flatten(Geometry)
mjoin = MeshJoin(Meshes=morph)
demesh_4 = DeconstructMesh(Mesh=mjoin)  # -> Vertices, Faces, Colours, Normals
facen = FaceNormals(Mesh=mjoin)  # -> Centers, Normals
cullpt = CullDuplicates(Points=facen.Centers, Tolerance=num, CullMode=1)  # -> Points, Indices, Valence
item = ListItem(List=demesh_4.Faces, Index=cullpt.Indices, Wrap=True)
conmesh_2 = ConstructMesh(Vertices=demesh_4.Vertices, Faces=item)
weld = WeldMesh(Mesh=conmesh_2, Angle=3.141592654)
c_script = CSharpScript(M=weld, radius=num)  # -> out, A; inputs M: Mesh, radius: Double; same code as c_script
lattice_hinge_shell = ClusterOutput(c_script.A)  # Joined mesh that makes up the lattice hinge

# ==== cluster RemoveDuplicateLines
lattice_l = ClusterInput()
crv = Curve(lattice_l)
curvepoint = PointOnCurve(crv, parameter=0.5)
cullpt = CullDuplicates(Points=curvepoint, Tolerance=".001", CullMode=1)  # -> Points, Indices, Valence
item = ListItem(List=crv, Index=cullpt.Indices, Wrap=True)
lattice = ClusterOutput(item)
