# Grasshopper definition 02-Mesh Flatten.gh (Grasshopper 1.0.7)
# Copyright: ©2019 GNU General Public License

# ---- group: Mesh Flatten
xy = XYPlane(Origin=Point(0, 0, 0))
mesh = Mesh(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)
mf = CrystallonV2MeshFlatten(mesh=mesh, plane=xy, threshold="1e-7", max_iterations="1000")  # -> iterations, flattened_mesh, mesh_faces, ratio_cp, cp_lines, ratio_ci, ci_lines, ratio_cf, cf_lines, ratio_average
panel = Panel(mf.iterations)

# ---- group: Strain -1-1
neg = Negative(Value="1")
bnd = Bounds(Numbers=flatten(mf.ratio_average))
dom = ConstructDomain(DomainStart=neg, DomainEnd="1")
remap = RemapNumbers(Value=mf.ratio_average, Source=bnd, Target=dom)  # -> Mapped, Clipped
abs = Absolute(Value=remap.Mapped)

# ---- group: Strain 0-1
bnd_2 = Bounds(Numbers=flatten(mf.ratio_average))
remap_2 = RemapNumbers(Value=mf.ratio_average, Source=bnd_2, Target=Domain(0, 1))  # -> Mapped, Clipped

# ----
num = Number(remap_2.Mapped)
num_2 = Number(abs)
entwine = Entwine(Branch00=num, Branch01=num_2, FlattenInputs=True)  # -> simplify(Result)
branch = TreeBranch(Tree=entwine, Path=Slider(1, range=0..1), MaintainPaths=True)  # -> graft(Branch)
gradient = Gradient(
    LowerLimit="1",
    UpperLimit="0",
    Parameter=branch,
    stops=[0: RGB(234, 38, 0), 0.25: RGB(234, 126, 0), 0.5: RGB(254, 244, 84), 0.75: RGB(173, 203, 249), 1: RGB(75, 107, 169)])
material = CreateMaterial(Diffuse=gradient, Specular=RGB(255, 255, 255), Emission=RGB(0, 0, 0), Transparency=Slider(0.229, range=0..1), Shine=0)
preview = CustomPreview(Geometry=mf.mesh_faces, Material=material)

# ---- group: Mesh Hinge (quad)
num_3 = Number(mf.ratio_cf)
num_4 = Number(mf.ratio_cp)
bnd_3 = Bounds(Numbers=flatten(num_3))
bnd_4 = Bounds(Numbers=flatten(num_4))
dom_2 = ConstructDomain(DomainStart=Slider(0.156, range=0..1), DomainEnd=Slider(0.76, range=0..1))
dom_3 = ConstructDomain(DomainStart=Slider(0.156, range=0..1), DomainEnd=Slider(0.798, range=0..1))
remap_3 = RemapNumbers(Value=num_3, Source=bnd_3, Target=dom_3)  # -> Mapped, Clipped
remap_4 = RemapNumbers(Value=num_4, Source=bnd_4, Target=dom_2)  # -> Mapped, Clipped
item = ListItem(List=remap_3.Mapped, Index=0, Wrap=True)  # -> Item, Item1, Item2, Item3
item_2 = ListItem(List=remap_4.Mapped, Index=0, Wrap=True)  # -> Item, Item1, Item2, Item3
mhq = CrystallonV2MeshHingeCellQuad(
    parameter_1a=item_2.Item,
    parameter_1b=item_2.Item1,
    parameter_1c=item_2.Item2,
    parameter_1d=item_2.Item3,
    parameter_2a=item.Item,
    parameter_2b=item.Item1,
    parameter_2c=item.Item2,
    parameter_2d=item.Item3,
    mesh_face=mf.mesh_faces,
    tolerance=".1")
preview_2 = CustomPreview(Geometry=mhq, Material=ColourSwatch(SwatchColor=RGB(153, 153, 153)))

# ---- group: Mesh Cell FIll
unit_cell_selector = CrystallonV2CellSelector({"Prim. Cubic": 0, "BC": 1, "BC Cubic": 2, "FC Cubic": 3, "Edge Octa.": 4, "Vertex Octa.": 5, "NaCl": 6, "Star Tet.": 7, "BC Star Tet.": 8, "Octa. Tet.": 9, "Dodecahedron": 10, "Trunc. Octa.": 11, "Tetrahedral": 12, "Auxetic": 13, "BC1 (tween)": 14, "BC2 (tween)": 15, "Octa. (shell)": 16, "Dodeca. (shell)": 17, "Trunc. Octa. (shell)": 18, "Gyroid (shell)": 19, "Cubic Center (shell)": 20, "Cubic Face (shell)": 21, "LH Square": 22, "LH Round": 23, "LH Square (shell)": 24, "LH Auxetic (shell)": 25, "MC Tri": 26, "MS Tri (shell)": 27, "MC Quad": 28, "MS Quad (shell)": 29}, selected="MC Quad")
ct = CrystallonV2CellType(unit_cell_selector=unit_cell_selector)
mcf = CrystallonV2MeshCellFill(mesh_cell=ct, mesh_face=mf.mesh_faces)
preview_3 = CustomPreview(Geometry=mcf, Material=ColourSwatch(SwatchColor=RGB(0, 0, 0)))

# ---- group: Mesh Shell Fill
unit_cell_selector_2 = CrystallonV2CellSelector({"Prim. Cubic": 0, "BC": 1, "BC Cubic": 2, "FC Cubic": 3, "Edge Octa.": 4, "Vertex Octa.": 5, "NaCl": 6, "Star Tet.": 7, "BC Star Tet.": 8, "Octa. Tet.": 9, "Dodecahedron": 10, "Trunc. Octa.": 11, "Tetrahedral": 12, "Auxetic": 13, "BC1 (tween)": 14, "BC2 (tween)": 15, "Octa. (shell)": 16, "Dodeca. (shell)": 17, "Trunc. Octa. (shell)": 18, "Gyroid (shell)": 19, "Cubic Center (shell)": 20, "Cubic Face (shell)": 21, "LH Square": 22, "LH Round": 23, "LH Square (shell)": 24, "LH Auxetic (shell)": 25, "MC Tri": 26, "MS Tri (shell)": 27, "MC Quad": 28, "MS Quad (shell)": 29}, selected="MS Quad (shell)")
ct_2 = CrystallonV2CellType(unit_cell_selector=unit_cell_selector_2)
msf = CrystallonV2MeshShellFIll(mesh_shell=ct_2, mesh_face=mf.mesh_faces, tolerance=".1")
preview_4 = CustomPreview(Geometry=msf, Material=ColourSwatch(SwatchColor=RGB(148, 148, 148)))

# ---- group: Mesh Tween Cell Fill
geo = Geometry([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])
geo_2 = Geometry([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])
mtc = CrystallonV2MeshTweenCellFill(mesh_cell_1=geo_2, mesh_cell_2=geo, mesh_face=mf.mesh_faces, value=branch)
preview_5 = CustomPreview(Geometry=mtc, Material=ColourSwatch(SwatchColor=RGB(0, 0, 0)))

# ---- group: Mesh Tween Shell Fill
mesh_2 = Mesh([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])
mesh_3 = Mesh([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])
mts = CrystallonV2MeshTweenShellFill(mesh_shell_1=mesh_2, mesh_shell_2=mesh_3, mesh_face=mf.mesh_faces, value=branch, tolerance=".1")
preview_6 = CustomPreview(Geometry=mts, Material=ColourSwatch(SwatchColor=RGB(153, 153, 153)))

# ==== cluster CrystallonV2MeshFlatten: Flatten a mesh surface and measure the strain per mesh face (requires Kangaroo2)

# ----
# Mesh Flatten
# 
# Requires Kangaroo2
# https://www.food4rhino.com/app/kangaroo-physics
# Thanks to Daniel Piker
# 
# https://www.grasshopper3d.com/group/kangaroo/forum/topics/relaxation-to-flat-geometry
mesh = ClusterInput()  # Mesh to flatten
plane = ClusterInput()  # Plane to flatten mesh to
threshold = ClusterInput()  # Threshold for Kangaroo Solver (~1e-7)
max_iterations = ClusterInput()  # Max iterations for Kangaroo Solver
num = Number(threshold)
mesh_2 = Mesh(mesh)
num_2 = Number(max_iterations)
pln = Plane(plane)
bool = Boolean()
bool_2 = Boolean()
tri = Triangulate(Mesh=mesh_2)  # -> Mesh, Count
# CRYSTALLON V2.0 -- Lattice structure tools for Grasshopper3D
# 
# Copyright (C) 2019  Aaron Porterfield
# 
# www.fequalsf.com
# info@fequalsf.com
# 
#     This program is free software: you can redistribute it and/or modify
#     it under the terms of the GNU General Public License as published by
#     the Free Software Foundation, either version 3 of the License, or any later version.
# 
#     This program is distributed in the hope that it will be useful,
#     but WITHOUT ANY WARRANTY; without even the implied warranty of
#     MERCHANTABILITY or FITNESS FOR A PARTICULAR PURPOSE.  See the
#     GNU General Public License for more details.
# 
#     You should have received a copy of the GNU General Public License
#     along with this program.  If not, see <http://www.gnu.org/licenses/>.
demesh = DeconstructMesh(Mesh=mesh_2)  # -> Vertices, Faces, Colours, Normals
hingepoints = HingePoints(Mesh=tri.Mesh)  # -> _1, _2, _3, _4
avr = Average(Input=demesh.Vertices)
foldangle = FoldAngle(P1=hingepoints._1, P2=hingepoints._2, P3=hingepoints._3, P4=hingepoints._4)
padjust = AdjustPlane(Plane=avr, Normal=pln)
edgelengths = EdgeLengths(Mesh=tri.Mesh, LengthFactor=1, Strength=1)
smooth = Smooth(M=tri.Mesh, Strength=1)
multiplication = Multiplication(A=foldangle, B="0")
onplane = OnPlane(Points=demesh.Vertices, Plane=padjust, Strength="10")
show = Show(G=mesh_2)
hinge = Hinge(
    FoldStart=hingepoints._1,
    FoldEnd=hingepoints._2,
    Tip1=hingepoints._3,
    Tip2=hingepoints._4,
    RestAngle=multiplication,
    Strength="3")
entwine = Entwine(Branch00=show, Branch01=[onplane, edgelengths, smooth, hinge], FlattenInputs=True)
zombiesolver = ZombieSolver(GoalObjects=entwine, Threshold=num, Tolerance=0.01, MaxIterations=num_2)  # -> I, V, O
solver = Solver(GoalObjects=entwine, Reset=bool, Threshold=num, Tolerance=0.01, On=bool_2)  # -> I, V, O; disabled
mesh_3 = Mesh(zombiesolver.O)
clean = CleanTree(RemoveNulls=True, RemoveInvalid=True, RemoveEmpty=Toggle(True), Tree=mesh_3)
mesh_4 = Mesh(mesh_2)
mesh_5 = Mesh(clean)
mesh_6 = Mesh(mesh_4)
mesh_7 = Mesh(mesh_5)
mesh_8 = Mesh(mesh_5)
facen = FaceNormals(Mesh=mesh_6)  # -> Centers, Normals
demesh_2 = DeconstructMesh(Mesh=mesh_7)  # -> Vertices, Faces, Colours, Normals
facen_2 = FaceNormals(Mesh=mesh_8)  # -> Centers, Normals
conmesh = ConstructMesh(Vertices=demesh_2.Vertices, Faces=graft(demesh_2.Faces))  # -> simplify(Mesh)
mesh_9 = Mesh(mesh_5)
mesh_10 = Mesh(conmesh)
num_3 = Number(zombiesolver.I)
flattened_mesh = ClusterOutput(mesh_9)  # Flattened Mesh
mesh_faces = ClusterOutput(mesh_10)  # Faces of the flattened mesh
iterations = ClusterOutput(num_3)  # Iterations of kangaroo solver

faceb = FaceBoundaries(Mesh=mesh_4)
faceb_2 = FaceBoundaries(Mesh=mesh_5)
explode = Explode(Curve=faceb_2, Recursive=True)  # -> Segments, Vertices
explode_2 = Explode(Curve=faceb, Recursive=True)  # -> Segments, Vertices
len = Length(Curve=explode.Segments)
len_2 = Length(Curve=explode_2.Segments)
division = Division(A=len, B=len_2)  # -> simplify(Result)

curvepoint = PointOnCurve(explode_2.Segments, parameter=0.5)
curvepoint_2 = PointOnCurve(explode.Segments, parameter=0.5)
ln = Line(StartPoint=curvepoint_2, EndPoint=graft(facen_2.Centers))
ln_2 = Line(StartPoint=curvepoint, EndPoint=graft(facen.Centers))
len_3 = Length(Curve=ln)
len_4 = Length(Curve=ln_2)
division_2 = Division(A=len_3, B=len_4)  # -> simplify(Result)

cullpt = CullDuplicates(Points=explode_2.Vertices, Tolerance=0.1, CullMode=1)  # -> Points, Indices, Valence
cullpt_2 = CullDuplicates(Points=explode.Vertices, Tolerance=0.1, CullMode=1)  # -> Points, Indices, Valence
ln_3 = Line(StartPoint=cullpt.Points, EndPoint=graft(facen.Centers))
ln_4 = Line(StartPoint=cullpt_2.Points, EndPoint=graft(facen_2.Centers))
len_5 = Length(Curve=ln_4)
len_6 = Length(Curve=ln_3)
division_3 = Division(A=len_5, B=len_6)  # -> simplify(Result)

num_4 = Number(division_3)
line = Line(ln_4)
ci_ratio = Panel(num_4)

num_5 = Number(division_2)
line_2 = Line(ln)
cf_ratio = Panel(num_5)

num_6 = Number(division)
line_3 = Line(explode.Segments)
cp_ratio = Panel(num_6)

merge = Merge(Data1=num_6, Data2=num_4, Data3=num_5)
avr_2 = Average(Input=merge)
num_7 = Number(avr_2)
average_ratio = Panel(num_7)

ratio_cp = ClusterOutput(num_6)  # Ratio of strain on face edges (cP)
cp_lines = ClusterOutput(line_3)  # Lines for preview
ratio_cf = ClusterOutput(num_5)  # Ratio of strain on face centered lines (cF)
cf_lines = ClusterOutput(line_2)  # Lines for preview
ratio_ci = ClusterOutput(num_4)  # Ratio of strain on body centered lines (cI)
ci_lines = ClusterOutput(line)  # Lines for preview
ratio_average = ClusterOutput(num_7)  # Average ratio of strain per face

# ==== cluster CrystallonV2MeshCellFill: Map Lattice unit cells to mesh faces

mesh_cell = ClusterInput()  # Lattice Unit cell to map to mesh faces
mesh_face = ClusterInput()  # Mesh faces (exploded as single meshes)
geo = Geometry(mesh_cell)
toggle = BooleanToggle(True)
crv = Curve(flatten(geo))
mesh = Mesh(geo)
clean = CleanTree(RemoveNulls=toggle, RemoveInvalid=toggle, RemoveEmpty=toggle, Tree=mesh)
clean_2 = CleanTree(RemoveNulls=toggle, RemoveInvalid=toggle, RemoveEmpty=toggle, Tree=crv)
mesh_2 = Mesh(mesh_face)
cp = ControlPoints(Curve=clean_2)  # -> Points, Weights, Knots
meshcp = MeshClosestPoint(Point=cp.Points, Mesh=clean)  # -> Point, Index, Parameter
panel = Panel("Mesh Cell Fill")
meval = MeshEval(Mesh=flatten(mesh_2), Parameter=simplify(graft(meshcp.Parameter)))  # -> simplify(Point), Normal, Colour
path_mapper = PathMapper(meval.Point, source="{A;B}(i)", target="{A;i}(B)")
pline = PolyLine(Vertices=path_mapper, Closed=False)
trim = TrimTree(Tree=pline, Depth=1)
flip = FlipMatrix(Data=trim)
join = JoinCurves(Curves=flip, Preserve=False)
lattice_hinge = ClusterOutput(join)  # Joined curves that makes up the lattice hinge

# ==== cluster CrystallonV2MeshShellFIll: Map shell unit cells to mesh faces

mesh_face = ClusterInput()  # Mesh faces (exploded as single meshes)
tolerance = ClusterInput()  # Tolerance for merging faces and vertices (number usually between 0.001 and 0.1)
mesh_shell = ClusterInput()  # Shell Unit cell to map to mesh faces
mesh = Mesh(mesh_face)
geo = Geometry(mesh_shell)
num = Number(tolerance)
item = ListItem(List=geo, Index=0, Wrap=True)  # -> Item, Item1
mesh_2 = Mesh(item.Item)
mesh_3 = Mesh(item.Item1)
demesh = DeconstructMesh(Mesh=mesh_2)  # -> Vertices, Faces, Colours, Normals
meshcp = MeshClosestPoint(Point=demesh.Vertices, Mesh=mesh_3)  # -> Point, Index, Parameter
panel = Panel("Mesh Shell Fill")
meval = MeshEval(Mesh=mesh, Parameter=meshcp.Parameter)  # -> Point, Normal, Colour
conmesh = ConstructMesh(Vertices=meval.Point, Faces=demesh.Faces)
mjoin = MeshJoin(Meshes=conmesh)
facen = FaceNormals(Mesh=mjoin)  # -> Centers, Normals
demesh_2 = DeconstructMesh(Mesh=mjoin)  # -> Vertices, Faces, Colours, Normals
cullpt = CullDuplicates(Points=facen.Centers, Tolerance=num, CullMode=1)  # -> Points, Indices, Valence
item_2 = ListItem(List=demesh_2.Faces, Index=cullpt.Indices, Wrap=True)
conmesh_2 = ConstructMesh(Vertices=demesh_2.Vertices, Faces=item_2)
weld = WeldMesh(Mesh=conmesh_2, Angle=3.141592654)
c_script = CSharpScript(M=weld, radius=num)  # -> out, A; inputs M: Mesh, radius: Double
# ---------- c_script: C# usings ----------
using System.IO;
using System.Linq;
using System.Data;
using System.Drawing;
using System.Reflection;
using System.Windows.Forms;
using System.Xml;
using System.Xml.Linq;
using System.Runtime.InteropServices;

using Rhino.DocObjects;
using Rhino.Collections;
using GH_IO;
using GH_IO.Serialization;
# ---------- c_script: C# ----------
    Component.Message = "Weld Mesh - RTree";


    //Store naked mesh vertices and their ids
    List<Point3f> pts = new List<Point3f>();
    bool[] flag = M.GetNakedEdgePointStatus();

    allPointsFound = new List<List<int>>();

    //History is need to stop searching rtee
    //When all point groups are found
    history.Clear();

    //Create Rtree
    RTree tree = new RTree();

    for(int i = 0; i < flag.Length; i++){
      if(flag[i]){
        tree.Insert(M.Vertices[i], i);
        pts.Add(M.Vertices[i]);
      }
    }

    //Search RTree
    for(int i = 0; i < pts.Count; i++){
      tempIDList = new List<int>();
      tree.Search(new Sphere(pts[i], radius), method);

      if(tempIDList.Count > 1)
        allPointsFound.Add(tempIDList);

      if(history.Count == M.Vertices.Count)
        break;
    }

    //Now move found vertices to one of firs vertex position
    foreach(List<int> i in allPointsFound)
      for(int j = 1; j < i.Count; j++)
        M.Vertices[i[0]] = M.Vertices[i[j]];

    M.Vertices.CombineIdentical(true, true);


    A = M;
# ---------- c_script: C# additional code ----------
  //Rtree collections
  List<int> history = new List<int>();
  List<List<int>> allPointsFound;
  List<int> tempIDList;

  private void method(object sender, RTreeEventArgs e){
    if(!history.Contains(e.Id)){
      tempIDList.Add(e.Id);
      history.Add(e.Id);
    }
  }
# ---------- end c_script ----------
lattice_hinge_shell = ClusterOutput(c_script.A)  # Joined mesh that makes up the lattice hinge

# ==== cluster CrystallonV2MeshTweenCellFill: Tween between lattice unit cells on mesh faces

# ----
# Mesh Tween Cell Fill
value = ClusterInput()  # Value from 0-1 corresponding to each voxel
mesh_cell_1 = ClusterInput()  # Lattice Unit cell to map to mesh faces
mesh_face = ClusterInput()  # Mesh faces (exploded as single meshes)
mesh_cell_2 = ClusterInput()  # Lattice Unit cell to map to mesh faces
mesh = Mesh(mesh_face)
geo = Geometry(mesh_cell_1)
geo_2 = Geometry(mesh_cell_2)
num = Number(value)
toggle = BooleanToggle(True)
crv = Curve(geo)
crv_2 = Curve(geo_2)
mesh_2 = Mesh(geo)
clean = CleanTree(RemoveNulls=toggle, RemoveInvalid=toggle, RemoveEmpty=toggle, Tree=crv)
clean_2 = CleanTree(RemoveNulls=toggle, RemoveInvalid=toggle, RemoveEmpty=toggle, Tree=crv_2)
clean_3 = CleanTree(RemoveNulls=toggle, RemoveInvalid=toggle, RemoveEmpty=toggle, Tree=mesh_2)
tweencrv = TweenCurve(CurveA=flatten(clean), CurveB=flatten(clean_2), Factor=graft(num), BlendType=0)
cp = ControlPoints(Curve=tweencrv)  # -> Points, Weights, Knots
meshcp = MeshClosestPoint(Point=cp.Points, Mesh=clean_3)  # -> Point, Index, Parameter
trim = TrimTree(Tree=meshcp.Parameter, Depth=1)
crossref = CrossReference(ListA=trim, ListB=mesh, CrossMode=1)  # -> ListA, ListB
meval = MeshEval(Mesh=crossref.ListB, Parameter=simplify(crossref.ListA))  # -> Point, Normal, Colour
dispatch = Dispatch(List=meval.Point, DispatchPattern=[True, False])  # -> ListA, ListB
ln = Line(StartPoint=dispatch.ListA, EndPoint=dispatch.ListB)
join = JoinCurves(Curves=ln, Preserve=False)
lattice_hinge = ClusterOutput(join)  # Joined curves that makes up the lattice hinge

# ==== cluster CrystallonV2MeshTweenShellFill: Tween between mesh shell unit cells on mesh faces

# ----
# Mesh Tween Shell Fill
value = ClusterInput()  # Value from 0-1 corresponding to each voxel
mesh_shell_2 = ClusterInput()  # Shell Unit cell to map to mesh faces
mesh_face = ClusterInput()  # Mesh faces (exploded as single meshes)
tolerance = ClusterInput()  # Tolerance for merging faces and vertices (number usually between 0.001 and 0.1)
mesh_shell_1 = ClusterInput()  # Shell Unit cell to map to mesh faces
num = Number(value)
geo = Geometry(mesh_shell_2)
mesh = Mesh(mesh_face)
geo_2 = Geometry(mesh_shell_1)
num_2 = Number(tolerance)
item = ListItem(List=geo, Index=0, Wrap=True)  # -> Item, Item1
item_2 = ListItem(List=geo_2, Index=0, Wrap=True)  # -> Item, Item1
mesh_2 = Mesh(item.Item1)
mesh_3 = Mesh(item.Item)
mesh_4 = Mesh(item_2.Item)
mesh_5 = Mesh(item_2.Item1)
demesh = DeconstructMesh(Mesh=mesh_3)  # -> Vertices, Faces, Colours, Normals
demesh_2 = DeconstructMesh(Mesh=mesh_4)  # -> Vertices, Faces, Colours, Normals
ln = Line(StartPoint=demesh_2.Vertices, EndPoint=demesh.Vertices)
eval = EvaluateCurve(Curve=ln, Parameter=num)  # -> simplify(Point), Tangent, Angle
meshcp = MeshClosestPoint(Point=eval.Point, Mesh=mesh_5)  # -> Point, Index, Parameter
meval = MeshEval(Mesh=mesh, Parameter=meshcp.Parameter)  # -> Point, Normal, Colour
conmesh = ConstructMesh(Vertices=meval.Point, Faces=demesh.Faces)
mjoin = MeshJoin(Meshes=conmesh)
facen = FaceNormals(Mesh=mjoin)  # -> Centers, Normals
demesh_3 = DeconstructMesh(Mesh=mjoin)  # -> Vertices, Faces, Colours, Normals
cullpt = CullDuplicates(Points=facen.Centers, Tolerance=num_2, CullMode=1)  # -> Points, Indices, Valence
item_3 = ListItem(List=demesh_3.Faces, Index=cullpt.Indices, Wrap=True)
conmesh_2 = ConstructMesh(Vertices=demesh_3.Vertices, Faces=item_3)
weld = WeldMesh(Mesh=conmesh_2, Angle=3.141592654)
c_script = CSharpScript(M=weld, radius=num_2)  # -> out, A; inputs M: Mesh, radius: Double; same code as c_script
lattice_hinge_shell = ClusterOutput(c_script.A)  # Joined mesh that makes up the lattice hinge

# ==== cluster CrystallonV2CellType: A collection of pre-made unit cells

crv = Curve([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])
crv_2 = Curve([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])
crv_3 = Curve([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])
crv_4 = Curve([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])
crv_5 = Curve([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])
mesh = Mesh(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)
mesh_2 = Mesh(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)
mesh_3 = Mesh(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)
mesh_4 = Mesh([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])
crv_6 = Curve([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])
crv_7 = Curve([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])
crv_8 = Curve([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])
crv_9 = Curve([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])
crv_10 = Curve([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])
crv_11 = Curve([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])
crv_12 = Curve([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])
crv_13 = Curve([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])
crv_14 = Curve([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])
crv_15 = Curve([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])
crv_16 = Curve([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])
mesh_5 = Mesh(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)
mesh_6 = Mesh(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)
mesh_7 = Mesh(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)
mesh_8 = Mesh(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)
crv_17 = Curve([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])
crv_18 = Curve([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])
mesh_9 = Mesh(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)
geo = Geometry([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])
geo_2 = Geometry([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])
mesh_10 = Mesh([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])
panel = Panel("CELL TYPES")
entwine = Entwine(
    Branch00=crv_6,
    Branch01=crv_7,
    Branch02=crv,
    Branch03=crv_8,
    Branch04=crv_2,
    Branch05=crv_9,
    Branch06=crv_3,
    Branch07=crv_10,
    Branch08=crv_11,
    Branch09=crv_12,
    Branch010=crv_4,
    Branch011=crv_5,
    Branch012=crv_13,
    Branch013=crv_14,
    Branch014=crv_15,
    Branch015=crv_16,
    Branch016=mesh,
    Branch017=mesh_5,
    Branch018=mesh_6,
    Branch019=mesh_2,
    Branch020=mesh_7,
    Branch021=mesh_8,
    Branch022=crv_17,
    Branch023=crv_18,
    Branch024=mesh_9,
    Branch025=mesh_3,
    Branch026=geo,
    Branch027=mesh_4,
    Branch028=geo_2,
    Branch029=mesh_10,
    FlattenInputs=True)  # -> simplify(Result)
unit_cell_selector = ClusterInput()
branch = TreeBranch(Tree=entwine, Path=unit_cell_selector, MaintainPaths=True)
unit_cell = ClusterOutput(branch)  # Single unit cell to populate voxels

# ==== cluster CrystallonV2MeshHingeCellQuad: Map a quad based parametric cell with two domains to mesh faces

parameter_1b = ClusterInput()  # Number (0-1)
parameter_2d = ClusterInput()  # Number (0-1)
tolerance = ClusterInput()  # Tolerance for merging faces and vertices (number usually between 0.001 and 0.1)
parameter_1c = ClusterInput()  # Number (0-1)
parameter_1d = ClusterInput()  # Number (0-1)
parameter_2c = ClusterInput()  # Number (0-1)
parameter_1a = ClusterInput()  # Number (0-1)
mesh_face = ClusterInput()  # Mesh faces (exploded as single meshes)
parameter_2b = ClusterInput()  # Number (0-1)
parameter_2a = ClusterInput()  # Number (0-1)
num = Number(tolerance)
t1 = Number(parameter_2a)
t1_2 = Number(parameter_2d)
t1_3 = Number(parameter_2c)
t1_4 = Number(parameter_1a)
t1_5 = Number(parameter_2b)
mesh = Mesh(mesh_face)
t1_6 = Number(parameter_1c)
t1_7 = Number(parameter_1d)
t1_8 = Number(parameter_1b)
polygon = Polygon(Plane=PlaneXY(0, 0, 0), Radius="3", Segments="4", FilletRadius=0)  # -> Polygon, Length
merge = Merge(Data1=t1, Data2=t1_5, Data3=t1_3, Data4=t1_2)
merge_2 = Merge(Data1=t1_4, Data2=t1_8, Data3=t1_6, Data4=t1_7)
crv = Curve(polygon.Polygon)
item = ListItem(List=merge_2, Index=0, Wrap=True)  # -> flatten(Item)
shift = ShiftList(List=merge, Shift="-1", Wrap=True)
shift_2 = ShiftList(List=merge_2, Shift="-1", Wrap=True)
explode = Explode(Curve=crv, Recursive=True)  # -> Segments, Vertices
pcen = PolygonCenter(Polyline=crv)  # -> CenterV, CenterE, CenterA
lng = ListLength(List=item)
curvepoint = PointOnCurve(explode.Segments, parameter=0.5)
division = Division(A=shift, B="2")
cullpt = CullDuplicates(Points=explode.Vertices, Tolerance=0.1, CullMode=3)  # -> Points, Indices, Valence
dup = DuplicateData(Data=graft(explode.Segments), Number=lng, Order=True)  # -> simplify(graft(Data))
subtraction = Subtraction(A="1", B=division)
ln = Line(StartPoint=pcen.CenterV, EndPoint=curvepoint)
merge_3 = Merge(Data1=graft(division), Data2=graft(subtraction))  # -> simplify(Result)
trim = TrimTree(Tree=dup, Depth=1)
flip = FlipMatrix(Data=trim)  # -> graft(Data)
eval = EvaluateCurve(Curve=ln, Parameter=shift_2)  # -> simplify(Point), Tangent, Angle
eval_2 = EvaluateCurve(Curve=reparameterize(simplify(flip)), Parameter=merge_3)  # -> simplify(Point), Tangent, Angle
item_2 = ListItem(List=eval.Point, Index=0, Wrap=True)  # -> flatten(Item)
item_3 = ListItem(List=eval_2.Point, Index=0, Wrap=True)  # -> Item, Item1
lng_2 = ListLength(List=item_2)
item_4 = ListItem(List=curvepoint, Index=0, Wrap=True)  # -> Item, Item1, Item2, Item3
trim_2 = TrimTree(Tree=item_3.Item1, Depth=1)
trim_3 = TrimTree(Tree=item_3.Item, Depth=1)
dup_2 = DuplicateData(Data=item_4.Item1, Number=lng_2, Order=True)  # -> simplify(graft(Data))
dup_3 = DuplicateData(Data=item_4.Item2, Number=lng_2, Order=True)  # -> simplify(graft(Data))
dup_4 = DuplicateData(Data=item_4.Item, Number=lng_2, Order=True)  # -> simplify(graft(Data))
dup_5 = DuplicateData(Data=item_4.Item3, Number=lng_2, Order=True)  # -> simplify(graft(Data))
item_5 = ListItem(List=trim_3, Index=0, Wrap=True)  # -> Item, Item1, Item2, Item3
item_6 = ListItem(List=eval.Point, Index=0, Wrap=True)  # -> Item, Item1, Item2, Item3
item_7 = ListItem(List=trim_2, Index=0, Wrap=True)  # -> Item, Item1, Item2, Item3
quad = MeshQuad(CornerA=0, CornerB=1, CornerC=2, CornerD=3)
conmesh = ConstructMesh(Vertices=[item_6.Item2, item_6.Item3, dup_5], Faces={A=0, B=1, C=2, D=2})
conmesh_2 = ConstructMesh(Vertices=[item_6.Item1, dup_2, item_7.Item1], Faces={A=0, B=1, C=2, D=2})
conmesh_3 = ConstructMesh(Vertices=[dup_2, item_6.Item, item_5.Item1], Faces={A=0, B=1, C=2, D=2})
conmesh_4 = ConstructMesh(Vertices=[dup_4, item_6.Item, item_7.Item], Faces={A=0, B=1, C=2, D=2})
conmesh_5 = ConstructMesh(Vertices=[dup_3, item_6.Item2, item_7.Item2], Faces={A=0, B=1, C=2, D=2})
conmesh_6 = ConstructMesh(Vertices=[item_7.Item3, dup_5, item_6.Item3], Faces={A=0, B=1, C=2, D=2})
conmesh_7 = ConstructMesh(Vertices=[dup_3, item_6.Item1, item_5.Item2], Faces={A=0, B=1, C=2, D=2})
conmesh_8 = ConstructMesh(Vertices=[item_6.Item2, item_5.Item3, dup_5], Faces={A=0, B=1, C=2, D=2})
conmesh_9 = ConstructMesh(Vertices=[item_6.Item, item_6.Item3, dup_4], Faces={A=0, B=1, C=2, D=2})
conmesh_10 = ConstructMesh(Vertices=[dup_2, item_6.Item, item_6.Item1], Faces={A=0, B=1, C=2, D=2})
conmesh_11 = ConstructMesh(Vertices=eval.Point, Faces=quad)
conmesh_12 = ConstructMesh(Vertices=[dup_3, item_6.Item2, item_6.Item1], Faces={A=0, B=1, C=2, D=2})
conmesh_13 = ConstructMesh(Vertices=[item_6.Item3, item_5.Item, dup_4], Faces={A=0, B=1, C=2, D=2})
merge_4 = Merge(
    Data1=conmesh_11,
    Data2=conmesh_9,
    Data3=conmesh_10,
    Data4=conmesh_12,
    Data5=conmesh,
    Data6=conmesh_4,
    Data7=conmesh_2,
    Data8=conmesh_5,
    Data9=conmesh_6,
    Data10=conmesh_8,
    Data11=conmesh_3,
    Data12=conmesh_7,
    Data13=conmesh_13)
mjoin = MeshJoin(Meshes=merge_4)
unim = UnifyMesh(Mesh=mjoin)  # -> Result, Count
demesh = DeconstructMesh(Mesh=unim.Result)  # -> Vertices, Faces, Colours, Normals
deface = DeconstructFace(Face=demesh.Faces)  # -> CornerA, CornerB, CornerC, CornerD
item_8 = ListItem(List=demesh.Vertices, Index=deface.CornerA, Wrap=True)
item_9 = ListItem(List=demesh.Vertices, Index=deface.CornerB, Wrap=True)
cullpt_2 = CullDuplicates(Points=demesh.Vertices, Tolerance=num, CullMode=3)  # -> Points, Indices, Valence
item_10 = ListItem(List=demesh.Vertices, Index=deface.CornerC, Wrap=True)
item_11 = ListItem(List=demesh.Vertices, Index=deface.CornerD, Wrap=True)
fsim = FindSimilarMember(Data=item_9, Set=cullpt_2.Points)  # -> Hit, Index
fsim_2 = FindSimilarMember(Data=item_10, Set=cullpt_2.Points)  # -> Hit, Index
fsim_3 = FindSimilarMember(Data=item_11, Set=cullpt_2.Points)  # -> Hit, Index
fsim_4 = FindSimilarMember(Data=item_8, Set=cullpt_2.Points)  # -> Hit, Index
quad_2 = MeshQuad(CornerA=fsim_4.Index, CornerB=fsim.Index, CornerC=fsim_2.Index, CornerD=fsim_3.Index)
conmesh_14 = ConstructMesh(Vertices=cullpt_2.Points, Faces=quad_2)  # -> simplify(Mesh)
conmesh_15 = ConstructMesh(Vertices=cullpt.Points, Faces={A=0, B=1, C=2, D=3})
weld = WeldMesh(Mesh=conmesh_14, Angle=3.141592654)
mesh_2 = Mesh(weld)
mesh_3 = Mesh(conmesh_15)
crv_2 = Curve(crv)
demesh_2 = DeconstructMesh(Mesh=mesh_2)  # -> Vertices, Faces, Colours, Normals
meshcp = MeshClosestPoint(Point=demesh_2.Vertices, Mesh=mesh_3)  # -> Point, Index, Parameter
meval = MeshEval(Mesh=mesh, Parameter=meshcp.Parameter)  # -> Point, Normal, Colour
conmesh_16 = ConstructMesh(Vertices=meval.Point, Faces=demesh_2.Faces)
mjoin_2 = MeshJoin(Meshes=flatten(conmesh_16))
facen = FaceNormals(Mesh=mjoin_2)  # -> Centers, Normals
demesh_3 = DeconstructMesh(Mesh=mjoin_2)  # -> Vertices, Faces, Colours, Normals
cullpt_3 = CullDuplicates(Points=facen.Centers, Tolerance=num, CullMode=1)  # -> Points, Indices, Valence
item_12 = ListItem(List=demesh_3.Faces, Index=cullpt_3.Indices, Wrap=True)
conmesh_17 = ConstructMesh(Vertices=demesh_3.Vertices, Faces=item_12)
weld_2 = WeldMesh(Mesh=conmesh_17, Angle=3.141592654)
c_script = CSharpScript(M=weld_2, radius=num)  # -> out, A; inputs M: Mesh, radius: Double; same code as c_script
lattice_hinge_shell = ClusterOutput(c_script.A)  # Joined mesh that makes up the lattice hinge
