# Grasshopper definition 01-Lattice Topology.gh (Grasshopper 1.0.7)
# Copyright: ©2019 GNU General Public License

# ---- group: Geometry
planesrf = PlaneSurface(Plane=PlaneXY(0, 0, 0), XSize=Domain(-10, 10), YSize=Domain(-10, 10))
Z = UnitZ(Factor="20")
range = Range(Domain=Domain(0, 1), Steps=Slider(3, range=0..10))
move = Move(Geometry=planesrf, Motion=Z)  # -> Geometry, Transform
mbs = CrystallonV2MorphBetweenSurfaces(surfaces=[planesrf, move.Geometry], x_parameter=range, y_parameter=range, z_parameter=range)

# ---- group: Cell Fill
unit_cell_selector = CrystallonV2CellSelector({"Prim. Cubic": 0, "BC": 1, "BC Cubic": 2, "FC Cubic": 3, "Edge Octa.": 4, "Vertex Octa.": 5, "NaCl": 6, "Star Tet.": 7, "BC Star Tet.": 8, "Octa. Tet.": 9, "Dodecahedron": 10, "Trunc. Octa.": 11, "Tetrahedral": 12, "Auxetic": 13, "BC1 (tween)": 14, "BC2 (tween)": 15, "Octa. (shell)": 16, "Dodeca. (shell)": 17, "Trunc. Octa. (shell)": 18, "Gyroid (shell)": 19, "Cubic Center (shell)": 20, "Cubic Face (shell)": 21, "LH Square": 22, "LH Round": 23, "LH Square (shell)": 24, "LH Auxetic (shell)": 25, "MC Tri": 26, "MS Tri (shell)": 27, "MC Quad": 28, "MS Quad (shell)": 29}, selected="BC")
ct = CrystallonV2CellType(unit_cell_selector=unit_cell_selector)
clf = CrystallonV2CellLatticeFill(unit_cell=ct, voxels=mbs)

# ---- group: Lattice Topology
lt = CrystallonV2LatticeTopology(lattice_beams=clf, tolerance=".1")  # -> nodes, line_point_connections, point_line_connections

# ---- group: Beams
item = ListItem(List=lt.nodes, Index=lt.line_point_connections, Wrap=True)
item_2 = ListItem(List=item, Index=0, Wrap=True)  # -> Item, Item1
branch = TreeBranch(Tree=lt.line_point_connections, Path=Slider(2, range=0..100), MaintainPaths=True)
ln = Line(StartPoint=item_2.Item, EndPoint=item_2.Item1)  # -> flatten(Line)
panel = Panel(branch)
curvepoint = PointOnCurve(ln, parameter=0.5)
lng = ListLength(List=ln)
beam_count = Panel(lng)
series = Series(Start=0, Step=1, Count=lng)
tag = TextTag(Location=curvepoint, Text=series, Colour=ColourSwatch(SwatchColor=RGB(208, 0, 255)))
preview = CustomPreview(Geometry=ln, Material=ColourSwatch(SwatchColor=RGB(0, 0, 0)))

# ---- group: Point-Line Connections
branch_2 = TreeBranch(Tree=lt.point_line_connections, Path=Slider(19, range=0..100), MaintainPaths=True)
item_3 = ListItem(List=ln, Index=branch_2, Wrap=True)
pipe = Pipe(Curve=item_3, Radius=".1", Caps=0)
preview_2 = CustomPreview(Geometry=pipe, Material=ColourSwatch(SwatchColor=RGB(47, 255, 0)))

# ---- group: Nodes
lng_2 = ListLength(List=lt.nodes)
sph = Sphere(Base=lt.nodes, Radius=".2")
node_count = Panel(lng_2)
series_2 = Series(Start=0, Step=1, Count=lng_2)
preview_3 = CustomPreview(Geometry=sph, Material=ColourSwatch(SwatchColor=RGB(0, 255, 255)))
tag_2 = TextTag(Location=lt.nodes, Text=series_2, Colour=ColourSwatch(SwatchColor=RGB(0, 4, 255)))

# ==== cluster CrystallonV2LatticeTopology: Creates a clean graph from a lattice with unique nodes and their connections

tolerance = ClusterInput()  # Tolerance to merge points
lattice_beams = ClusterInput()  # Lattice Curves
num = Number(tolerance)
crv = Curve(lattice_beams)
cp = ControlPoints(Curve=crv)  # -> simplify(Points), Weights, Knots
cullpt = CullDuplicates(Points=flatten(cp.Points), Tolerance=num, CullMode=3)  # -> Points, Indices, Valence
sort_pt = SortPoints(Points=cullpt.Points)  # -> Points, Indices
lng = ListLength(List=crv)
lng_2 = ListLength(List=sort_pt.Points)
fsim = FindSimilarMember(Data=cp.Points, Set=sort_pt.Points)  # -> Hit, simplify(Index)
series = Series(Start=0, Step=1, Count=lng)  # -> simplify(Series)
series_2 = Series(Start=0, Step=1, Count=lng_2)  # -> simplify(Series)
# CRYSTALLON V2.0 -- Lattice structure tools for Grasshopper3D
# 
# Copyright (C) 2019  Aaron Porterfield
# 
# www.fequalsf.com
# info@fequalsf.com
# 
#     This program is free software: you can redistribute it and/or modify
#     it under the terms of the GNU General Public License as published by
#     the Free Software Foundation, either version 3 of the License, or any later version.
# 
#     This program is distributed in the hope that it will be useful,
#     but WITHOUT ANY WARRANTY; without even the implied warranty of
#     MERCHANTABILITY or FITNESS FOR A PARTICULAR PURPOSE.  See the
#     GNU General Public License for more details.
# 
#     You should have received a copy of the GNU General Public License
#     along with this program.  If not, see <http://www.gnu.org/licenses/>.
panel = Panel("LATTICE TOPOLOGY")
num_2 = Number(fsim.Index)
pt = Point(sort_pt.Points)
equals = Equality(FirstNumber=series_2, SecondNumber=graft(num_2))  # -> Equality, Inequality
flip = FlipMatrix(Data=equals.Equality)
partition = PartitionList(List=flip, Size="2")  # -> simplify(Chunks)
item = ListItem(List=partition, Index=0, Wrap=True)  # -> Item, Item1
or = GateOr(A=item.Item, B=item.Item1)
trim = TrimTree(Tree=or, Depth=1)
cull = CullPattern(List=series, CullPattern=trim)  # -> simplify(List)
nodes = ClusterOutput(pt)  # Unique points in the network
line_point_connections = ClusterOutput(num_2)  # Index of points that make up each beam
point_line_connections = ClusterOutput(cull)  # For each point, lists the index of each line connected to it

# ==== cluster CrystallonV2MorphBetweenSurfaces: Conformal fill of voxels between two or more surfaces

x_parameter = ClusterInput()  # Range of numbers (0-1) for X divisions
z_parameter = ClusterInput()  # Range of numbers (0-1) for Z divisions
surfaces = ClusterInput()  # At least 2 surfaces to morph voxels between
y_parameter = ClusterInput()  # Range of numbers (0-1) for Y divisions
srf = Surface(flatten(surfaces))
num = Number(y_parameter)
num_2 = Number(x_parameter)
num_3 = Number(z_parameter)
pt = ConstructPoint(XCoordinate=simplify(graft(num_2)), YCoordinate=simplify(num), ZCoordinate=0)  # -> simplify(Point)
lng = ListLength(List=num_2)
num_4 = Number(lng)
evalsrf = EvaluateSurface(Surface=reparameterize(simplify(srf)), Point=simplify(graft(pt)))  # -> simplify(Point), Normal, Frame
pline = PolyLine(Vertices=evalsrf.Point, Closed=False)
eval = EvaluateCurve(Curve=reparameterize(pline), Parameter=num_3)  # -> Point, Tangent, Angle
path_mapper = PathMapper(eval.Point, source="{A;B}(i)", target="{B;A}(i)")
path_mapper_2 = PathMapper(path_mapper, source="{A;B}", target="{path_index}")
toggle = BooleanToggle(False)
shift = ShiftList(List=path_mapper_2, Shift="1", Wrap=toggle)
shift_2 = ShiftList(List=path_mapper_2, Shift="-1", Wrap=toggle)
flip = FlipMatrix(Data=shift)
flip_2 = FlipMatrix(Data=shift_2)
partition = PartitionList(List=flip_2, Size=num_4)
partition_2 = PartitionList(List=flip, Size=num_4)
shift_3 = ShiftList(List=partition, Shift="-1", Wrap=toggle)  # -> simplify(List)
shift_4 = ShiftList(List=partition, Shift="1", Wrap=toggle)  # -> simplify(List)
shift_5 = ShiftList(List=partition_2, Shift="1", Wrap=toggle)  # -> simplify(List)
shift_6 = ShiftList(List=partition_2, Shift="-1", Wrap=toggle)  # -> simplify(List)
path_mapper_3 = PathMapper(shift_4, source="{A;B}(i)", target="{A;i}(B)")
path_mapper_4 = PathMapper(shift_3, source="{A;B}(i)", target="{A;i}(B)")
path_mapper_5 = PathMapper(shift_5, source="{A;B}(i)", target="{A;i}(B)")
path_mapper_6 = PathMapper(shift_6, source="{A;B}(i)", target="{A;i}(B)")
shift_7 = ShiftList(List=path_mapper_4, Shift="-1", Wrap=toggle)
shift_8 = ShiftList(List=path_mapper_3, Shift="1", Wrap=toggle)
shift_9 = ShiftList(List=path_mapper_3, Shift="-1", Wrap=toggle)
shift_10 = ShiftList(List=path_mapper_6, Shift="-1", Wrap=toggle)
shift_11 = ShiftList(List=path_mapper_4, Shift="1", Wrap=toggle)
shift_12 = ShiftList(List=path_mapper_5, Shift="1", Wrap=toggle)
shift_13 = ShiftList(List=path_mapper_5, Shift="-1", Wrap=toggle)
shift_14 = ShiftList(List=path_mapper_6, Shift="1", Wrap=toggle)
tbox = TwistedBox(
    CornerA=shift_11,
    CornerB=shift_7,
    CornerC=shift_9,
    CornerD=shift_8,
    CornerE=shift_14,
    CornerF=shift_10,
    CornerG=shift_13,
    CornerH=shift_12)
voxels = ClusterOutput(tbox)  # Voxels to be filled with unit cells

# ==== cluster CrystallonV2CellType: A collection of pre-made unit cells

crv = Curve([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])
crv_2 = Curve([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])
crv_3 = Curve([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])
crv_4 = Curve([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])
crv_5 = Curve([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])
mesh = Mesh(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)
mesh_2 = Mesh(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)
mesh_3 = Mesh(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)
mesh_4 = Mesh([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])
crv_6 = Curve([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])
crv_7 = Curve([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])
crv_8 = Curve([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])
crv_9 = Curve([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])
crv_10 = Curve([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])
crv_11 = Curve([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])
crv_12 = Curve([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])
crv_13 = Curve([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])
crv_14 = Curve([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])
crv_15 = Curve([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])
crv_16 = Curve([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])
mesh_5 = Mesh(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)
mesh_6 = Mesh(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)
mesh_7 = Mesh(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)
mesh_8 = Mesh(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)
crv_17 = Curve([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])
crv_18 = Curve([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])
mesh_9 = Mesh(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)
geo = Geometry([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])
geo_2 = Geometry([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])
mesh_10 = Mesh([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])
panel = Panel("CELL TYPES")
entwine = Entwine(
    Branch00=crv_6,
    Branch01=crv_7,
    Branch02=crv,
    Branch03=crv_8,
    Branch04=crv_2,
    Branch05=crv_9,
    Branch06=crv_3,
    Branch07=crv_10,
    Branch08=crv_11,
    Branch09=crv_12,
    Branch010=crv_4,
    Branch011=crv_5,
    Branch012=crv_13,
    Branch013=crv_14,
    Branch014=crv_15,
    Branch015=crv_16,
    Branch016=mesh,
    Branch017=mesh_5,
    Branch018=mesh_6,
    Branch019=mesh_2,
    Branch020=mesh_7,
    Branch021=mesh_8,
    Branch022=crv_17,
    Branch023=crv_18,
    Branch024=mesh_9,
    Branch025=mesh_3,
    Branch026=geo,
    Branch027=mesh_4,
    Branch028=geo_2,
    Branch029=mesh_10,
    FlattenInputs=True)  # -> simplify(Result)
unit_cell_selector = ClusterInput()
branch = TreeBranch(Tree=entwine, Path=unit_cell_selector, MaintainPaths=True)
unit_cell = ClusterOutput(branch)  # Single unit cell to populate voxels

# ==== cluster CrystallonV2CellLatticeFill: Fill voxels with lattice unit cells

unit_cell = ClusterInput()  # Unit cell to populate voxels
voxels = ClusterInput()  # Voxels to be filled with unit cells
crv = Curve(unit_cell)
bbox = BoundingBox(Content=crv, Plane=PlaneXY(0, 0, 0), UnionBox=True)  # -> Box, Box_2
panel = Panel("CELL FILL")
morph = BoxMorph(Geometry=crv, Reference=bbox.Box, Target=graft(voxels))  # -> flatten(Geometry)
remove_duplicate_lines = RemoveDuplicateLines(lattice_l=flatten(morph))
lattice = ClusterOutput(remove_duplicate_lines)  # List of curves that make up the lattice

# ==== cluster RemoveDuplicateLines
lattice_l = ClusterInput()
crv = Curve(lattice_l)
curvepoint = PointOnCurve(crv, parameter=0.5)
cullpt = CullDuplicates(Points=curvepoint, Tolerance=".001", CullMode=1)  # -> Points, Indices, Valence
item = ListItem(List=crv, Index=cullpt.Indices, Wrap=True)
lattice = ClusterOutput(item)
