# Grasshopper definition 02-LTCX Writer.gh (Grasshopper 1.0.7)
# Copyright: ©2019 GNU General Public License

# ---- group: Geometry
planesrf = PlaneSurface(Plane=PlaneXY(0, 0, 0), XSize=Domain(-10, 10), YSize=Domain(-10, 10))
Z = UnitZ(Factor="20")
range = Range(Domain=Domain(0, 1), Steps=Slider(5, range=0..10))
move = Move(Geometry=planesrf, Motion=Z)  # -> Geometry, Transform
mbs = CrystallonV2MorphBetweenSurfaces(surfaces=[planesrf, move.Geometry], x_parameter=range, y_parameter=range, z_parameter=range)

# ---- group: Attractor
md_slider = MDSlider(
    SliderMode=0,
    slider_value=Point(0.1232725702, 0.5500183105, 0.5),
    x_domain=Domain(0, 1),
    y_domain=Domain(0, 1),
    z_domain=Domain(0, 1))
Z_2 = UnitZ(Factor=Slider(16.095, range=0..20))
move_2 = Move(Geometry=planesrf, Motion=Z_2)  # -> Geometry, Transform
evalsrf = EvaluateSurface(Surface=reparameterize(move_2.Geometry), Point=md_slider)  # -> Point, Normal, UDirection, VDirection, Frame
sph = Sphere(Base=evalsrf.Point, Radius=1)

# ---- group: Cell Fill
unit_cell_selector = CrystallonV2CellSelector({"Prim. Cubic": 0, "BC": 1, "BC Cubic": 2, "FC Cubic": 3, "Edge Octa.": 4, "Vertex Octa.": 5, "NaCl": 6, "Star Tet.": 7, "BC Star Tet.": 8, "Octa. Tet.": 9, "Dodecahedron": 10, "Trunc. Octa.": 11, "Tetrahedral": 12, "Auxetic": 13, "BC1 (tween)": 14, "BC2 (tween)": 15, "Octa. (shell)": 16, "Dodeca. (shell)": 17, "Trunc. Octa. (shell)": 18, "Gyroid (shell)": 19, "Cubic Center (shell)": 20, "Cubic Face (shell)": 21, "LH Square": 22, "LH Round": 23, "LH Square (shell)": 24, "LH Auxetic (shell)": 25, "MC Tri": 26, "MS Tri (shell)": 27, "MC Quad": 28, "MS Quad (shell)": 29}, selected="BC")
ct = CrystallonV2CellType(unit_cell_selector=unit_cell_selector)
clf = CrystallonV2CellLatticeFill(unit_cell=ct, voxels=mbs)

# ---- group: Lattice Thickness (attractor)
lta = CrystallonV2LatticeThicknessAttractor(
    lattice=clf,
    attractor=evalsrf.Point,
    influence=Slider(0.228, range=0..1),
    magnitude_min=Slider(0.087, range=0..1),
    magnitude_max=Slider(0.582, range=0..1))
pipe = Pipe(Curve=clf, Radius=lta, Caps=0)
preview = CustomPreview(Geometry=pipe, Material=ColourSwatch(SwatchColor=RGB(120, 120, 120)))

# ---- group: LTCX Writer
lxo = CrystallonV2LTCXWriter(id="001", name="example", units="mm", type="rnd", lattice_beams=clf, radius=lta, tolerance=".1")

# ----
panel = Panel(lxo)

# ==== cluster CrystallonV2LTCXWriter: Creates a LTCX output

radius = ClusterInput()  # A list of radii that corresponds with the lattice beams
tolerance = ClusterInput()  # Tolerance to merge points
lattice_beams = ClusterInput()  # Lattice Curves
crv = Curve(lattice_beams)
# CRYSTALLON V2.0 -- Lattice structure tools for Grasshopper3D
# 
# Copyright (C) 2019  Aaron Porterfield
# 
# www.fequalsf.com
# info@fequalsf.com
# 
#     This program is free software: you can redistribute it and/or modify
#     it under the terms of the GNU General Public License as published by
#     the Free Software Foundation, either version 3 of the License, or any later version.
# 
#     This program is distributed in the hope that it will be useful,
#     but WITHOUT ANY WARRANTY; without even the implied warranty of
#     MERCHANTABILITY or FITNESS FOR A PARTICULAR PURPOSE.  See the
#     GNU General Public License for more details.
# 
#     You should have received a copy of the GNU General Public License
#     along with this program.  If not, see <http://www.gnu.org/licenses/>.
id = ClusterInput()  # graph ID (number)
num = Number(tolerance)
type = ClusterInput()  # Cross Section (rnd)
name = ClusterInput()  # File Name
units = ClusterInput()  # Units (in/mm)
num_2 = Number(radius)
cp = ControlPoints(Curve=crv)  # -> Points, Weights, Knots
num_3 = Number(num)
cullpt = CullDuplicates(Points=flatten(cp.Points), Tolerance=num_3, CullMode=3)  # -> Points, Indices, Valence
cp_2 = ClosestPoint(Point=cullpt.Points, Cloud=cp.Points)  # -> ClosestPoint, CPIndex, Distance
flip = FlipMatrix(Data=cp_2.Distance)
smaller = SmallerThan(FirstNumber=flip, SecondNumber=num)  # -> SmallerThan, OrEqualTo
cull = CullPattern(List=flatten(num_2), CullPattern=smaller.OrEqualTo)
fsim = FindSimilarMember(Data=cp.Points, Set=cullpt.Points)  # -> Hit, Index
lng = ListLength(List=cullpt.Points)
avr = Average(Input=cull)  # -> flatten(ArithmeticMean)
devec = DeconstructVector(Vector=cullpt.Points)  # -> XComponent, YComponent, ZComponent
series = Series(Start=0, Step=1, Count=lng)
format = Expression(
    x=series,
    y=devec.XComponent,
    z=devec.YComponent,
    u=devec.ZComponent,
    v=avr,
    Expression="Format(\"                <node id='{0}' x='{1}' y='{2}' z='{3}' r='{4}'/>\", x, Round (y, 3), Round (z, 3), Round (u, 3), Round (v, 3))")
lng_2 = ListLength(List=flatten(crv))
item = ListItem(List=fsim.Index, Index="0", Wrap=True)  # -> Item, Item1
series_2 = Series(Start=0, Step=1, Count=lng_2)  # -> graft(Series)
format_2 = Expression(
    x=series_2,
    y=item.Item,
    z=item.Item1,
    Expression="Format(\"                <beam id='{0}' n1='{1}' n2='{2}'/>\", x, y, z)")
format_3 = Expression(x=id, y=name, z=units, u=type, Expression="Format(\"<graph id='{0}' name='{1}' units='{2}' type='{3}'>\", x, y, z, u)")
panel = Panel("""<?xml version="1.0" encoding="UTF-8"?>
<!--Generator: Grasshopper , LTCX export module , Aaron Porterfield. -->""")
rep = ReplaceText(Text=format_3, Find="'", Replace="\"", RecursiveReplace=False)
rep_2 = ReplaceText(Text=format_2, Find="'", Replace="\"", RecursiveReplace=False)
rep_3 = ReplaceText(Text=format, Find="'", Replace="\"", RecursiveReplace=False)
entwine = Entwine(
    Branch00=panel,
    Branch01=rep,
    Branch02="\t<nodegroup>",
    Branch03=rep_3,
    Branch04="\t</nodegroup>",
    Branch05="\t<beamgroup>",
    Branch06=rep_2,
    Branch07="\t</beamgroup>",
    Branch08="</graph>",
    FlattenInputs=True)  # -> flatten(Result)
ltcx_output = ClusterOutput(entwine)  # output text

# ==== cluster CrystallonV2CellLatticeFill: Fill voxels with lattice unit cells

unit_cell = ClusterInput()  # Unit cell to populate voxels
voxels = ClusterInput()  # Voxels to be filled with unit cells
crv = Curve(unit_cell)
bbox = BoundingBox(Content=crv, Plane=PlaneXY(0, 0, 0), UnionBox=True)  # -> Box, Box_2
panel = Panel("CELL FILL")
morph = BoxMorph(Geometry=crv, Reference=bbox.Box, Target=graft(voxels))  # -> flatten(Geometry)
remove_duplicate_lines = RemoveDuplicateLines(lattice_l=flatten(morph))
lattice = ClusterOutput(remove_duplicate_lines)  # List of curves that make up the lattice

# ==== cluster CrystallonV2CellType: A collection of pre-made unit cells

crv = Curve([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])
crv_2 = Curve([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])
crv_3 = Curve([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])
crv_4 = Curve([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])
crv_5 = Curve([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])
mesh = Mesh(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)
mesh_2 = Mesh(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)
mesh_3 = Mesh(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)
mesh_4 = Mesh([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])
crv_6 = Curve([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])
crv_7 = Curve([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])
crv_8 = Curve([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])
crv_9 = Curve([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])
crv_10 = Curve([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])
crv_11 = Curve([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])
crv_12 = Curve([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])
crv_13 = Curve([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])
crv_14 = Curve([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])
crv_15 = Curve([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])
crv_16 = Curve([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])
mesh_5 = Mesh(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)
mesh_6 = Mesh(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)
mesh_7 = Mesh(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)
mesh_8 = Mesh(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)
crv_17 = Curve([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])
crv_18 = Curve([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])
mesh_9 = Mesh(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)
geo = Geometry([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])
geo_2 = Geometry([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])
mesh_10 = Mesh([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])
panel = Panel("CELL TYPES")
entwine = Entwine(
    Branch00=crv_6,
    Branch01=crv_7,
    Branch02=crv,
    Branch03=crv_8,
    Branch04=crv_2,
    Branch05=crv_9,
    Branch06=crv_3,
    Branch07=crv_10,
    Branch08=crv_11,
    Branch09=crv_12,
    Branch010=crv_4,
    Branch011=crv_5,
    Branch012=crv_13,
    Branch013=crv_14,
    Branch014=crv_15,
    Branch015=crv_16,
    Branch016=mesh,
    Branch017=mesh_5,
    Branch018=mesh_6,
    Branch019=mesh_2,
    Branch020=mesh_7,
    Branch021=mesh_8,
    Branch022=crv_17,
    Branch023=crv_18,
    Branch024=mesh_9,
    Branch025=mesh_3,
    Branch026=geo,
    Branch027=mesh_4,
    Branch028=geo_2,
    Branch029=mesh_10,
    FlattenInputs=True)  # -> simplify(Result)
unit_cell_selector = ClusterInput()
branch = TreeBranch(Tree=entwine, Path=unit_cell_selector, MaintainPaths=True)
unit_cell = ClusterOutput(branch)  # Single unit cell to populate voxels

# ==== cluster CrystallonV2MorphBetweenSurfaces: Conformal fill of voxels between two or more surfaces

x_parameter = ClusterInput()  # Range of numbers (0-1) for X divisions
z_parameter = ClusterInput()  # Range of numbers (0-1) for Z divisions
surfaces = ClusterInput()  # At least 2 surfaces to morph voxels between
y_parameter = ClusterInput()  # Range of numbers (0-1) for Y divisions
srf = Surface(flatten(surfaces))
num = Number(y_parameter)
num_2 = Number(x_parameter)
num_3 = Number(z_parameter)
pt = ConstructPoint(XCoordinate=simplify(graft(num_2)), YCoordinate=simplify(num), ZCoordinate=0)  # -> simplify(Point)
lng = ListLength(List=num_2)
num_4 = Number(lng)
evalsrf = EvaluateSurface(Surface=reparameterize(simplify(srf)), Point=simplify(graft(pt)))  # -> simplify(Point), Normal, Frame
pline = PolyLine(Vertices=evalsrf.Point, Closed=False)
eval = EvaluateCurve(Curve=reparameterize(pline), Parameter=num_3)  # -> Point, Tangent, Angle
path_mapper = PathMapper(eval.Point, source="{A;B}(i)", target="{B;A}(i)")
path_mapper_2 = PathMapper(path_mapper, source="{A;B}", target="{path_index}")
toggle = BooleanToggle(False)
shift = ShiftList(List=path_mapper_2, Shift="1", Wrap=toggle)
shift_2 = ShiftList(List=path_mapper_2, Shift="-1", Wrap=toggle)
flip = FlipMatrix(Data=shift)
flip_2 = FlipMatrix(Data=shift_2)
partition = PartitionList(List=flip_2, Size=num_4)
partition_2 = PartitionList(List=flip, Size=num_4)
shift_3 = ShiftList(List=partition, Shift="-1", Wrap=toggle)  # -> simplify(List)
shift_4 = ShiftList(List=partition, Shift="1", Wrap=toggle)  # -> simplify(List)
shift_5 = ShiftList(List=partition_2, Shift="1", Wrap=toggle)  # -> simplify(List)
shift_6 = ShiftList(List=partition_2, Shift="-1", Wrap=toggle)  # -> simplify(List)
path_mapper_3 = PathMapper(shift_4, source="{A;B}(i)", target="{A;i}(B)")
path_mapper_4 = PathMapper(shift_3, source="{A;B}(i)", target="{A;i}(B)")
path_mapper_5 = PathMapper(shift_5, source="{A;B}(i)", target="{A;i}(B)")
path_mapper_6 = PathMapper(shift_6, source="{A;B}(i)", target="{A;i}(B)")
shift_7 = ShiftList(List=path_mapper_4, Shift="-1", Wrap=toggle)
shift_8 = ShiftList(List=path_mapper_3, Shift="1", Wrap=toggle)
shift_9 = ShiftList(List=path_mapper_3, Shift="-1", Wrap=toggle)
shift_10 = ShiftList(List=path_mapper_6, Shift="-1", Wrap=toggle)
shift_11 = ShiftList(List=path_mapper_4, Shift="1", Wrap=toggle)
shift_12 = ShiftList(List=path_mapper_5, Shift="1", Wrap=toggle)
shift_13 = ShiftList(List=path_mapper_5, Shift="-1", Wrap=toggle)
shift_14 = ShiftList(List=path_mapper_6, Shift="1", Wrap=toggle)
tbox = TwistedBox(
    CornerA=shift_11,
    CornerB=shift_7,
    CornerC=shift_9,
    CornerD=shift_8,
    CornerE=shift_14,
    CornerF=shift_10,
    CornerG=shift_13,
    CornerH=shift_12)
voxels = ClusterOutput(tbox)  # Voxels to be filled with unit cells

# ==== cluster CrystallonV2LatticeThicknessAttractor: Apply thickness values to lattice curves with attractor(s)

lattice = ClusterInput()  # Lattice to thicken
attractor = ClusterInput()  # Any geometry to use as attractor(s)
influence = ClusterInput()  # Smoothed range of attractor influence (0-1)
magnitude_min = ClusterInput()  # Lattice beam thickness (minimum value)
magnitude_max = ClusterInput()  # Lattice beam thickness (maximum value)
crv = Curve(lattice)
geo = Geometry(attractor)
curvepoint = PointOnCurve(crv, parameter=0.5)
pull = PullPoint(Point=curvepoint, Geometry=geo, ClosestOnly=True)  # -> ClosestPoint, Distance
panel = Panel("THICKNESS ATTRACTOR")
expression = Expression(x=influence, y=pull.Distance, Expression="-1*e^(-x*y)")
dom = ConstructDomain(DomainStart=magnitude_min, DomainEnd=magnitude_max)
bnd = Bounds(Numbers=expression)
dedomain = DeconstructDomain(Domain=bnd)  # -> Start, End
dom_2 = ConstructDomain(DomainStart=dedomain.End, DomainEnd=dedomain.Start)
remap = RemapNumbers(Value=expression, Source=dom_2, Target=dom)  # -> Mapped, Clipped
value = ClusterOutput(remap.Mapped)  # Values for beam thickness

# ==== cluster RemoveDuplicateLines
lattice_l = ClusterInput()
crv = Curve(lattice_l)
curvepoint = PointOnCurve(crv, parameter=0.5)
cullpt = CullDuplicates(Points=curvepoint, Tolerance=".001", CullMode=1)  # -> Points, Indices, Valence
item = ListItem(List=crv, Index=cullpt.Indices, Wrap=True)
lattice = ClusterOutput(item)
