# Grasshopper definition 03-LTCX Parser.gh (Grasshopper 1.0.7)
# Copyright: ©2019 GNU General Public License

# ---- group: LTCX Parser
path = FilePath("C:\Users\porte\Desktop\Crystallon\ExamplesV2\06-Utilities\example.ltcx")
lxi = CrystallonV2LTCXParser(ltcx_file=path, enable_beams=Toggle(False))  # -> node, node_radius, line_point_connections, beam_curves, beam_radius
item = ListItem(List=lxi.node, Index=lxi.line_point_connections, Wrap=True)
item_2 = ListItem(List=lxi.node_radius, Index=lxi.line_point_connections, Wrap=True)
item_3 = ListItem(List=item, Index=0, Wrap=True)  # -> Item, Item1
avr = Average(Input=item_2)
ln = Line(StartPoint=item_3.Item, EndPoint=item_3.Item1)
pipe = Pipe(Curve=flatten(ln), Radius=flatten(avr), Caps=0)
preview = CustomPreview(Geometry=pipe, Material=ColourSwatch(SwatchColor=RGB(120, 120, 120)))

# ----
file = ReadFile(File=path, PerLineParse=True)
panel = Panel(file)

# ==== cluster CrystallonV2LTCXParser: Reads a LTCX file and outputs beams and radii

ltcx_file = ClusterInput()  # File path of .ltcx file
enable_beams = ClusterInput()  # Enable beam curves (boolean)
bool = Boolean(enable_beams)
file = ReadFile(F=ltcx_file, PerLineParse=True)  # -> C
#   port F: Uri of file to read
# ---------- file: VB line parser ----------
    action = GH_LineParserAction.Include
    Return line

    'Parse the line and return some data that represents the line.
    'If the line cannot be parsed, you can return Nothing and
    'assign a different action.
    'The default implementation is to just return the line itself.
    'If you return types that implement IGH_Goo, this component
    'will work substantially faster.
# ---------- end file ----------
fsim = FindSimilarMember(Data="</beamgroup>", Set=file)  # -> Hit, Index
# CRYSTALLON V2.0 -- Lattice structure tools for Grasshopper3D
# 
# Copyright (C) 2019  Aaron Porterfield
# 
# www.fequalsf.com
# info@fequalsf.com
# 
#     This program is free software: you can redistribute it and/or modify
#     it under the terms of the GNU General Public License as published by
#     the Free Software Foundation, either version 3 of the License, or any later version.
# 
#     This program is distributed in the hope that it will be useful,
#     but WITHOUT ANY WARRANTY; without even the implied warranty of
#     MERCHANTABILITY or FITNESS FOR A PARTICULAR PURPOSE.  See the
#     GNU General Public License for more details.
# 
#     You should have received a copy of the GNU General Public License
#     along with this program.  If not, see <http://www.gnu.org/licenses/>.
panel = Panel(file)
fsim_2 = FindSimilarMember(Data="<beamgroup>", Set=file)  # -> Hit, Index
fsim_3 = FindSimilarMember(Data="<nodegroup>", Set=file)  # -> Hit, Index
fsim_4 = FindSimilarMember(Data="</nodegroup>", Set=file)  # -> Hit, Index
subtraction = Subtraction(A=fsim.Index, B=fsim_2.Index)
subtraction_2 = Subtraction(A=fsim_4.Index, B=fsim_3.Index)
series = Series(Start=expr("x+1", fsim_2.Index), Step=1, Count=expr("x-1", subtraction))
series_2 = Series(Start=expr("x+1", fsim_3.Index), Step=1, Count=expr("x-1", subtraction_2))
item = ListItem(List=file, Index=series, Wrap=True)
item_2 = ListItem(List=file, Index=series_2, Wrap=True)
split = TextSplit(Text=item, Separators="\"\"")
split_2 = TextSplit(Text=item_2, Separators="\"\"")
panel_2 = Panel("LTCX Parser")
dispatch = Dispatch(List=split, DispatchPattern=[True, False])  # -> ListA, ListB
dispatch_2 = Dispatch(List=split_2, DispatchPattern=[True, False])  # -> ListA, ListB
item_3 = ListItem(List=dispatch.ListB, Index="0", Wrap=True)
item_4 = ListItem(List=dispatch.ListB, Index="1", Wrap=True)
item_5 = ListItem(List=dispatch_2.ListB, Index="0", Wrap=True)
item_6 = ListItem(List=dispatch_2.ListB, Index="1", Wrap=True)
item_7 = ListItem(List=dispatch.ListB, Index="2", Wrap=True)
item_8 = ListItem(List=dispatch_2.ListB, Index="2", Wrap=True)
item_9 = ListItem(List=dispatch_2.ListB, Index="3", Wrap=True)
item_10 = ListItem(List=dispatch_2.ListB, Index="4", Wrap=True)
node_id = Panel(item_5)
pt = ConstructPoint(XCoordinate=item_6, YCoordinate=item_8, ZCoordinate=item_9)  # -> flatten(Point)
end = Panel(item_7)
start = Panel(item_4)
beam_id = Panel(item_3)
radius = Panel(item_10)
num = Number(flatten(item_10))
pt_2 = Point(pt)
merge = Merge(Data1=item_4, Data2=item_7)  # -> simplify(Result)
item_11 = ListItem(List=item_10, Index=item_7, Wrap=True)
item_12 = ListItem(List=item_10, Index=item_4, Wrap=True)
item_13 = ListItem(List=pt, Index=item_4, Wrap=True)
item_14 = ListItem(List=pt, Index=item_7, Wrap=True)
num_2 = Number(item_12)
cull = CullPattern(List=item_14, CullPattern=bool)
num_3 = Number(item_11)
node_radius = ClusterOutput(num)  # Radius at node (number)
node = ClusterOutput(pt_2)  # Nodes (point)
ln = Line(StartPoint=item_13, EndPoint=cull)
line_point_connections = ClusterOutput(merge)  # Index of points that make up each beam
avr = Average(Input=[num_2, num_3])
line = Line(ln)
beam_radius = ClusterOutput(avr)  # Beam radius (average of two nodes)
beam_curves = ClusterOutput(line)  # Connections between nodes (line)
