# Grasshopper definition 04-INP B32.gh (Grasshopper 1.0.7)
# Copyright: ©2019 GNU General Public License

# ---- group: Geometry
planesrf = PlaneSurface(Plane=PlaneXY(0, 0, 0), XSize=Domain(-10, 10), YSize=Domain(-10, 10))
Z = UnitZ(Factor="20")
range = Range(Domain=Domain(0, 1), Steps=Slider(5, range=0..10))
move = Move(Geometry=planesrf, Motion=Z)  # -> Geometry, Transform
mbs = CrystallonV2MorphBetweenSurfaces(surfaces=[planesrf, move.Geometry], x_parameter=range, y_parameter=range, z_parameter=range)

# ---- group: Cell Fill
unit_cell_selector = CrystallonV2CellSelector({"Prim. Cubic": 0, "BC": 1, "BC Cubic": 2, "FC Cubic": 3, "Edge Octa.": 4, "Vertex Octa.": 5, "NaCl": 6, "Star Tet.": 7, "BC Star Tet.": 8, "Octa. Tet.": 9, "Dodecahedron": 10, "Trunc. Octa.": 11, "Tetrahedral": 12, "Auxetic": 13, "BC1 (tween)": 14, "BC2 (tween)": 15, "Octa. (shell)": 16, "Dodeca. (shell)": 17, "Trunc. Octa. (shell)": 18, "Gyroid (shell)": 19, "Cubic Center (shell)": 20, "Cubic Face (shell)": 21, "LH Square": 22, "LH Round": 23, "LH Square (shell)": 24, "LH Auxetic (shell)": 25, "MC Tri": 26, "MS Tri (shell)": 27, "MC Quad": 28, "MS Quad (shell)": 29}, selected="BC")
ct = CrystallonV2CellType(unit_cell_selector=unit_cell_selector)
clf = CrystallonV2CellLatticeFill(unit_cell=ct, voxels=mbs)

# ---- group: INP B32
b32 = CrystallonV2INPB32(filename="example", lattice_curves=clf, tolerance=".1", cross_section=Toggle(True), width=".5", height=".5")

# ----
panel = Panel(b32)

# ==== cluster CrystallonV2CellLatticeFill: Fill voxels with lattice unit cells

unit_cell = ClusterInput()  # Unit cell to populate voxels
voxels = ClusterInput()  # Voxels to be filled with unit cells
crv = Curve(unit_cell)
bbox = BoundingBox(Content=crv, Plane=PlaneXY(0, 0, 0), UnionBox=True)  # -> Box, Box_2
# CRYSTALLON V2.0 -- Lattice structure tools for Grasshopper3D
# 
# Copyright (C) 2019  Aaron Porterfield
# 
# www.fequalsf.com
# info@fequalsf.com
# 
#     This program is free software: you can redistribute it and/or modify
#     it under the terms of the GNU General Public License as published by
#     the Free Software Foundation, either version 3 of the License, or any later version.
# 
#     This program is distributed in the hope that it will be useful,
#     but WITHOUT ANY WARRANTY; without even the implied warranty of
#     MERCHANTABILITY or FITNESS FOR A PARTICULAR PURPOSE.  See the
#     GNU General Public License for more details.
# 
#     You should have received a copy of the GNU General Public License
#     along with this program.  If not, see <http://www.gnu.org/licenses/>.
panel = Panel("CELL FILL")
morph = BoxMorph(Geometry=crv, Reference=bbox.Box, Target=graft(voxels))  # -> flatten(Geometry)
remove_duplicate_lines = RemoveDuplicateLines(lattice_l=flatten(morph))
lattice = ClusterOutput(remove_duplicate_lines)  # List of curves that make up the lattice

# ==== cluster CrystallonV2CellType: A collection of pre-made unit cells

crv = Curve([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])
crv_2 = Curve([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])
crv_3 = Curve([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])
crv_4 = Curve([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])
crv_5 = Curve([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])
mesh = Mesh(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)
mesh_2 = Mesh(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)
mesh_3 = Mesh(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)
mesh_4 = Mesh([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])
crv_6 = Curve([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])
crv_7 = Curve([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])
crv_8 = Curve([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])
crv_9 = Curve([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])
crv_10 = Curve([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])
crv_11 = Curve([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])
crv_12 = Curve([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])
crv_13 = Curve([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])
crv_14 = Curve([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])
crv_15 = Curve([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])
crv_16 = Curve([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])
mesh_5 = Mesh(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)
mesh_6 = Mesh(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)
mesh_7 = Mesh(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)
mesh_8 = Mesh(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)
crv_17 = Curve([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])
crv_18 = Curve([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])
mesh_9 = Mesh(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)
geo = Geometry([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])
geo_2 = Geometry([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])
mesh_10 = Mesh([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])
panel = Panel("CELL TYPES")
entwine = Entwine(
    Branch00=crv_6,
    Branch01=crv_7,
    Branch02=crv,
    Branch03=crv_8,
    Branch04=crv_2,
    Branch05=crv_9,
    Branch06=crv_3,
    Branch07=crv_10,
    Branch08=crv_11,
    Branch09=crv_12,
    Branch010=crv_4,
    Branch011=crv_5,
    Branch012=crv_13,
    Branch013=crv_14,
    Branch014=crv_15,
    Branch015=crv_16,
    Branch016=mesh,
    Branch017=mesh_5,
    Branch018=mesh_6,
    Branch019=mesh_2,
    Branch020=mesh_7,
    Branch021=mesh_8,
    Branch022=crv_17,
    Branch023=crv_18,
    Branch024=mesh_9,
    Branch025=mesh_3,
    Branch026=geo,
    Branch027=mesh_4,
    Branch028=geo_2,
    Branch029=mesh_10,
    FlattenInputs=True)  # -> simplify(Result)
unit_cell_selector = ClusterInput()
branch = TreeBranch(Tree=entwine, Path=unit_cell_selector, MaintainPaths=True)
unit_cell = ClusterOutput(branch)  # Single unit cell to populate voxels

# ==== cluster CrystallonV2MorphBetweenSurfaces: Conformal fill of voxels between two or more surfaces

x_parameter = ClusterInput()  # Range of numbers (0-1) for X divisions
z_parameter = ClusterInput()  # Range of numbers (0-1) for Z divisions
surfaces = ClusterInput()  # At least 2 surfaces to morph voxels between
y_parameter = ClusterInput()  # Range of numbers (0-1) for Y divisions
srf = Surface(flatten(surfaces))
num = Number(y_parameter)
num_2 = Number(x_parameter)
num_3 = Number(z_parameter)
pt = ConstructPoint(XCoordinate=simplify(graft(num_2)), YCoordinate=simplify(num), ZCoordinate=0)  # -> simplify(Point)
lng = ListLength(List=num_2)
num_4 = Number(lng)
evalsrf = EvaluateSurface(Surface=reparameterize(simplify(srf)), Point=simplify(graft(pt)))  # -> simplify(Point), Normal, Frame
pline = PolyLine(Vertices=evalsrf.Point, Closed=False)
eval = EvaluateCurve(Curve=reparameterize(pline), Parameter=num_3)  # -> Point, Tangent, Angle
path_mapper = PathMapper(eval.Point, source="{A;B}(i)", target="{B;A}(i)")
path_mapper_2 = PathMapper(path_mapper, source="{A;B}", target="{path_index}")
toggle = BooleanToggle(False)
shift = ShiftList(List=path_mapper_2, Shift="1", Wrap=toggle)
shift_2 = ShiftList(List=path_mapper_2, Shift="-1", Wrap=toggle)
flip = FlipMatrix(Data=shift)
flip_2 = FlipMatrix(Data=shift_2)
partition = PartitionList(List=flip_2, Size=num_4)
partition_2 = PartitionList(List=flip, Size=num_4)
shift_3 = ShiftList(List=partition, Shift="-1", Wrap=toggle)  # -> simplify(List)
shift_4 = ShiftList(List=partition, Shift="1", Wrap=toggle)  # -> simplify(List)
shift_5 = ShiftList(List=partition_2, Shift="1", Wrap=toggle)  # -> simplify(List)
shift_6 = ShiftList(List=partition_2, Shift="-1", Wrap=toggle)  # -> simplify(List)
path_mapper_3 = PathMapper(shift_4, source="{A;B}(i)", target="{A;i}(B)")
path_mapper_4 = PathMapper(shift_3, source="{A;B}(i)", target="{A;i}(B)")
path_mapper_5 = PathMapper(shift_5, source="{A;B}(i)", target="{A;i}(B)")
path_mapper_6 = PathMapper(shift_6, source="{A;B}(i)", target="{A;i}(B)")
shift_7 = ShiftList(List=path_mapper_4, Shift="-1", Wrap=toggle)
shift_8 = ShiftList(List=path_mapper_3, Shift="1", Wrap=toggle)
shift_9 = ShiftList(List=path_mapper_3, Shift="-1", Wrap=toggle)
shift_10 = ShiftList(List=path_mapper_6, Shift="-1", Wrap=toggle)
shift_11 = ShiftList(List=path_mapper_4, Shift="1", Wrap=toggle)
shift_12 = ShiftList(List=path_mapper_5, Shift="1", Wrap=toggle)
shift_13 = ShiftList(List=path_mapper_5, Shift="-1", Wrap=toggle)
shift_14 = ShiftList(List=path_mapper_6, Shift="1", Wrap=toggle)
tbox = TwistedBox(
    CornerA=shift_11,
    CornerB=shift_7,
    CornerC=shift_9,
    CornerD=shift_8,
    CornerE=shift_14,
    CornerF=shift_10,
    CornerG=shift_13,
    CornerH=shift_12)
voxels = ClusterOutput(tbox)  # Voxels to be filled with unit cells

# ==== cluster CrystallonV2INPB32: Create a B32 INP file from a lattice

# ----
# *BEAM SECTION,MATERIAL=EL,ELSET=Eall,OFFSET1=-0.5,SECTION=RECT
filename = ClusterInput()  # Name of file (also NSET, ELSET, etc)
lattice_curves = ClusterInput()  # Lattice curves to create B32 elements
cross_section = ClusterInput()  # True if CIRC, false if RECT
tolerance = ClusterInput()  # Tolerance for combining nodes
height = ClusterInput()  # Height of cross section
width = ClusterInput()  # Width of cross section
txt = Text(filename)
line = Line(lattice_curves)
bool = Boolean(cross_section)
num = Number(width)
num_2 = Number(height)
num_3 = Number(tolerance)
lattice_topology = LatticeTopology(lattice_beams=line, tolerance=num_3)  # -> nodes, line_point_connections, point_line_connections
item = ListItem(List=lattice_topology.nodes, Index=lattice_topology.line_point_connections, Wrap=True)
avr = Average(Input=item)
entwine = Entwine(Branch00=lattice_topology.nodes, Branch01=avr, FlattenInputs=True)  # -> flatten(Result)
item_2 = ListItem(List=item, Index=0, Wrap=True)
pline = PolyLine(Vertices=item, Closed=False)  # -> flatten(Polyline)
end = EndPoints(Curve=pline)  # -> Start, End
lng = ListLength(List=flatten(item_2))
lng_2 = ListLength(List=entwine)
lng_3 = ListLength(List=lattice_topology.nodes)
lng_4 = ListLength(List=flatten(avr))
pl = PlaneNormal(Origin=end.End, ZAxis=pline)
Z = UnitZ(Factor=1)
series = Series(Start=0, Step=1, Count=lng_2)
devec = DeconstructVector(Vector=entwine)  # -> XComponent, YComponent, ZComponent
series_2 = Series(Start=0, Step=1, Count=lng)  # -> graft(Series)
item_3 = ListItem(List=lattice_topology.line_point_connections, Index=0, Wrap=True)  # -> Item, Item1
series_3 = Series(Start=lng_3, Step=1, Count=lng_4)
align = AlignPlane(Plane=pl, Direction=Z)  # -> Plane, Angle
addition = Addition(A=series, B=1)
devec_2 = DeconstructVector(Vector=align.Plane)  # -> XComponent, YComponent, ZComponent
addition_2 = Addition(A=series_2, B=1)
addition_3 = Addition(A=series_3, B=1)  # -> graft(Result)
addition_4 = Addition(A=item_3.Item, B=1)
addition_5 = Addition(A=item_3.Item1, B=1)
p_n_c = PickNChoose(Pattern=bool, Stream0="RECT", Stream1="CIRC")
format = Expression(x=txt, y=p_n_c, Expression="Format(\"*BEAM SECTION,MATERIAL=M{0},ELSET=E{0},SECTION={1}\", x, y)")
format_2 = Expression(
    x=addition_2,
    y=addition_4,
    z=graft(devec_2.XComponent),
    u=graft(devec_2.YComponent),
    v=graft(devec_2.ZComponent),
    Expression="Format(\" {0}, {1}, {2}, {3}, {4}\", x, y, Round (z, 3), Round (u, 3), Round (v, 3))")
format_3 = Expression(
    x=addition,
    y=devec.XComponent,
    z=devec.YComponent,
    u=devec.ZComponent,
    Expression="Format(\" {0}, {1}, {2}, {3}\", x, Round (y, 3), Round (z, 3), Round (u, 3))")
format_4 = Expression(x=num, y=num_2, Expression="Format(\"{0},{1}\", x, y)")
panel = Panel("*ELEMENT,TYPE=B32,ELSET=EAll")
format_5 = Expression(x=txt, Expression="Format(\"*ELEMENT,TYPE=B32,ELSET=E{0}\", x)")
format_6 = Expression(x=addition_2, y=addition_4, z=addition_3, u=addition_5, Expression="Format(\"{0}, {1}, {2}, {3}\", x, y, z, u)")
format_7 = Expression(x=txt, Expression="Format(\"*NODE,NSET=N{0}\", x)")
panel_2 = Panel("""** NORMAL = Element,Node,X,Y,Z
*NORMAL""")
format_8 = Expression(x=txt, Expression="Format(\"**FILENAME = {0}\", x)")
entwine_2 = Entwine(
    Branch00="**INP GENERATOR - CRYSTALLON ",
    Branch01=format_8,
    Branch02=format_7,
    Branch03=format_3,
    Branch04=format_5,
    Branch05=format_6,
    Branch06=panel_2,
    Branch07=format_2,
    Branch08=format,
    Branch010=format_4,
    FlattenInputs=True)  # -> flatten(Result)
inp_output = ClusterOutput(entwine_2)  # output text

# ==== cluster RemoveDuplicateLines
lattice_l = ClusterInput()
crv = Curve(lattice_l)
curvepoint = PointOnCurve(crv, parameter=0.5)
cullpt = CullDuplicates(Points=curvepoint, Tolerance=".001", CullMode=1)  # -> Points, Indices, Valence
item = ListItem(List=crv, Index=cullpt.Indices, Wrap=True)
lattice = ClusterOutput(item)

# ==== cluster LatticeTopology

tolerance = ClusterInput()  # Tolerance to merge points
lattice_beams = ClusterInput()  # Lattice Curves
num = Number(tolerance)
crv = Curve(lattice_beams)
cp = ControlPoints(Curve=crv)  # -> simplify(Points), Weights, Knots
cullpt = CullDuplicates(Points=flatten(cp.Points), Tolerance=num, CullMode=3)  # -> Points, Indices, Valence
sort_pt = SortPoints(Points=cullpt.Points)  # -> Points, Indices
lng = ListLength(List=sort_pt.Points)
lng_2 = ListLength(List=crv)
fsim = FindSimilarMember(Data=cp.Points, Set=sort_pt.Points)  # -> Hit, simplify(Index)
series = Series(Start=0, Step=1, Count=lng_2)  # -> simplify(Series)
series_2 = Series(Start=0, Step=1, Count=lng)  # -> simplify(Series)
# CRYSTALLON V1.0 -- Lattice structure tools for Grasshopper3D
# 
# Copyright (C) 2018  Aaron Porterfield
# 
# www.studiofathom.com
# www.fequalsf.com
# 
#     This program is free software: you can redistribute it and/or modify
#     it under the terms of the GNU General Public License as published by
#     the Free Software Foundation, either version 3 of the License, or any later version.
# 
#     This program is distributed in the hope that it will be useful,
#     but WITHOUT ANY WARRANTY; without even the implied warranty of
#     MERCHANTABILITY or FITNESS FOR A PARTICULAR PURPOSE.  See the
#     GNU General Public License for more details.
# 
#     You should have received a copy of the GNU General Public License
#     along with this program.  If not, see <http://www.gnu.org/licenses/>.
panel = Panel("LATTICE TOPOLOGY")
num_2 = Number(fsim.Index)
pt = Point(sort_pt.Points)
equals = Equality(FirstNumber=series_2, SecondNumber=graft(num_2))  # -> Equality, Inequality
flip = FlipMatrix(Data=equals.Equality)
partition = PartitionList(List=flip, Size="2")  # -> simplify(Chunks)
item = ListItem(List=partition, Index=0, Wrap=True)  # -> Item, Item1
or = GateOr(A=item.Item, B=item.Item1)
trim = TrimTree(Tree=or, Depth=1)
cull = CullPattern(List=series, CullPattern=trim)  # -> simplify(List)
nodes = ClusterOutput(pt)  # Unique points in the network
line_point_connections = ClusterOutput(num_2)  # Index of points that make up each beam
point_line_connections = ClusterOutput(cull)  # For each point, lists the index of each line connected to it
