# Grasshopper definition 05-INP S3 and S4.gh (Grasshopper 1.0.7)
# Copyright: ©2019 GNU General Public License

# ---- group: Geometry
planesrf = PlaneSurface(Plane=PlaneXY(0, 0, 0), XSize=Domain(-10, 10), YSize=Domain(-10, 10))
Z = UnitZ(Factor="20")
range = Range(Domain=Domain(0, 1), Steps=Slider(3, range=0..10))
move = Move(Geometry=planesrf, Motion=Z)  # -> Geometry, Transform
mbs = CrystallonV2MorphBetweenSurfaces(surfaces=[planesrf, move.Geometry], x_parameter=range, y_parameter=range, z_parameter=range)

# ---- group: Shell Fill (gyroid-quads)
unit_cell_selector = CrystallonV2CellSelector({"Prim. Cubic": 0, "BC": 1, "BC Cubic": 2, "FC Cubic": 3, "Edge Octa.": 4, "Vertex Octa.": 5, "NaCl": 6, "Star Tet.": 7, "BC Star Tet.": 8, "Octa. Tet.": 9, "Dodecahedron": 10, "Trunc. Octa.": 11, "Tetrahedral": 12, "Auxetic": 13, "BC1 (tween)": 14, "BC2 (tween)": 15, "Octa. (shell)": 16, "Dodeca. (shell)": 17, "Trunc. Octa. (shell)": 18, "Gyroid (shell)": 19, "Cubic Center (shell)": 20, "Cubic Face (shell)": 21, "LH Square": 22, "LH Round": 23, "LH Square (shell)": 24, "LH Auxetic (shell)": 25, "MC Tri": 26, "MS Tri (shell)": 27, "MC Quad": 28, "MS Quad (shell)": 29}, selected="Gyroid (shell)")
ct = CrystallonV2CellType(unit_cell_selector=unit_cell_selector)
csf = CrystallonV2CellShellFill(unit_cell_shell=ct, voxels=mbs, tolerance=".1")
medges = MeshEdges(Mesh=csf)  # -> NakedEdges, InteriorEdges, NonManifoldEdges
preview = CustomPreview(Geometry=csf, Material=ColourSwatch(SwatchColor=RGB(120, 120, 120)))

# ---- group: Triangulate Shell
tri = Triangulate(Mesh=csf)  # -> Mesh, Count
preview_2 = CustomPreview(Geometry=tri.Mesh, Material=ColourSwatch(SwatchColor=RGB(120, 120, 120)))
medges_2 = MeshEdges(Mesh=tri.Mesh)  # -> NakedEdges, InteriorEdges, NonManifoldEdges

# ---- group: S4
s4 = CrystallonV2INPS4(filename="s4example", lattice_shell_quads=csf, thickness=".5")

# ---- group: S3
s3 = CrystallonV2INPS3(filename="s3example", lattice_shell_triangles=tri.Mesh, thickness=".5")

# ----
panel = Panel(s4)
panel_2 = Panel(s3)

# ==== cluster CrystallonV2CellType: A collection of pre-made unit cells

crv = Curve([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])
crv_2 = Curve([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])
crv_3 = Curve([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])
crv_4 = Curve([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])
crv_5 = Curve([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])
mesh = Mesh(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)
mesh_2 = Mesh(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)
mesh_3 = Mesh(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)
mesh_4 = Mesh([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])
crv_6 = Curve([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])
crv_7 = Curve([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])
crv_8 = Curve([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])
crv_9 = Curve([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])
crv_10 = Curve([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])
crv_11 = Curve([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])
crv_12 = Curve([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])
crv_13 = Curve([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])
crv_14 = Curve([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])
crv_15 = Curve([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])
crv_16 = Curve([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])
mesh_5 = Mesh(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)
mesh_6 = Mesh(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)
mesh_7 = Mesh(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)
mesh_8 = Mesh(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)
crv_17 = Curve([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])
crv_18 = Curve([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])
mesh_9 = Mesh(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)
geo = Geometry([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])
geo_2 = Geometry([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])
mesh_10 = Mesh([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])
# CRYSTALLON V2.0 -- Lattice structure tools for Grasshopper3D
# 
# Copyright (C) 2019  Aaron Porterfield
# 
# www.fequalsf.com
# info@fequalsf.com
# 
#     This program is free software: you can redistribute it and/or modify
#     it under the terms of the GNU General Public License as published by
#     the Free Software Foundation, either version 3 of the License, or any later version.
# 
#     This program is distributed in the hope that it will be useful,
#     but WITHOUT ANY WARRANTY; without even the implied warranty of
#     MERCHANTABILITY or FITNESS FOR A PARTICULAR PURPOSE.  See the
#     GNU General Public License for more details.
# 
#     You should have received a copy of the GNU General Public License
#     along with this program.  If not, see <http://www.gnu.org/licenses/>.
panel = Panel("CELL TYPES")
entwine = Entwine(
    Branch00=crv_6,
    Branch01=crv_7,
    Branch02=crv,
    Branch03=crv_8,
    Branch04=crv_2,
    Branch05=crv_9,
    Branch06=crv_3,
    Branch07=crv_10,
    Branch08=crv_11,
    Branch09=crv_12,
    Branch010=crv_4,
    Branch011=crv_5,
    Branch012=crv_13,
    Branch013=crv_14,
    Branch014=crv_15,
    Branch015=crv_16,
    Branch016=mesh,
    Branch017=mesh_5,
    Branch018=mesh_6,
    Branch019=mesh_2,
    Branch020=mesh_7,
    Branch021=mesh_8,
    Branch022=crv_17,
    Branch023=crv_18,
    Branch024=mesh_9,
    Branch025=mesh_3,
    Branch026=geo,
    Branch027=mesh_4,
    Branch028=geo_2,
    Branch029=mesh_10,
    FlattenInputs=True)  # -> simplify(Result)
unit_cell_selector = ClusterInput()
branch = TreeBranch(Tree=entwine, Path=unit_cell_selector, MaintainPaths=True)
unit_cell = ClusterOutput(branch)  # Single unit cell to populate voxels

# ==== cluster CrystallonV2MorphBetweenSurfaces: Conformal fill of voxels between two or more surfaces

x_parameter = ClusterInput()  # Range of numbers (0-1) for X divisions
z_parameter = ClusterInput()  # Range of numbers (0-1) for Z divisions
surfaces = ClusterInput()  # At least 2 surfaces to morph voxels between
y_parameter = ClusterInput()  # Range of numbers (0-1) for Y divisions
srf = Surface(flatten(surfaces))
num = Number(y_parameter)
num_2 = Number(x_parameter)
num_3 = Number(z_parameter)
pt = ConstructPoint(XCoordinate=simplify(graft(num_2)), YCoordinate=simplify(num), ZCoordinate=0)  # -> simplify(Point)
lng = ListLength(List=num_2)
num_4 = Number(lng)
evalsrf = EvaluateSurface(Surface=reparameterize(simplify(srf)), Point=simplify(graft(pt)))  # -> simplify(Point), Normal, Frame
pline = PolyLine(Vertices=evalsrf.Point, Closed=False)
eval = EvaluateCurve(Curve=reparameterize(pline), Parameter=num_3)  # -> Point, Tangent, Angle
path_mapper = PathMapper(eval.Point, source="{A;B}(i)", target="{B;A}(i)")
path_mapper_2 = PathMapper(path_mapper, source="{A;B}", target="{path_index}")
toggle = BooleanToggle(False)
shift = ShiftList(List=path_mapper_2, Shift="1", Wrap=toggle)
shift_2 = ShiftList(List=path_mapper_2, Shift="-1", Wrap=toggle)
flip = FlipMatrix(Data=shift)
flip_2 = FlipMatrix(Data=shift_2)
partition = PartitionList(List=flip_2, Size=num_4)
partition_2 = PartitionList(List=flip, Size=num_4)
shift_3 = ShiftList(List=partition, Shift="-1", Wrap=toggle)  # -> simplify(List)
shift_4 = ShiftList(List=partition, Shift="1", Wrap=toggle)  # -> simplify(List)
shift_5 = ShiftList(List=partition_2, Shift="1", Wrap=toggle)  # -> simplify(List)
shift_6 = ShiftList(List=partition_2, Shift="-1", Wrap=toggle)  # -> simplify(List)
path_mapper_3 = PathMapper(shift_4, source="{A;B}(i)", target="{A;i}(B)")
path_mapper_4 = PathMapper(shift_3, source="{A;B}(i)", target="{A;i}(B)")
path_mapper_5 = PathMapper(shift_5, source="{A;B}(i)", target="{A;i}(B)")
path_mapper_6 = PathMapper(shift_6, source="{A;B}(i)", target="{A;i}(B)")
shift_7 = ShiftList(List=path_mapper_4, Shift="-1", Wrap=toggle)
shift_8 = ShiftList(List=path_mapper_3, Shift="1", Wrap=toggle)
shift_9 = ShiftList(List=path_mapper_3, Shift="-1", Wrap=toggle)
shift_10 = ShiftList(List=path_mapper_6, Shift="-1", Wrap=toggle)
shift_11 = ShiftList(List=path_mapper_4, Shift="1", Wrap=toggle)
shift_12 = ShiftList(List=path_mapper_5, Shift="1", Wrap=toggle)
shift_13 = ShiftList(List=path_mapper_5, Shift="-1", Wrap=toggle)
shift_14 = ShiftList(List=path_mapper_6, Shift="1", Wrap=toggle)
tbox = TwistedBox(
    CornerA=shift_11,
    CornerB=shift_7,
    CornerC=shift_9,
    CornerD=shift_8,
    CornerE=shift_14,
    CornerF=shift_10,
    CornerG=shift_13,
    CornerH=shift_12)
voxels = ClusterOutput(tbox)  # Voxels to be filled with unit cells

# ==== cluster CrystallonV2CellShellFill: Fill voxels with shell unit cells

unit_cell_shell = ClusterInput()  # Unit cell to populate voxels
tolerance = ClusterInput()  # Tolerance for merging faces and vertices (number usually between 0.001 and 0.1)
voxels = ClusterInput()  # Voxels to be filled with unit cells
geo = Geometry(unit_cell_shell)
bbox = BoundingBox(Content=geo, Plane=PlaneXY(0, 0, 0), UnionBox=True)  # -> Box, Box_2
morph = BoxMorph(Geometry=geo, Reference=bbox.Box, Target=graft(voxels))  # -> flatten(Geometry)
mjoin = MeshJoin(Meshes=morph)
panel = Panel("CELL SHELL FILL")
demesh = DeconstructMesh(Mesh=mjoin)  # -> Vertices, Faces, Colours, Normals
facen = FaceNormals(Mesh=mjoin)  # -> Centers, Normals
cullpt = CullDuplicates(Points=facen.Centers, Tolerance=tolerance, CullMode=1)  # -> Points, Indices, Valence
item = ListItem(List=demesh.Faces, Index=cullpt.Indices, Wrap=True)
conmesh = ConstructMesh(Vertices=demesh.Vertices, Faces=item)
weld = WeldMesh(Mesh=conmesh, Angle=3.141592654)
c_script = CSharpScript(M=weld, radius=tolerance)  # -> out, A; inputs M: Mesh, radius: Double
# ---------- c_script: C# usings ----------
using System.IO;
using System.Linq;
using System.Data;
using System.Drawing;
using System.Reflection;
using System.Windows.Forms;
using System.Xml;
using System.Xml.Linq;
using System.Runtime.InteropServices;

using Rhino.DocObjects;
using Rhino.Collections;
using GH_IO;
using GH_IO.Serialization;
# ---------- c_script: C# ----------
    Component.Message = "Weld Mesh - RTree";


    //Store naked mesh vertices and their ids
    List<Point3f> pts = new List<Point3f>();
    bool[] flag = M.GetNakedEdgePointStatus();

    allPointsFound = new List<List<int>>();

    //History is need to stop searching rtee
    //When all point groups are found
    history.Clear();

    //Create Rtree
    RTree tree = new RTree();

    for(int i = 0; i < flag.Length; i++){
      if(flag[i]){
        tree.Insert(M.Vertices[i], i);
        pts.Add(M.Vertices[i]);
      }
    }

    //Search RTree
    for(int i = 0; i < pts.Count; i++){
      tempIDList = new List<int>();
      tree.Search(new Sphere(pts[i], radius), method);

      if(tempIDList.Count > 1)
        allPointsFound.Add(tempIDList);

      if(history.Count == M.Vertices.Count)
        break;
    }

    //Now move found vertices to one of firs vertex position
    foreach(List<int> i in allPointsFound)
      for(int j = 1; j < i.Count; j++)
        M.Vertices[i[0]] = M.Vertices[i[j]];

    M.Vertices.CombineIdentical(true, true);


    A = M;
# ---------- c_script: C# additional code ----------
  //Rtree collections
  List<int> history = new List<int>();
  List<List<int>> allPointsFound;
  List<int> tempIDList;

  private void method(object sender, RTreeEventArgs e){
    if(!history.Contains(e.Id)){
      tempIDList.Add(e.Id);
      history.Add(e.Id);
    }
  }
# ---------- end c_script ----------
lattice_shell = ClusterOutput(c_script.A)  # Joined mesh that makes up the lattice

# ==== cluster CrystallonV2INPS4: Create a S4 INP file from a quad based shell

lattice_shell_quads = ClusterInput()  # Lattice shell to create S4 elements
thickness = ClusterInput()  # Thickness of cross section
filename = ClusterInput()  # Name of file (also NSET, ELSET, etc)
panel = Panel("shelltest")
mesh = Mesh(lattice_shell_quads)
num = Number(thickness)
demesh = DeconstructMesh(Mesh=mesh)  # -> Vertices, Faces, Colours, Normals
txt = Text(filename)
deface = DeconstructFace(Face=demesh.Faces)  # -> CornerA, CornerB, CornerC, CornerD
devec = DeconstructVector(Vector=demesh.Vertices)  # -> XComponent, YComponent, ZComponent
lng = ListLength(List=demesh.Vertices)
series = Series(Start=0, Step=1, Count=lng)
lng_2 = ListLength(List=flatten(deface.CornerA))
addition = Addition(A=series, B=1)
series_2 = Series(Start=0, Step=1, Count=lng_2)
addition_2 = Addition(A=series_2, B=1)  # -> graft(Result)
addition_3 = Addition(A=deface.CornerA, B=1)  # -> graft(Result)
addition_4 = Addition(A=deface.CornerB, B=1)  # -> graft(Result)
addition_5 = Addition(A=deface.CornerC, B=1)  # -> graft(Result)
addition_6 = Addition(A=deface.CornerD, B=1)  # -> graft(Result)
panel_2 = Panel("S4")
format = Expression(
    x=addition,
    y=devec.XComponent,
    z=devec.YComponent,
    u=devec.ZComponent,
    Expression="Format(\" {0}, {1}, {2}, {3}\", x, Round (y, 3), Round (z, 3), Round (u, 3))")
format_2 = Expression(x=txt, Expression="Format(\"*SHELL SECTION,MATERIAL=M{0},ELSET=E{0}\", x)")
format_3 = Expression(
    x=addition_2,
    y=addition_3,
    z=addition_4,
    u=addition_5,
    v=addition_6,
    Expression="Format(\"{0}, {1}, {2}, {3}, {4}\", x, y, z, u, v)")
format_4 = Expression(x=txt, Expression="Format(\"*ELEMENT,TYPE=S4,ELSET=E{0}\", x)")
format_5 = Expression(x=txt, Expression="Format(\"*NODE,NSET=N{0}\", x)")
format_6 = Expression(x=txt, Expression="Format(\"**FILENAME = {0}\", x)")
entwine = Entwine(
    Branch00="**INP GENERATOR - CRYSTALLON ",
    Branch01=format_6,
    Branch02=format_5,
    Branch03=format,
    Branch04=format_4,
    Branch05=format_3,
    Branch06=format_2,
    Branch07=num,
    FlattenInputs=True)  # -> flatten(Result)
inp_output = ClusterOutput(entwine)  # output text

# ==== cluster CrystallonV2INPS3: Create a S3 INP file from a triangle based shell

lattice_shell_triangles = ClusterInput()  # Lattice shell to create S3 elements
thickness = ClusterInput()  # Thickness of cross section
filename = ClusterInput()  # Name of file (also NSET, ELSET, etc)
mesh = Mesh(lattice_shell_triangles)
num = Number(thickness)
demesh = DeconstructMesh(Mesh=mesh)  # -> Vertices, Faces, Colours, Normals
txt = Text(filename)
deface = DeconstructFace(Face=demesh.Faces)  # -> CornerA, CornerB, CornerC, CornerD
devec = DeconstructVector(Vector=demesh.Vertices)  # -> XComponent, YComponent, ZComponent
lng = ListLength(List=demesh.Vertices)
series = Series(Start=0, Step=1, Count=lng)
lng_2 = ListLength(List=flatten(deface.CornerA))
addition = Addition(A=series, B=1)
series_2 = Series(Start=0, Step=1, Count=lng_2)
addition_2 = Addition(A=series_2, B=1)  # -> graft(Result)
addition_3 = Addition(A=deface.CornerA, B=1)  # -> graft(Result)
addition_4 = Addition(A=deface.CornerB, B=1)  # -> graft(Result)
addition_5 = Addition(A=deface.CornerC, B=1)  # -> graft(Result)
panel = Panel("S3")
format = Expression(
    x=addition,
    y=devec.XComponent,
    z=devec.YComponent,
    u=devec.ZComponent,
    Expression="Format(\" {0}, {1}, {2}, {3}\", x, Round (y, 3), Round (z, 3), Round (u, 3))")
format_2 = Expression(x=txt, Expression="Format(\"*SHELL SECTION,MATERIAL=M{0},ELSET=E{0}\", x)")
format_3 = Expression(x=txt, Expression="Format(\"*ELEMENT,TYPE=S3,ELSET=E{0}\", x)")
format_4 = Expression(x=addition_2, y=addition_3, z=addition_4, u=addition_5, Expression="Format(\"{0}, {1}, {2}, {3}\", x, y, z, u)")
format_5 = Expression(x=txt, Expression="Format(\"*NODE,NSET=N{0}\", x)")
format_6 = Expression(x=txt, Expression="Format(\"**FILENAME = {0}\", x)")
entwine = Entwine(
    Branch00="**INP GENERATOR - CRYSTALLON ",
    Branch01=format_6,
    Branch02=format_5,
    Branch03=format,
    Branch04=format_3,
    Branch05=format_4,
    Branch06=format_2,
    Branch07=num,
    FlattenInputs=True)  # -> flatten(Result)
inp_output = ClusterOutput(entwine)  # output text
