# Grasshopper definition 06-INP C3 Elements.gh (Grasshopper 1.0.7)
# Copyright: ©2019 GNU General Public License

# ---- group: Geometry
mesh = Mesh(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)
medges = MeshEdges(Mesh=mesh)  # -> NakedEdges, InteriorEdges, NonManifoldEdges
preview = CustomPreview(Geometry=mesh, Material=ColourSwatch(SwatchColor=RGB(120, 120, 120)))

# ---- group: Triangulate Shell
tri = Triangulate(Mesh=mesh)  # -> Mesh, Count
preview_2 = CustomPreview(Geometry=tri.Mesh, Material=ColourSwatch(SwatchColor=RGB(120, 120, 120)))
medges_2 = MeshEdges(Mesh=tri.Mesh)  # -> NakedEdges, InteriorEdges, NonManifoldEdges

# ----
mesh_2 = Mesh([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])
num = Number(Tree({0}: [169, 266, 271, 277], {1}: [175, 245, 253, 263], {2}: [192, 158, 254, 258], {3}: [60, 61, 228, 246], {4}: [10, 4, 180, 199], {5}: [191, 197, 202, 261]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))
pt = Point([Point(-3.905667305, -6.509445667, 6.509445667), Point(-1.400280118, -7.001400471, 7.001400471), Point(1.400280118, -7.001400471, 7.001400471), Point(-4.574956894, -4.574956894, 7.624928474), Point(-1.690308452, -5.070925713, 8.451542854), Point(1.690308452, -5.070925713, 8.451542854)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])

# ---- group: C3D8
c3d8 = CrystallonV2INPC3D8(filename="C3D8example", mesh_quads=mesh, thickness="1")

# ---- group: C3D6
c3d6 = CrystallonV2INPC3D6(filename="C3D6example", mesh_triangulated=tri.Mesh, thickness="1")

# ----
c3d4 = CrystallonV2INPC3D4(filename="C3D4example", indices=num, points=pt)
panel = Panel(c3d4)
panel_2 = Panel(c3d6)
panel_3 = Panel(c3d8)

# ==== cluster CrystallonV2INPC3D6: Creates a C3D6 INP file from a trianhulated mesh

mesh_triangulated = ClusterInput()  # Triangulated mesh to create C3D6 elements
thickness = ClusterInput()  # Thickness (offset) of elements
filename = ClusterInput()  # Name of file (also NSET, ELSET, etc)
mesh = Mesh(mesh_triangulated)
num = Number(thickness)
demesh = DeconstructMesh(Mesh=mesh)  # -> Vertices, Faces, Colours, Normals
# CRYSTALLON V2.0 -- Lattice structure tools for Grasshopper3D
# 
# Copyright (C) 2019  Aaron Porterfield
# 
# www.fequalsf.com
# info@fequalsf.com
# 
#     This program is free software: you can redistribute it and/or modify
#     it under the terms of the GNU General Public License as published by
#     the Free Software Foundation, either version 3 of the License, or any later version.
# 
#     This program is distributed in the hope that it will be useful,
#     but WITHOUT ANY WARRANTY; without even the implied warranty of
#     MERCHANTABILITY or FITNESS FOR A PARTICULAR PURPOSE.  See the
#     GNU General Public License for more details.
# 
#     You should have received a copy of the GNU General Public License
#     along with this program.  If not, see <http://www.gnu.org/licenses/>.
txt = Text(filename)
amp = Amplitude(Vector=demesh.Normals, Amplitude=num)
move = Move(Geometry=demesh.Vertices, Motion=amp)  # -> Geometry, Transform
conmesh = ConstructMesh(Vertices=move.Geometry, Faces=demesh.Faces)
demesh_2 = DeconstructMesh(Mesh=conmesh)  # -> Vertices, Faces, Colours, Normals
deface = DeconstructFace(Face=demesh.Faces)  # -> CornerA, CornerB, CornerC, CornerD
lng = ListLength(List=demesh_2.Vertices)
merge = Merge(Data1=demesh.Vertices, Data2=demesh_2.Vertices)  # -> flatten(Result)
lng_2 = ListLength(List=merge)
devec = DeconstructVector(Vector=merge)  # -> XComponent, YComponent, ZComponent
lng_3 = ListLength(List=flatten(deface.CornerA))
series = Series(Start=0, Step=1, Count=lng_2)
series_2 = Series(Start=0, Step=1, Count=lng_3)
addition = Addition(A=deface.CornerA, B=lng)
addition_2 = Addition(A=deface.CornerC, B=lng)
addition_3 = Addition(A=deface.CornerB, B=lng)
addition_4 = Addition(A=series, B=1)
addition_5 = Addition(A=series_2, B=1)  # -> graft(Result)
addition_6 = Addition(A=deface.CornerA, B=1)  # -> graft(Result)
addition_7 = Addition(A=deface.CornerB, B=1)  # -> graft(Result)
addition_8 = Addition(A=deface.CornerC, B=1)  # -> graft(Result)
addition_9 = Addition(A=addition, B=1)  # -> graft(Result)
addition_10 = Addition(A=addition_3, B=1)  # -> graft(Result)
addition_11 = Addition(A=addition_2, B=1)  # -> graft(Result)
panel = Panel("C3D6")
format = Expression(
    x=addition_4,
    y=devec.XComponent,
    z=devec.YComponent,
    u=devec.ZComponent,
    Expression="Format(\" {0}, {1}, {2}, {3}\", x, Round (y, 3), Round (z, 3), Round (u, 3))")
format_2 = Expression(
    x=addition_5,
    y=addition_6,
    z=addition_7,
    u=addition_8,
    v=addition_9,
    w=addition_10,
    a=addition_11,
    Expression="Format(\"{0}, {1}, {2}, {3}, {4}, {5}, {6}\", x, y, z, u, v, w, a)")
format_3 = Expression(x=txt, Expression="Format(\"*ELEMENT,TYPE=C3D6,ELSET=E{0}\", x)")
format_4 = Expression(x=txt, Expression="Format(\"*NODE,NSET=N{0}\", x)")
format_5 = Expression(x=txt, Expression="Format(\"**FILENAME = {0}\", x)")
entwine = Entwine(
    Branch00="**INP GENERATOR - CRYSTALLON ",
    Branch01=format_5,
    Branch02=format_4,
    Branch03=format,
    Branch04=format_3,
    Branch05=format_2,
    FlattenInputs=True)  # -> flatten(Result)
inp_output = ClusterOutput(entwine)  # output text

# ==== cluster CrystallonV2INPC3D8: Creates a C3D8 input file from a quad mesh

mesh_quads = ClusterInput()  # Quad mesh to create C3D8 elements
thickness = ClusterInput()  # Thickness (offset) of elements
filename = ClusterInput()  # Name of file (also NSET, ELSET, etc)
mesh = Mesh(mesh_quads)
num = Number(thickness)
demesh = DeconstructMesh(Mesh=mesh)  # -> Vertices, Faces, Colours, Normals
txt = Text(filename)
amp = Amplitude(Vector=demesh.Normals, Amplitude=num)
move = Move(Geometry=demesh.Vertices, Motion=amp)  # -> Geometry, Transform
conmesh = ConstructMesh(Vertices=move.Geometry, Faces=demesh.Faces)
demesh_2 = DeconstructMesh(Mesh=conmesh)  # -> Vertices, Faces, Colours, Normals
merge = Merge(Data1=demesh.Vertices, Data2=demesh_2.Vertices)  # -> flatten(Result)
deface = DeconstructFace(Face=demesh.Faces)  # -> CornerA, CornerB, CornerC, CornerD
lng = ListLength(List=demesh_2.Vertices)
lng_2 = ListLength(List=merge)
devec = DeconstructVector(Vector=merge)  # -> XComponent, YComponent, ZComponent
lng_3 = ListLength(List=flatten(deface.CornerA))
series = Series(Start=0, Step=1, Count=lng_2)
series_2 = Series(Start=0, Step=1, Count=lng_3)
addition = Addition(A=deface.CornerA, B=lng)
addition_2 = Addition(A=deface.CornerC, B=lng)
addition_3 = Addition(A=deface.CornerD, B=lng)
addition_4 = Addition(A=deface.CornerB, B=lng)
addition_5 = Addition(A=series, B=1)
addition_6 = Addition(A=addition, B=1)  # -> graft(Result)
addition_7 = Addition(A=series_2, B=1)  # -> graft(Result)
addition_8 = Addition(A=deface.CornerA, B=1)  # -> graft(Result)
addition_9 = Addition(A=deface.CornerB, B=1)  # -> graft(Result)
addition_10 = Addition(A=deface.CornerC, B=1)  # -> graft(Result)
addition_11 = Addition(A=deface.CornerD, B=1)  # -> graft(Result)
addition_12 = Addition(A=addition_4, B=1)  # -> graft(Result)
addition_13 = Addition(A=addition_2, B=1)  # -> graft(Result)
addition_14 = Addition(A=addition_3, B=1)  # -> graft(Result)
format = Expression(
    x=addition_5,
    y=devec.XComponent,
    z=devec.YComponent,
    u=devec.ZComponent,
    Expression="Format(\" {0}, {1}, {2}, {3}\", x, Round (y, 3), Round (z, 3), Round (u, 3))")
panel = Panel("C3D8")
format_2 = Expression(
    x=addition_7,
    y=addition_8,
    z=addition_9,
    u=addition_10,
    v=addition_11,
    w=addition_6,
    a=addition_12,
    b=addition_13,
    c=addition_14,
    Expression="Format(\"{0}, {1}, {2}, {3}, {4}, {5}, {6}, {7}, {8}\", x, y, z, u, v, w, a, b, c)")
format_3 = Expression(x=txt, Expression="Format(\"*ELEMENT,TYPE=C3D8,ELSET=E{0}\", x)")
format_4 = Expression(x=txt, Expression="Format(\"*NODE,NSET=N{0}\", x)")
format_5 = Expression(x=txt, Expression="Format(\"**FILENAME = {0}\", x)")
entwine = Entwine(
    Branch00="**INP GENERATOR - CRYSTALLON ",
    Branch01=format_5,
    Branch02=format_4,
    Branch03=format,
    Branch04=format_3,
    Branch05=format_2,
    FlattenInputs=True)  # -> flatten(Result)
inp_output = ClusterOutput(entwine)  # output text

# ==== cluster CrystallonV2INPC3D4: Creates a C3D4 INP file from a tetrahedral mesh (requires Tetrino https://www.food4rhino.com/app/tetrino)

# ----
# C3D4
# 
# REQUIRES TETRINO OR OTHER TETRAHEDRAL MESHER
# 
# https://www.food4rhino.com/app/tetrino
indices = ClusterInput()  # Indices of tetrahedrons ("I" output of Tetgen)
filename = ClusterInput()  # Name of file (also NSET, ELSET, etc)
points = ClusterInput()  # Points of tetrahedral mesh ("P" output of Tetgen)
pt = Point(points)
int = Integer(indices)
txt = Text(filename)
item = ListItem(List=int, Index=0, Wrap=True)  # -> flatten(Item), Item1, Item2, Item3
lng = ListLength(List=pt)
devec = DeconstructVector(Vector=pt)  # -> XComponent, YComponent, ZComponent
series = Series(Start=0, Step=1, Count=lng)
lng_2 = ListLength(List=flatten(item.Item))
series_2 = Series(Start=0, Step=1, Count=lng_2)
addition = Addition(A=series, B=1)
addition_2 = Addition(A=series_2, B=1)  # -> graft(Result)
addition_3 = Addition(A=item.Item, B=1)  # -> graft(Result)
addition_4 = Addition(A=item.Item1, B=1)  # -> graft(Result)
addition_5 = Addition(A=item.Item2, B=1)  # -> graft(Result)
addition_6 = Addition(A=item.Item3, B=1)  # -> graft(Result)
format = Expression(
    x=addition,
    y=devec.XComponent,
    z=devec.YComponent,
    u=devec.ZComponent,
    Expression="Format(\" {0}, {1}, {2}, {3}\", x, Round (y, 3), Round (z, 3), Round (u, 3))")
format_2 = Expression(
    x=addition_2,
    y=addition_3,
    z=addition_4,
    u=addition_5,
    v=addition_6,
    Expression="Format(\"{0}, {1}, {2}, {3}, {4}\", x, y, z, u, v)")
format_3 = Expression(x=txt, Expression="Format(\"*ELEMENT,TYPE=C3D4,ELSET=E{0}\", x)")
format_4 = Expression(x=txt, Expression="Format(\"*NODE,NSET=N{0}\", x)")
format_5 = Expression(x=txt, Expression="Format(\"**FILENAME = {0}\", x)")
entwine = Entwine(
    Branch00="**INP GENERATOR - CRYSTALLON ",
    Branch01=format_5,
    Branch02=format_4,
    Branch03=format,
    Branch04=format_3,
    Branch05=format_2,
    FlattenInputs=True)  # -> flatten(Result)
inp_output = ClusterOutput(entwine)  # output text
